# Grasshopper definition STUDIO V8_2021.06.15_New dataset.gh (Grasshopper 1.0.7)
# plug-ins: Heron, Bifocals, Human

boolean_toggle = BooleanToggle(True)

zoom_level = Slider(19, range=1..19)  # disabled
site = Panel("ORLY, France")  # disabled

# ----
# NOTE
note = Panel("")
panel = Panel("SITE")  # disabled
# KPF GH Standards
# Inputs
input_data = Panel("")
# USER INPUT
input_data_2 = Panel("")

# ---- group: X
min_panel_n_x = Panel("3")
length = Panel("4")
min_panel_n_x_2 = Panel("4")
min_panel_n_x_3 = Panel("5")
length_2 = Panel("5")
min_panel_n_x_4 = Panel("6")
length_3 = Panel("6")
min_panel_n_x_5 = Panel("7")
min_panel_n_x_6 = Panel("8")
min_panel_n_x_7 = Panel("9")
min_panel_n_x_8 = Panel("10")
min_panel_n_x_9 = Panel("11")
min_panel_n_x_10 = Panel("12")
length_4 = Panel("3")

# ---- group: Y
panel_n_y = Panel("3")
count = Panel("4")
panel_n_y_2 = Panel("4")
count_2 = Panel("5")
panel_n_y_3 = Panel("4")
count_3 = Panel("6")
panel_n_y_4 = Panel("5")
count_4 = Panel("5")
panel_n_y_5 = Panel("6")
panel_n_y_6 = Panel("7")
panel_n_y_7 = Panel("8")
panel_n_y_8 = Panel("9")
panel_n_y_9 = Panel("10")
# Raw
# Column
count_5 = Panel("3")

# ----
angle_step = Panel("10")
angle = Panel("360")

series = Series(Start=panel_n_y, Step=1, Count=count)
series_2 = Series(Start=panel_n_y_2, Step=1, Count=count_2)
series_3 = Series(Start=panel_n_y_3, Step=1, Count=count_3)
series_4 = Series(Start=panel_n_y_4, Step=1, Count=count_4)
series_5 = Series(Start=panel_n_y_5, Step=1, Count=count_4)
series_6 = Series(Start=panel_n_y_6, Step=1, Count=count_4)
series_7 = Series(Start=panel_n_y_7, Step=1, Count=count_4)
series_8 = Series(Start=panel_n_y_8, Step=1, Count=count)
series_9 = Series(Start=panel_n_y_9, Step=1, Count=count_5)
merge = Merge(
    Data1=series,
    Data2=series,
    Data3=series_2,
    Data4=series_3,
    Data5=series_4,
    Data6=series_5,
    Data7=series_6,
    Data8=series_7,
    Data9=series_8,
    Data10=series_9)
panel_2 = Panel(merge)

division = Division(A=angle, B=angle_step)

repeat_data = RepeatData(Data=min_panel_n_x, Length=length)
repeat_data_2 = RepeatData(Data=min_panel_n_x_2, Length=length)
repeat_data_3 = RepeatData(Data=min_panel_n_x_3, Length=length_2)
repeat_data_4 = RepeatData(Data=min_panel_n_x_4, Length=length_3)
repeat_data_5 = RepeatData(Data=min_panel_n_x_5, Length=length_2)
repeat_data_6 = RepeatData(Data=min_panel_n_x_6, Length=length_2)
repeat_data_7 = RepeatData(Data=min_panel_n_x_7, Length=length_2)
repeat_data_8 = RepeatData(Data=min_panel_n_x_8, Length=length_2)
repeat_data_9 = RepeatData(Data=min_panel_n_x_9, Length=length)
repeat_data_10 = RepeatData(Data=min_panel_n_x_10, Length=length_4)
merge_2 = Merge(
    Data1=repeat_data,
    Data2=repeat_data_2,
    Data3=repeat_data_3,
    Data4=repeat_data_4,
    Data5=repeat_data_5,
    Data6=repeat_data_6,
    Data7=repeat_data_7,
    Data8=repeat_data_8,
    Data9=repeat_data_9,
    Data10=repeat_data_10)
panel_3 = Panel(merge_2)

# ----
# OUTPUT
# NUMERIC DATA
action_panel = Panel("")
button = Button()
series_10 = Series(Start=0, Step=angle_step, Count=division)
list_length = ListLength(List=panel_2)
list_length_2 = ListLength(List=series_10)
panel_4 = Panel(series_10)
# OUTPUT
# GEOMETRY
geometry = Panel("")
multiplication = Multiplication(A=list_length_2, B=list_length)
dataset_n = Panel(multiplication)
integer = Integer(dataset_n)
# OPTIMIZATION
# SOLVER
result_panel = Panel("")
repeat_data_11 = RepeatData(Data=series_10, Length=integer)
sort_list = SortList(Keys=repeat_data_11)  # -> Keys, ValuesValuesA
panel_5 = Panel(sort_list.Keys)
# ANIMATE ME!!
number_slider = Slider(0, range=0..1655)
list_item = ListItem(List=panel_5, Index=number_slider, Wrap=True)
list_item_2 = ListItem(List=panel_3, Index=number_slider, Wrap=True)
list_item_3 = ListItem(List=panel_2, Index=number_slider, Wrap=True)
panel_n_x = Panel(list_item_2)
panel_n_y_10 = Panel(list_item_3)
rotation_degree = Panel(list_item)
X = Integer(panel_n_x)
Y = Integer(panel_n_y_10)

# ----
# 1
# 0
# 2
# 5
# 3
# 4
# 10
# 6
# 16
# 11
# 17
# 21
# 27
# 22
# 28
# 34
# 39
# 43
total_wall = Panel("8")
total_win = Panel("4")
total_wall_2 = Panel("10")
total_win_2 = Panel("4")
interior_wall_length = Panel("3.7")
honeyb_close = Curve([<curve referenced from the Rhino model> x4])
honeyb_open = Curve([<curve referenced from the Rhino model> x4])
honeyb_close_2 = Curve([<curve referenced from the Rhino model> x4])
honeyb_open_2 = Curve([<curve referenced from the Rhino model> x4])
total_wall_3 = Panel("10")
total_win_3 = Panel("6")
interior_wall_length_2 = Panel("5")
total_wall_4 = Panel("10")
total_win_4 = Panel("8")
interior_wall_length_3 = Panel("5")
interior_wall_length_4 = Panel("3.7")
total_wall_5 = Panel("8")
total_win_5 = Panel("6")
total_wall_6 = Panel("12")
total_win_6 = Panel("6")
total_wall_7 = Panel("13")
total_win_7 = Panel("7")
honeyb_close_3 = Curve([<curve referenced from the Rhino model> x4])
interior_wall_length_5 = Panel("8.5")
interior_wall_length_6 = Panel("8.5")
total_wall_8 = Panel("11")
total_win_8 = Panel("5")
honeyb_open_3 = Curve([<curve referenced from the Rhino model> x4])
interior_wall_length_7 = Panel("3.7")
total_wall_9 = Panel("13")
total_win_9 = Panel("8")
interior_wall_length_8 = Panel("12.5")
total_wall_10 = Panel("14")
total_win_10 = Panel("8.5")
total_wall_11 = Panel("13")
total_win_11 = Panel("11")
interior_wall_length_9 = Panel("17.8")
interior_wall_length_10 = Panel("17.8")
total_wall_12 = Panel("13")
total_win_12 = Panel("11")
interior_wall_length_11 = Panel("13.4")
terrasse_m2 = Panel("7.8")
total_wall_13 = Panel("11")
total_win_13 = Panel("7")
interior_wall_length_12 = Panel("8.5")
total_wall_14 = Panel("14")
total_win_14 = Panel("8")
interior_wall_length_13 = Panel("13.3")
total_wall_15 = Panel("12")
total_win_15 = Panel("8")
total_wall_16 = Panel("13")
total_win_16 = Panel("11")
total_wall_17 = Panel("13")
total_win_17 = Panel("13")
interior_wall_length_14 = Panel("14.6")
interior_wall_length_15 = Panel("8.5")
interior_wall_length_16 = Panel("19")
interior_wall_length_17 = Panel("19")
total_wall_18 = Panel("13")
total_win_18 = Panel("13")
terrasse_m2_2 = Panel("9.3")
interior_wall_length_18 = Panel("19")
total_wall_19 = Panel("16")
total_win_19 = Panel("12")
terrasse_m2_3 = Panel("9.3")
total_wall_20 = Panel("14")
total_win_20 = Panel("10")
total_wall_21 = Panel("15")
total_win_21 = Panel("13")
total_win_22 = Panel("12")
total_wall_22 = Panel("14")
interior_wall_length_19 = Panel("24.9")
interior_wall_length_20 = Panel("19.1")
interior_wall_length_21 = Panel("17.9")
interior_wall_length_22 = Panel("24.9")
total_wall_23 = Panel("15")
total_win_23 = Panel("13")
terrasse_m2_4 = Panel("10.8")
total_wall_24 = Panel("16")
total_win_24 = Panel("14")
terrasse_m2_5 = Panel("10.8")
interior_wall_length_23 = Panel("24.9")
total_wall_25 = Panel("15")
total_win_25 = Panel("13")
terrasse_m2_6 = Panel("9.5")
interior_wall_length_24 = Panel("24.9")
total_wall_26 = Panel("13")
total_win_26 = Panel("13")
terrasse_m2_7 = Panel("9.5")
interior_wall_length_25 = Panel("19.1")
total_wall_27 = Panel("16")
total_win_27 = Panel("13")
terrasse_m2_8 = Panel("24")
interior_wall_length_26 = Panel("24.9")
total_wall_28 = Panel("17")
total_win_28 = Panel("14")
terrasse_m2_9 = Panel("24")
interior_wall_length_27 = Panel("24.9")
total_wall_29 = Panel("14")
total_win_29 = Panel("22")
interior_wall_length_28 = Panel("45.3")
interior_wall_length_29 = Panel("27")
total_wall_30 = Panel("15")
total_win_30 = Panel("15")
terrasse_m2_10 = Panel("9.5")
total_wall_31 = Panel("16")
total_win_31 = Panel("15")
terrasse_m2_11 = Panel("25.5")
interior_wall_length_30 = Panel("27")
total_win_32 = Panel("16")
terrasse_m2_12 = Panel("26")
total_wall_32 = Panel("16")
interior_wall_length_31 = Panel("26.5")
total_wall_33 = Panel("15")
total_win_33 = Panel("22")
terrasse_m2_13 = Panel("17")
interior_wall_length_32 = Panel("46.5")
total_wall_34 = Panel("14")
total_win_34 = Panel("23")
terrasse_m2_14 = Panel("16.8")
interior_wall_length_33 = Panel("45.3")
total_wall_35 = Panel("14")
total_win_35 = Panel("22")
interior_wall_length_34 = Panel("45.3")
total_wall_36 = Panel("15")
total_win_36 = Panel("22")
terrasse_m2_15 = Panel("15")
total_wall_37 = Panel("16")
total_win_37 = Panel("22")
terrasse_m2_16 = Panel("29.5")
interior_wall_length_35 = Panel("45.3")
interior_wall_length_36 = Panel("45.3")
interior_wall_length_37 = Panel("46.5")
interior_wall_length_38 = Panel("47.7")
total_wall_38 = Panel("17")
total_win_38 = Panel("23")
terrasse_m2_17 = Panel("32.4")
total_wall_39 = Panel("17")
total_win_39 = Panel("24")
total_wall_40 = Panel("14")
total_win_40 = Panel("23")
terrasse_m2_18 = Panel("16.5")
total_wall_41 = Panel("15")
total_win_41 = Panel("25")
terrasse_m2_19 = Panel("33.5")
interior_wall_length_39 = Panel("46.5")
total_wall_42 = Panel("29")
total_win_42 = Panel("15")
interior_wall_length_40 = Panel("46.5")
interior_wall_length_41 = Panel("77.6")
total_wall_43 = Panel("28")
total_win_43 = Panel("18")
terrasse_m2_20 = Panel("35")
interior_wall_length_42 = Panel("78.8")
total_wall_44 = Panel("16")
total_win_44 = Panel("26")
terrasse_m2_21 = Panel("36.5")
interior_wall_length_43 = Panel("47.7")
total_wall_45 = Panel("28")
total_win_45 = Panel("16")
total_wall_46 = Panel("28")
total_win_46 = Panel("20")
interior_wall_length_44 = Panel("78.8")
interior_wall_length_45 = Panel("81.2")

# ---- group: 3 x 3 / Glass
crv = Curve([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])

# ---- group: 3 x 3 / Profile
crv_2 = Curve([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])

# ---- group: 3 x 3 / Boundary
crv_3 = Curve(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)

# ---- group: 3 x 3 / Facade
crv_4 = Curve([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])

# ---- group: 4 x 3 / Interior
crv_5 = Curve([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])

# ---- group: 4 x 3 / Facade
crv_6 = Curve([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])

# ---- group: 4 x 3 / Glass
crv_7 = Curve([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])

# ---- group: 4 x 3 / Profile
crv_8 = Curve([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])

# ---- group: 4 x 3 / Boundary
crv_9 = Curve(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)

# ----
honeyb_close_4 = Curve([<curve referenced from the Rhino model> x5])
honeyb_open_4 = Curve([<curve referenced from the Rhino model> x5])

# ---- group: 5 x 3 / Boundary
crv_10 = Curve(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)

# ---- group: 5 x 3 / Glass
crv_11 = Curve([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])

# ---- group: 5 x 3 / Interior
crv_12 = Curve([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])

# ---- group: 5 x 3 / Facade
crv_13 = Curve([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])

# ---- group: 5 x 3 / Profile
crv_14 = Curve([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])

# ----
honeyb_close_5 = Curve([<curve referenced from the Rhino model> x4])

# ---- group: 6 x 3 / Glass
crv_15 = Curve([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])

# ---- group: 6 x 3 / Profile
crv_16 = Curve([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])

# ----
honeyb_open_5 = Curve([<curve referenced from the Rhino model> x4])

# ---- group: 6 x 3 / Boundary
crv_17 = Curve(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)

# ---- group: 6 x 3 / Interior
crv_18 = Curve([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])

# ---- group: 6 x 3 / Facade
crv_19 = Curve([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])

# ---- group: 5 x 4 / Profile
crv_20 = Curve([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])

# ---- group: 5 x 4 / Interior
crv_21 = Curve([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])

# ---- group: 5 x 4 / Facade
crv_22 = Curve([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])

# ---- group: 5 x 4 / Glass
crv_23 = Curve([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])

# ---- group: 5 x 4 / Boundary
crv_24 = Curve(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)

# ---- group: 3 x 4 / Glass
crv_25 = Curve([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])

# ---- group: 3 x 4 / Profile
crv_26 = Curve([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])

# ----
honeyb_close_6 = Curve([<curve referenced from the Rhino model> x4])

# ---- group: 3 x 4 / Interior
crv_27 = Curve([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])

# ---- group: 3 x 4 / Facade
crv_28 = Curve([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])

# ---- group: 3 x 4 / Boundary
crv_29 = Curve(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)

# ----
honeyb_open_6 = Curve([<curve referenced from the Rhino model> x4])
honeyb_close_7 = Curve([<curve referenced from the Rhino model> x4])

# ---- group: 6 x 4 / Glass
crv_30 = Curve([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])

# ---- group: 6 x 4 / Profile
crv_31 = Curve([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])

# ----
honeyb_open_7 = Curve([<curve referenced from the Rhino model> x4])

# ---- group: 6 x 4 / Boundary
crv_32 = Curve(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)

# ---- group: 6 x 4 / Interior
crv_33 = Curve([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])

# ---- group: 6 x 4 / Facade
crv_34 = Curve([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])

# ----
honeyb_close_8 = Curve([<curve referenced from the Rhino model> x4])
honeyb_open_8 = Curve([<curve referenced from the Rhino model> x4])

# ---- group: 4 x 4 / Interior
crv_35 = Curve([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])

# ---- group: 4 x 4 / Facade
crv_36 = Curve([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])

# ---- group: 4 x 4 / Profile
crv_37 = Curve([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])

# ---- group: 4 x 4 / Boundary
crv_38 = Curve(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)

# ---- group: 4 x 4 / Glass
crv_39 = Curve([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])

# ---- group: 5 x 5 / Boundary
crv_40 = Curve(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)

# ---- group: 5 x 5 / Interior
crv_41 = Curve([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])

# ---- group: 5 x 5 / Glass
crv_42 = Curve([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])

# ---- group: 5 x 5 / Profile
crv_43 = Curve([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])

# ---- group: 5 x 5 / Facade
crv_44 = Curve([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])

# ----
honeyb_close_9 = Curve([<curve referenced from the Rhino model> x4])
honeyb_open_9 = Curve([<curve referenced from the Rhino model> x4])
honeyb_close_10 = Curve([<curve referenced from the Rhino model> x5])
honeyb_open_10 = Curve([<curve referenced from the Rhino model> x5])
honeyb_close_11 = Curve([<curve referenced from the Rhino model> x5])
honeyb_open_11 = Curve([<curve referenced from the Rhino model> x5])

# ---- group: 6 x 5 / Glass
crv_45 = Curve([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])

# ---- group: 6 x 5 / Profile
crv_46 = Curve([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])

# ---- group: 7 x 5 / Boundary
crv_47 = Curve(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)

# ---- group: 7 x 5 / Glass
crv_48 = Curve([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])

# ---- group: 7 x 5 / Profile
crv_49 = Curve([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])

# ---- group: 6 x 5 / Boundary
crv_50 = Curve(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)

# ---- group: 6 x 5 / Interior
crv_51 = Curve([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])

# ---- group: 6 x 5 / Facade
crv_52 = Curve([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])

# ----
honeyb_close_12 = Curve([<curve referenced from the Rhino model> x5])

# ---- group: 7 x 5 / Interior
crv_53 = Curve([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])

# ---- group: 7 x 5 / Facade
crv_54 = Curve([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])

# ----
honeyb_open_12 = Curve([<curve referenced from the Rhino model> x5])

# ---- group: 8 x 5 / Boundary
crv_55 = Curve(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)

# ----
honeyb_close_13 = Curve([<curve referenced from the Rhino model> x4])

# ---- group: 8 x 5 / Glass
crv_56 = Curve([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])

# ---- group: 8 x 5 / Profile
crv_57 = Curve([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])

# ---- group: 8 x 5 / Interior
crv_58 = Curve([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])

# ---- group: 8 x 5 / Facade
crv_59 = Curve([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])

# ---- group: 4 x 5 / Glass
crv_60 = Curve([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])

# ----
honeyb_open_13 = Curve([<curve referenced from the Rhino model> x4])

# ---- group: 4 x 5 / Boundary
crv_61 = Curve(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)

# ---- group: 4 x 5 / Interior
crv_62 = Curve([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])

# ---- group: 4 x 5 / Facade
crv_63 = Curve([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])

# ---- group: 4 x 5 / Profile
crv_64 = Curve([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])

# ---- group: 5 x 6 / Interior
crv_65 = Curve([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])

# ---- group: 5 x 6 / Glass
crv_66 = Curve([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])

# ---- group: 5 x 6 / Facade
crv_67 = Curve([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])

# ---- group: 5 x 6 / Profile
crv_68 = Curve([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])

# ---- group: 5 x 6 / Boundary
crv_69 = Curve(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)

# ----
honeyb_close_14 = Curve([<curve referenced from the Rhino model> x5])
honeyb_open_14 = Curve([<curve referenced from the Rhino model> x5])

# ---- group: 6 x 6 / Glass
crv_70 = Curve([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])

# ---- group: 6 x 6 / Interior
crv_71 = Curve([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])

# ---- group: 6 x 6 / Facade
crv_72 = Curve([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])

# ---- group: 6 x 6 / Profile
crv_73 = Curve([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])

# ---- group: 4 x 6 / Facade
crv_74 = Curve([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])

# ---- group: 6 x 6 / Boundary
crv_75 = Curve(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)

# ---- group: 7 x 6 / Profile
crv_76 = Curve([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])

# ---- group: 7 x 6 / Interior
crv_77 = Curve([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])

# ---- group: 7 x 6 / Facade
crv_78 = Curve([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])

# ---- group: 7 x 6 / Boundary
crv_79 = Curve(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)

# ---- group: 7 x 6 / Glass
crv_80 = Curve([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])

# ---- group: 4 x 6 / Glass
crv_81 = Curve([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])

# ---- group: 4 x 6 / Interior
crv_82 = Curve([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])

# ---- group: 4 x 6 / Profile
crv_83 = Curve([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])

# ----
honeyb_close_15 = Curve([<curve referenced from the Rhino model> x4])
honeyb_close_16 = Curve([<curve referenced from the Rhino model> x7])

# ---- group: 4 x 6 / Boundary
crv_84 = Curve(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)

# ----
honeyb_open_15 = Curve([<curve referenced from the Rhino model> x4])
honeyb_open_16 = Curve([<curve referenced from the Rhino model> x7])
honeyb_close_17 = Curve([<curve referenced from the Rhino model> x6])
honeyb_open_17 = Curve([<curve referenced from the Rhino model> x6])
honeyb_close_18 = Curve([<curve referenced from the Rhino model> x5])
honeyb_open_18 = Curve([<curve referenced from the Rhino model> x5])
honeyb_close_19 = Curve([<curve referenced from the Rhino model> x4])
honeyb_open_19 = Curve([<curve referenced from the Rhino model> x4])

# ---- group: 8 x 6 / Profile
crv_85 = Curve([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])

# ---- group: 8 x 6 / Interior
crv_86 = Curve([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])

# ---- group: 8 x 6 / Facade
crv_87 = Curve([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])

# ---- group: 8 x 6 / Glass
crv_88 = Curve([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])

# ---- group: 8 x 6 / Boundary
crv_89 = Curve(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)

# ---- group: 9 x 6 / Interior
crv_90 = Curve([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])

# ---- group: 9 x 6 / Boundary
crv_91 = Curve(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)

# ---- group: 9 x 6 / Glass
crv_92 = Curve([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])

# ---- group: 9 x 6 / Profile
crv_93 = Curve([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])

# ---- group: 9 x 6 / Facade
crv_94 = Curve([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])

# ---- group: 5 x 7 / Glass
crv_95 = Curve([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])

# ---- group: 5 x 7 / Profile
crv_96 = Curve([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])

# ---- group: 5 x 7 / Interior
crv_97 = Curve([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])

# ---- group: 5 x 7 / Facade
crv_98 = Curve([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])

# ---- group: 5 x 7 / Boundary
crv_99 = Curve(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)

# ---- group: 6 x 7 / Glass
crv_100 = Curve([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])

# ---- group: 6 x 7 / Profile
crv_101 = Curve([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])

# ---- group: 7 x 7 / Interior
crv_102 = Curve([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])

# ---- group: 7 x 7 / Profile
crv_103 = Curve([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])

# ---- group: 6 x 7 / Boundary
crv_104 = Curve(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)

# ---- group: 6 x 7 / Interior
crv_105 = Curve([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])

# ---- group: 6 x 7 / Facade
crv_106 = Curve([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])

# ---- group: 7 x 7 / Facade
crv_107 = Curve([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])

# ----
honeyb_close_20 = Curve([<curve referenced from the Rhino model> x6])

# ---- group: 7 x 7 / Boundary
crv_108 = Curve(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)

# ---- group: 7 x 7 / Glass
crv_109 = Curve([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])

# ----
honeyb_open_20 = Curve([<curve referenced from the Rhino model> x6])
honeyb_close_21 = Curve([<curve referenced from the Rhino model> x8])
honeyb_open_21 = Curve([<curve referenced from the Rhino model> x8])
honeyb_close_22 = Curve([<curve referenced from the Rhino model> x5])
honeyb_open_22 = Curve([<curve referenced from the Rhino model> x5])
honeyb_close_23 = Curve([<curve referenced from the Rhino model> x6])
honeyb_open_23 = Curve([<curve referenced from the Rhino model> x6])

# ---- group: 8 x 7 / Boundary
crv_110 = Curve(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)

# ---- group: 8 x 7 / Glass
crv_111 = Curve([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])

# ---- group: 8 x 7 / Profile
crv_112 = Curve([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])

# ---- group: 8 x 7 / Interior
crv_113 = Curve([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])

# ---- group: 8 x 7 / Facade
crv_114 = Curve([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])

# ----
panel_6 = Panel("PRE-FAB MODELS")
honeyb_close_24 = Curve([<curve referenced from the Rhino model> x6])

# ---- group: 9 x 7 / Boundary
crv_115 = Curve(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)

# ---- group: 9 x 7 / Interior
crv_116 = Curve([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])

# ---- group: 9 x 7 / Glass
crv_117 = Curve([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])

# ---- group: 9 x 7 / Profile
crv_118 = Curve([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])

# ---- group: 9 x 7 / Facade
crv_119 = Curve([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])

# ----
honeyb_open_24 = Curve([<curve referenced from the Rhino model> x6])

# ---- group: 7 x 8 / Boundary
crv_120 = Curve(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)

# ---- group: 7 x 8 / Glass
crv_121 = Curve([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])

# ---- group: 7 x 8 / Profile
crv_122 = Curve([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])

# ---- group: 7 x 8 / Interior
crv_123 = Curve([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])

# ---- group: 7 x 8 / Facade
crv_124 = Curve([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])

# ----
honeyb_close_25 = Curve([<curve referenced from the Rhino model> x8])
honeyb_open_25 = Curve([<curve referenced from the Rhino model> x8])
honeyb_close_26 = Curve([<curve referenced from the Rhino model> x5])

# ---- group: 6 x 8 / Interior
crv_125 = Curve([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])

# ---- group: 6 x 8 / Boundary
crv_126 = Curve(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)

# ---- group: 6 x 8 / Facade
crv_127 = Curve([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])

# ---- group: 6 x 8 / Glass
crv_128 = Curve([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])

# ---- group: 6 x 8 / Profile
crv_129 = Curve([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])

# ----
honeyb_open_26 = Curve([<curve referenced from the Rhino model> x5])
honeyb_close_27 = Curve([<curve referenced from the Rhino model> x6])

# ---- group: 8 x 8 / Boundary
crv_130 = Curve(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)

# ---- group: 8 x 8 / Facade
crv_131 = Curve([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])

# ---- group: 8 x 8 / Profile
crv_132 = Curve([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])

# ---- group: 8 x 8 / Interior
crv_133 = Curve([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])

# ---- group: Glass
crv_134 = Curve([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])

# ----
honeyb_open_27 = Curve([<curve referenced from the Rhino model> x6])

# ---- group: 9 x 8 / Boundary
crv_135 = Curve(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)

# ---- group: 9 x 8 / Interior
crv_136 = Curve([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])

# ---- group: 9 x 8 / Glass
crv_137 = Curve([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])

# ---- group: 9 x 8 / Profile
crv_138 = Curve([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])

# ----
honeyb_close_28 = Curve([<curve referenced from the Rhino model> x6])

# ---- group: 9 x 8 / Facade
crv_139 = Curve([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])

# ----
honeyb_open_28 = Curve([<curve referenced from the Rhino model> x6])
honeyb_close_29 = Curve([<curve referenced from the Rhino model> x7])
honeyb_open_29 = Curve([<curve referenced from the Rhino model> x7])

# ---- group: 10 x 8 / Interior
crv_140 = Curve([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])

# ---- group: 10 x 8 / Glass
crv_141 = Curve([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])

# ---- group: 10 x 8 / Profile
crv_142 = Curve([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])

# ---- group: 10 x 8 / Facade
crv_143 = Curve([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])

# ---- group: 10 x 8 / Boundary
crv_144 = Curve(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)

# ----
honeyb_close_30 = Curve([<curve referenced from the Rhino model> x8])
honeyb_open_30 = Curve([<curve referenced from the Rhino model> x8])

# ---- group: 7 x 9 / Boundary
crv_145 = Curve(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)

# ---- group: 7 x 9 / Interior
crv_146 = Curve([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])

# ---- group: 7 x 9 / Facade
crv_147 = Curve([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])

# ---- group: 7 x 9 / Glass
crv_148 = Curve([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])

# ---- group: 7 x 9 / Profile
crv_149 = Curve([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])

# ----
curve = Curve(<curve referenced from the Rhino model>)
explode = Explode(Curve=curve, Recursive=True)  # -> Segments, Vertices
boundary_surfaces = BoundarySurfaces(Edges=explode.Segments)

# ---- group: 8 x 9 / Glass
crv_150 = Curve([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])

# ---- group: 8 x 9 / Profile
crv_151 = Curve([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])

# ---- group: 8 x 9 / Interior
crv_152 = Curve([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])

# ---- group: 8 x 9 / Facade
crv_153 = Curve([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])

# ---- group: 8 x 9 / Boundary
crv_154 = Curve(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)

# ----
panel_7 = Panel("SITE")
honeyb_close_31 = Curve([<curve referenced from the Rhino model> x9])
honeyb_open_31 = Curve([<curve referenced from the Rhino model> x9])
honeyb_close_32 = Curve([<curve referenced from the Rhino model> x6])

# ---- group: 9 x 9 / Boundary
crv_155 = Curve(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)

# ---- group: 9 x 9 / Interior
crv_156 = Curve([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])

# ---- group: 9 x 9 / Glass
crv_157 = Curve([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])

# ---- group: 9 x 9 / Profile
crv_158 = Curve([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])

# ----
honeyb_open_32 = Curve([<curve referenced from the Rhino model> x6])

# ---- group: 9 x 9 / Facade
crv_159 = Curve([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])

# ----
honeyb_close_33 = Curve([<curve referenced from the Rhino model> x8])
honeyb_open_33 = Curve([<curve referenced from the Rhino model> x8])

# ---- group: 10 x 9 / Interior
crv_160 = Curve([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])

# ---- group: 10 x 9 / Glass
crv_161 = Curve([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])

# ---- group: 10 x 9 / Profile
crv_162 = Curve([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])

# ---- group: 10 x 9 / Boundary
crv_163 = Curve(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)

# ---- group: 10 x 9 / Facade
crv_164 = Curve([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])

# ----
dash_pattern = DashPattern(Curve=curve, Pattern=Slider(100, range=0..100))  # -> Dashes, Gaps
honeyb_close_34 = Curve([<curve referenced from the Rhino model> x7])

# ---- group: 11 x 9 / Glass
crv_165 = Curve([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])

# ---- group: 11 x 9 / Profile
crv_166 = Curve([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])

# ---- group: 11 x 9 / Interior
crv_167 = Curve([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])

# ---- group: 11 x 9 / Facade
crv_168 = Curve([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])

# ----
honeyb_open_34 = Curve([<curve referenced from the Rhino model> x7])

# ---- group: 11 x 9 / Boundary
crv_169 = Curve(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)

# ---- group: 8 x 10 / Boundary
crv_170 = Curve(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)

# ---- group: 8 x 10 / Glass
crv_171 = Curve([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])

# ---- group: 8 x 10 / Profile
crv_172 = Curve([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])

# ----
honeyb_close_35 = Curve([<curve referenced from the Rhino model> x7])

# ---- group: 8 x 10 / Interior
crv_173 = Curve([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])

# ---- group: 8 x 10 / Facade
crv_174 = Curve([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])

# ----
honeyb_open_35 = Curve([<curve referenced from the Rhino model> x7])
honeyb_close_36 = Curve([<curve referenced from the Rhino model> x7])
honeyb_open_36 = Curve([<curve referenced from the Rhino model> x7])

# ---- group: 9 x 10 / Interior
crv_175 = Curve([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])

# ---- group: 9 x 10 / Glass
crv_176 = Curve([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])

# ---- group: 9 x 10 / Profile
crv_177 = Curve([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])

# ---- group: 9 x 10 / Boundary
crv_178 = Curve(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)

# ---- group: 9 x 10 / Facade
crv_179 = Curve([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])

# ----
honeyb_close_37 = Curve([<curve referenced from the Rhino model> x7])

# ---- group: 10 x 10 / Interior
crv_180 = Curve([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])

# ---- group: 10 x 10 / Glass
crv_181 = Curve([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])

# ---- group: 10 x 10 / Profile
crv_182 = Curve([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])

# ----
honeyb_open_37 = Curve([<curve referenced from the Rhino model> x7])

# ---- group: 10 x 10 / Facade
crv_183 = Curve([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])

# ---- group: 10 x 10 / Boundary
crv_184 = Curve(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)

# ----
honeyb_close_38 = Curve([<curve referenced from the Rhino model> x6])
honeyb_open_38 = Curve([<curve referenced from the Rhino model> x6])
honeyb_close_39 = Curve([<curve referenced from the Rhino model> x6])
honeyb_open_39 = Curve([<curve referenced from the Rhino model> x6])

# ---- group: 11 x 10 / Glass
crv_185 = Curve([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])

# ---- group: 11 x 10 / Profile
crv_186 = Curve([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])

# ---- group: 11 x 10 / Interior
crv_187 = Curve([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])

# ---- group: 11 x 10 / Facade
crv_188 = Curve([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])

# ----
custom_preview_lineweights = CustomPreviewLineweights(
    Geometry=dash_pattern.Dashes,
    Shader=ColourSwatch(SwatchColor=RGB(255, 0, 0)),
    Thickness=Slider(5, range=0..10),
    Absolute=False)

# ---- group: 11 x 10 / Boundary
crv_189 = Curve(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)

# ---- group: 12 x 10 / Glass
crv_190 = Curve([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])

# ---- group: 12 x 10 / Interior
crv_191 = Curve([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])

# ---- group: 12 x 10 / Facade
crv_192 = Curve([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])

# ---- group: 12 x 10 / Profile
crv_193 = Curve([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])

# ---- group: 12 x 10 / Boundary
crv_194 = Curve(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)

# ---- group: 9 x 11 / Interior
crv_195 = Curve([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])

# ---- group: 9 x 11 / Glass
crv_196 = Curve([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])

# ---- group: 9 x 11 / Profile
crv_197 = Curve([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])

# ---- group: 9 x 11 / Facade
crv_198 = Curve([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])

# ---- group: 9 x 11 / Boundary
crv_199 = Curve(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)

# ----
honeyb_close_40 = Curve([<curve referenced from the Rhino model> x8])

# ---- group: 10 x 11 / Interior
crv_200 = Curve([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])

# ---- group: 10 x 11 / Glass
crv_201 = Curve([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])

# ---- group: 10 x 11 / Profile
crv_202 = Curve([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])

# ---- group: 10 x 11 / Facade
crv_203 = Curve([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])

# ----
honeyb_close_41 = Curve([<curve referenced from the Rhino model> x6])

# ---- group: 10 x 11 / Boundary
crv_204 = Curve(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)

# ----
honeyb_open_40 = Curve([<curve referenced from the Rhino model> x8])
honeyb_open_41 = Curve([<curve referenced from the Rhino model> x6])
honeyb_close_42 = Curve([<curve referenced from the Rhino model> x6])
honeyb_open_42 = Curve([<curve referenced from the Rhino model> x6])

# ---- group: 11 x 11 / Glass
crv_205 = Curve([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])

# ---- group: 11 x 11 / Interior
crv_206 = Curve([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])

# ---- group: 11 x 11 / Facade
crv_207 = Curve([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])

# ---- group: 11 x 11 / Profile
crv_208 = Curve([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])

# ---- group: 11 x 11 / Boundary
crv_209 = Curve(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)

# ----
honeyb_close_43 = Curve([<curve referenced from the Rhino model> x13])

# ---- group: 12 x 11 / Glass
crv_210 = Curve([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])

# ---- group: 12 x 11 / Interior
crv_211 = Curve([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])

# ---- group: 12 x 11 / Facade
crv_212 = Curve([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])

# ---- group: 12 x 11 / Profile
crv_213 = Curve([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])

# ----
honeyb_open_43 = Curve([<curve referenced from the Rhino model> x12])

# ---- group: 12 x 11 / Boundary
crv_214 = Curve(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)

# ---- group: 10 x 12 / Interior
crv_215 = Curve([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])

# ---- group: 10 x 12 / Glass
crv_216 = Curve([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])

# ---- group: 10 x 12 / Profile
crv_217 = Curve([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])

# ----
honeyb_close_44 = Curve([<curve referenced from the Rhino model> x6])

# ---- group: 10 x 12 / Facade
crv_218 = Curve([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])

# ---- group: 10 x 12 / Boundary
crv_219 = Curve(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)

# ----
honeyb_open_44 = Curve([<curve referenced from the Rhino model> x6])

# ---- group: 11 x 12 / Interior
crv_220 = Curve([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])

# ---- group: 11 x 12 / Glass
crv_221 = Curve([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])

# ---- group: 11 x 12 / Facade
crv_222 = Curve([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])

# ---- group: 11 x 12 / Profile
crv_223 = Curve([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])

# ---- group: 11 x 12 / Boundary
crv_224 = Curve(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)

# ----
honeyb_close_45 = Curve([<curve referenced from the Rhino model> x11])

# ---- group: 12 x 12 / Glass
crv_225 = Curve([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])

# ---- group: 12 x 12 / Interior
crv_226 = Curve([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])

# ---- group: 12 x 12 / Facade
crv_227 = Curve([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])

# ---- group: 12 x 12 / Profile
crv_228 = Curve([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])

# ---- group: 12 x 12 / Boundary
crv_229 = Curve(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)

# ----
honeyb_close_46 = Curve([<curve referenced from the Rhino model> x8])
honeyb_open_45 = Curve([<curve referenced from the Rhino model> x11])
honeyb_open_46 = Curve([<curve referenced from the Rhino model> x8])
unit_z = UnitZ(Factor="2.44")
unit_z_2 = UnitZ(Factor="2.44")
unit_z_3 = UnitZ(Factor="2.44")
ghpython_script = GhPythonScript(x=Y, y=X)  # -> out
# ---------- ghpython_script: Python ----------
import Rhino.Geometry as rg

if (x==(3)) and (y==(3)):
    print(0)
else:
    print(1)
# ---------- end ghpython_script ----------
panel_8 = Panel("DATA ")
number_slider_2 = Slider(0.1, range=0..1)

# ----
# *NOTA: *To change the city, GO to the Ladybug in the bottom of this script, and select prefer city.
# USER INPUT
# Turn to True when
#  you change your city
panel_9 = Panel("pk.eyJ1Ijoia2tpbWJpYiIsImEiOiJja293NGdhNTYwMm5nMnBvN3ZuZHVjOWFqIn0.ehBnS7YxzHQLJr_6ojqYdg")  # disabled
workingdir = Panel("C:\Users\kimky\Desktop\tmp\")  # disabled
update_imagery = BooleanToggle(True)  # disabled
image_prefix = Panel("aerial")  # disabled
map_boundary = Curve(<curve referenced from the Rhino model>)  # disabled
esri_rest_service_geocode = ESRIRESTServiceGeocode(Addresses=site)  # -> simplify(Candidates), simplify(Latitude), simplify(Longitude); disabled
panel_10 = Panel("0")  # disabled
panel_11 = Panel(esri_rest_service_geocode.Candidates)  # disabled
mapbox_raster = MapboxRaster(
    Boundary=map_boundary,
    ZoomLevel=zoom_level,
    TargetFolder=workingdir,
    Prefix=image_prefix,
    MapboxAccessToken=panel_9,
    Run=update_imagery,
    MapboxSource="Mapbox Satellite",
    MapboxSourceList="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",
    MapboxURL="https://api.mapbox.com/v4/mapbox.satellite/{z}/{x}/{y}@2x.jpg90?access_token=",
    TileCacheMeta="19265621180606265653180625")  # -> ImageFile, ImageFrame, TileCount, MapboxAttribution; disabled
boolean_toggle_2 = BooleanToggle(False)  # disabled
tree_branch = TreeBranch(Tree=esri_rest_service_geocode.Latitude, Path=panel_10, MaintainPaths=True)  # disabled
tree_branch_2 = TreeBranch(Tree=esri_rest_service_geocode.Longitude, Path=panel_10, MaintainPaths=True)  # disabled
decimal_degrees_to_xy = DecimalDegreesToXY(Latitude=tree_branch, Longitude=tree_branch_2)  # -> XyPoint, Transform; disabled
number = Number(tree_branch)  # disabled
number_2 = Number(tree_branch_2)  # disabled
boundary_surfaces_2 = BoundarySurfaces(Edges=mapbox_raster.ImageFrame)  # disabled
set_earthanchorpoint = SetEarthAnchorPoint(SetEAP=boolean_toggle_2, Latitude=number, Longitude=number_2)  # disabled
surfacemapping = SurfaceMapping(Mesh=graft(map_boundary), Surface=boundary_surfaces_2)  # disabled
esri_rest_service_reverse_geocode = ESRIRESTServiceReverseGeocode(XY=decimal_degrees_to_xy.XyPoint)  # -> Address, Neighborhood, City, Region, Postal, Country, LAT, LON; disabled
panel_12 = Panel(decimal_degrees_to_xy.XyPoint)  # disabled
previewmat = CustomPreviewMaterials(Geometry=surfacemapping, DiffuseColor=RGB(255, 255, 255), DiffuseBitmap=mapbox_raster.ImageFile)  # disabled

multiplication_2 = Multiplication(A="1.22", B=Y)
multiplication_3 = Multiplication(A="1.22", B=X)
rectangle = Rectangle(Plane=PlaneXY(0, 0, 0), XSize=multiplication_2, YSize=multiplication_3, Radius=0)  # -> Rectangle, Length
area = Area(Geometry=rectangle.Rectangle)  # -> Area, Centroid
curve_2 = Curve(rectangle.Rectangle)
explode_2 = Explode(Curve=curve_2, Recursive=True)  # -> Segments, Vertices
deconstruct_brep = DeconstructBrep(Brep=curve_2)  # -> Faces, Edges, Vertices
crv_cp = CurveClosestPoint(Point=area.Centroid, Curve=explode_2.Segments)  # -> Point, Parameter, Distance
item = ListItem(List=explode_2.Vertices, Index=1, Wrap=True)  # -> Item, Item1, Item2, Item3
item_2 = ListItem(List=crv_cp.Point, Index=1, Wrap=True)  # -> Item, Item1, Item2
panel_13 = Panel(Y)
panel_14 = Panel(X)
ghpython_script_2 = GhPythonScript(x=Y, y=X)  # -> out, a
# ---------- ghpython_script_2: Python ----------
import Rhino.Geometry as rg

if (x==(3)) and (y==(3)):
    print(0)

if (x==(3)) and (y==(4)):
    print(1)


if (x==(4)) and (y==(3)):
    print(2)

if (x==(4)) and (y==(4)):
    print(3)


if (x==(4)) and (y==(5)):
    print(4)

if (x==(4)) and (y==(6)):
    print(5)


if (x==(5)) and (y==(3)):
    print(6)

if (x==(5)) and (y==(4)):
    print(7)


if (x==(5)) and (y==(5)):
    print(8)

if (x==(5)) and (y==(6)):
    print(9)


if (x==(5)) and (y==(7)):
    print(10)

if (x==(6)) and (y==(3)):
    print(11)


if (x==(6)) and (y==(4)):
    print(12)

if (x==(6)) and (y==(5)):
    print(13)


if (x==(6)) and (y==(6)):
    print(14)

if (x==(6)) and (y==(7)):
    print(15)


if (x==(6)) and (y==(8)):
    print(16)

if (x==(7)) and (y==(5)):
    print(17)


if (x==(7)) and (y==(6)):
    print(18)

if (x==(7)) and (y==(7)):
    print(19)


if (x==(7)) and (y==(8)):
    print(20)

if (x==(7)) and (y==(9)):
    print(21)


if (x==(8)) and (y==(5)):
    print(22)

if (x==(8)) and (y==(6)):
    print(23)


if (x==(8)) and (y==(7)):
    print(24)

if (x==(8)) and (y==(8)):
    print(25)


if (x==(8)) and (y==(9)):
    print(26)

if (x==(8)) and (y==(10)):
    print(27)


if (x==(9)) and (y==(6)):
    print(28)

if (x==(9)) and (y==(7)):
    print(29)


if (x==(9)) and (y==(8)):
    print(30)

if (x==(9)) and (y==(9)):
    print(31)


if (x==(9)) and (y==(10)):
    print(32)

if (x==(9)) and (y==(11)):
    print(33)


if (x==(10)) and (y==(8)):
    print(34)

if (x==(10)) and (y==(9)):
    print(35)


if (x==(10)) and (y==(10)):
    print(36)

if (x==(10)) and (y==(11)):
    print(37)


if (x==(10)) and (y==(12)):
    print(38)

if (x==(11)) and (y==(9)):
    print(39)


if (x==(11)) and (y==(10)):
    print(40)

if (x==(11)) and (y==(11)):
    print(41)


if (x==(11)) and (y==(12)):
    print(42)

if (x==(12)) and (y==(10)):
    print(43)


if (x==(12)) and (y==(11)):
    print(44)

if (x==(12)) and (y==(12)):
    print(45)
# ---------- end ghpython_script_2 ----------
boundary = StreamFilter(
    Gate=ghpython_script_2.out,
    Stream0=crv_3,
    Stream1=crv_29,
    Stream2=crv_9,
    Stream3=crv_38,
    Stream4=crv_61,
    Stream5=crv_84,
    Stream6=crv_10,
    Stream7=crv_24,
    Stream8=crv_40,
    Stream9=crv_69,
    Stream10=crv_99,
    Stream11=crv_17,
    Stream12=crv_32,
    Stream13=crv_50,
    Stream14=crv_75,
    Stream15=crv_104,
    Stream16=crv_126,
    Stream17=crv_47,
    Stream18=crv_79,
    Stream19=crv_108,
    Stream20=crv_120,
    Stream21=crv_145,
    Stream22=crv_55,
    Stream23=crv_89,
    Stream24=crv_110,
    Stream25=crv_130,
    Stream26=crv_154,
    Stream27=crv_170,
    Stream28=crv_91,
    Stream29=crv_115,
    Stream30=crv_135,
    Stream31=crv_155,
    Stream32=crv_178,
    Stream33=crv_199,
    Stream34=crv_144,
    Stream35=crv_163,
    Stream36=crv_184,
    Stream37=crv_204,
    Stream38=crv_219,
    Stream39=crv_169,
    Stream40=crv_189,
    Stream41=crv_209,
    Stream42=crv_224,
    Stream43=crv_194,
    Stream44=crv_214,
    Stream45=crv_229)

# ---- group: Terrasse
stream_filter = StreamFilter(
    Gate=ghpython_script_2.out,
    Stream16=terrasse_m2_7,
    Stream20=terrasse_m2_6,
    Stream21=terrasse_m2_10,
    Stream22=terrasse_m2,
    Stream23=terrasse_m2_2,
    Stream24=terrasse_m2_4,
    Stream25=terrasse_m2_8,
    Stream26=terrasse_m2_11,
    Stream28=terrasse_m2_3,
    Stream29=terrasse_m2_5,
    Stream30=terrasse_m2_9,
    Stream31=terrasse_m2_12,
    Stream32=terrasse_m2_15,
    Stream33=terrasse_m2_18,
    Stream35=terrasse_m2_13,
    Stream36=terrasse_m2_16,
    Stream37=terrasse_m2_19,
    Stream38=terrasse_m2_21,
    Stream39=terrasse_m2_14,
    Stream40=terrasse_m2_17,
    Stream44=terrasse_m2_20)

# ---- group: OPEN
stream_filter_2 = StreamFilter(
    Gate=ghpython_script_2.out,
    Stream0=honeyb_open_2,
    Stream1=honeyb_open_3,
    Stream2=honeyb_open,
    Stream3=honeyb_open_8,
    Stream4=honeyb_open_13,
    Stream5=honeyb_open_15,
    Stream6=honeyb_open_4,
    Stream7=honeyb_open_7,
    Stream8=honeyb_open_9,
    Stream9=honeyb_open_14,
    Stream10=honeyb_open_22,
    Stream11=honeyb_open_5,
    Stream12=honeyb_open_6,
    Stream13=honeyb_open_12,
    Stream14=honeyb_open_17,
    Stream15=honeyb_open_20,
    Stream16=honeyb_open_26,
    Stream17=honeyb_open_10,
    Stream18=honeyb_open_16,
    Stream19=honeyb_open_21,
    Stream20=honeyb_open_25,
    Stream21=honeyb_open_30,
    Stream22=honeyb_open_11,
    Stream23=honeyb_open_18,
    Stream24=honeyb_open_23,
    Stream25=honeyb_open_27,
    Stream26=honeyb_open_31,
    Stream27=honeyb_open_35,
    Stream28=honeyb_open_19,
    Stream29=honeyb_open_24,
    Stream30=honeyb_open_28,
    Stream31=honeyb_open_33,
    Stream32=honeyb_open_36,
    Stream33=honeyb_open_41,
    Stream34=honeyb_open_29,
    Stream35=honeyb_open_34,
    Stream36=honeyb_open_37,
    Stream37=honeyb_open_42,
    Stream38=honeyb_open_44,
    Stream39=honeyb_open_32,
    Stream40=honeyb_open_38,
    Stream41=honeyb_open_40,
    Stream42=honeyb_open_45,
    Stream43=honeyb_open_39,
    Stream44=honeyb_open_43,
    Stream45=honeyb_open_46)

# ---- group: CLOSE
stream_filter_3 = StreamFilter(
    Gate=ghpython_script_2.out,
    Stream0=honeyb_close,
    Stream1=honeyb_close_3,
    Stream2=honeyb_close_2,
    Stream3=honeyb_close_8,
    Stream4=honeyb_close_13,
    Stream5=honeyb_close_15,
    Stream6=honeyb_close_4,
    Stream7=honeyb_close_7,
    Stream8=honeyb_close_9,
    Stream9=honeyb_close_14,
    Stream10=honeyb_close_22,
    Stream11=honeyb_close_5,
    Stream12=honeyb_close_6,
    Stream13=honeyb_close_12,
    Stream14=honeyb_close_17,
    Stream15=honeyb_close_20,
    Stream16=honeyb_close_26,
    Stream17=honeyb_close_10,
    Stream18=honeyb_close_16,
    Stream19=honeyb_close_21,
    Stream20=honeyb_close_25,
    Stream21=honeyb_close_30,
    Stream22=honeyb_close_11,
    Stream23=honeyb_close_18,
    Stream24=honeyb_close_23,
    Stream25=honeyb_close_27,
    Stream26=honeyb_close_31,
    Stream27=honeyb_close_35,
    Stream28=honeyb_close_19,
    Stream29=honeyb_close_24,
    Stream30=honeyb_close_28,
    Stream31=honeyb_close_33,
    Stream32=honeyb_close_36,
    Stream33=honeyb_close_41,
    Stream34=honeyb_close_29,
    Stream35=honeyb_close_34,
    Stream36=honeyb_close_37,
    Stream37=honeyb_close_42,
    Stream38=honeyb_close_44,
    Stream39=honeyb_close_32,
    Stream40=honeyb_close_38,
    Stream41=honeyb_close_40,
    Stream42=honeyb_close_45,
    Stream43=honeyb_close_39,
    Stream44=honeyb_close_43,
    Stream45=honeyb_close_46)

# ---- group: Window numb
stream_filter_4 = StreamFilter(
    Gate=ghpython_script_2.out,
    Stream0=total_win,
    Stream1=total_win_5,
    Stream2=total_win_2,
    Stream3=total_win_8,
    Stream4=total_win_13,
    Stream5=total_win_15,
    Stream6=total_win_3,
    Stream7=total_win_6,
    Stream8=total_win_9,
    Stream9=total_win_14,
    Stream10=total_win_20,
    Stream11=total_win_4,
    Stream12=total_win_7,
    Stream13=total_win_10,
    Stream14=total_win_16,
    Stream15=total_win_22,
    Stream16=total_win_26,
    Stream17=total_win_11,
    Stream18=total_win_17,
    Stream19=total_win_21,
    Stream20=total_win_25,
    Stream21=total_win_30,
    Stream22=total_win_12,
    Stream23=total_win_18,
    Stream24=total_win_23,
    Stream25=total_win_27,
    Stream26=total_win_31,
    Stream27=total_win_35,
    Stream28=total_win_19,
    Stream29=total_win_24,
    Stream30=total_win_28,
    Stream31=total_win_32,
    Stream32=total_win_36,
    Stream33=total_win_40,
    Stream34=total_win_29,
    Stream35=total_win_33,
    Stream36=total_win_37,
    Stream37=total_win_41,
    Stream38=total_win_44,
    Stream39=total_win_34,
    Stream40=total_win_38,
    Stream41=total_win_42,
    Stream42=total_win_45,
    Stream43=total_win_39,
    Stream44=total_win_43,
    Stream45=total_win_46)

# ---- group: Total wall
stream_filter_5 = StreamFilter(
    Gate=ghpython_script_2.out,
    Stream0=total_wall,
    Stream1=total_wall_5,
    Stream2=total_wall_2,
    Stream3=total_wall_8,
    Stream4=total_wall_13,
    Stream5=total_wall_15,
    Stream6=total_wall_3,
    Stream7=total_wall_6,
    Stream8=total_wall_9,
    Stream9=total_wall_14,
    Stream10=total_wall_20,
    Stream11=total_wall_4,
    Stream12=total_wall_7,
    Stream13=total_wall_10,
    Stream14=total_wall_16,
    Stream15=total_wall_22,
    Stream16=total_wall_26,
    Stream17=total_wall_11,
    Stream18=total_wall_17,
    Stream19=total_wall_21,
    Stream20=total_wall_25,
    Stream21=total_wall_30,
    Stream22=total_wall_12,
    Stream23=total_wall_18,
    Stream24=total_wall_23,
    Stream25=total_wall_27,
    Stream26=total_wall_31,
    Stream27=total_wall_35,
    Stream28=total_wall_19,
    Stream29=total_wall_24,
    Stream30=total_wall_28,
    Stream31=total_wall_32,
    Stream32=total_wall_36,
    Stream33=total_wall_40,
    Stream34=total_wall_29,
    Stream35=total_wall_33,
    Stream36=total_wall_37,
    Stream37=total_wall_41,
    Stream38=total_wall_44,
    Stream39=total_wall_34,
    Stream40=total_wall_38,
    Stream41=total_wall_42,
    Stream42=total_wall_45,
    Stream43=total_wall_39,
    Stream44=total_wall_43,
    Stream45=total_wall_46)

# ---- group: Glass
filter = StreamFilter(
    Gate=ghpython_script_2.out,
    Stream0=crv,
    Stream1=crv_25,
    Stream2=crv_7,
    Stream3=crv_39,
    Stream4=crv_60,
    Stream5=crv_81,
    Stream6=crv_11,
    Stream7=crv_23,
    Stream8=crv_42,
    Stream9=crv_66,
    Stream10=crv_95,
    Stream11=crv_15,
    Stream12=crv_30,
    Stream13=crv_45,
    Stream14=crv_70,
    Stream15=crv_100,
    Stream16=crv_128,
    Stream17=crv_48,
    Stream18=crv_80,
    Stream19=crv_109,
    Stream20=crv_121,
    Stream21=crv_148,
    Stream22=crv_56,
    Stream23=crv_88,
    Stream24=crv_111,
    Stream25=crv_134,
    Stream26=crv_150,
    Stream27=crv_171,
    Stream28=crv_92,
    Stream29=crv_117,
    Stream30=crv_137,
    Stream31=crv_157,
    Stream32=crv_176,
    Stream33=crv_196,
    Stream34=crv_141,
    Stream35=crv_161,
    Stream36=crv_181,
    Stream37=crv_201,
    Stream38=crv_216,
    Stream39=crv_165,
    Stream40=crv_185,
    Stream41=crv_205,
    Stream42=crv_221,
    Stream43=crv_190,
    Stream44=crv_210,
    Stream45=crv_225)

# ---- group: Profil
filter_2 = StreamFilter(
    Gate=ghpython_script_2.out,
    Stream0=crv_2,
    Stream1=crv_26,
    Stream2=crv_8,
    Stream3=crv_37,
    Stream4=crv_64,
    Stream5=crv_83,
    Stream6=crv_14,
    Stream7=crv_20,
    Stream8=crv_43,
    Stream9=crv_68,
    Stream10=crv_96,
    Stream11=crv_16,
    Stream12=crv_31,
    Stream13=crv_46,
    Stream14=crv_73,
    Stream15=crv_101,
    Stream16=crv_129,
    Stream17=crv_49,
    Stream18=crv_76,
    Stream19=crv_103,
    Stream20=crv_122,
    Stream21=crv_149,
    Stream22=crv_57,
    Stream23=crv_85,
    Stream24=crv_112,
    Stream25=crv_132,
    Stream26=crv_151,
    Stream27=crv_172,
    Stream28=crv_93,
    Stream29=crv_118,
    Stream30=crv_138,
    Stream31=crv_158,
    Stream32=crv_177,
    Stream33=crv_197,
    Stream34=crv_142,
    Stream35=crv_162,
    Stream36=crv_182,
    Stream37=crv_202,
    Stream38=crv_217,
    Stream39=crv_166,
    Stream40=crv_186,
    Stream41=crv_208,
    Stream42=crv_223,
    Stream43=crv_193,
    Stream44=crv_213,
    Stream45=crv_228)

# ---- group: Interior
boundary_2 = StreamFilter(
    Gate=ghpython_script_2.out,
    Stream1=crv_27,
    Stream2=crv_5,
    Stream3=crv_35,
    Stream4=crv_62,
    Stream5=crv_82,
    Stream6=crv_12,
    Stream7=crv_21,
    Stream8=crv_41,
    Stream9=crv_65,
    Stream10=crv_97,
    Stream11=crv_18,
    Stream12=crv_33,
    Stream13=crv_51,
    Stream14=crv_71,
    Stream15=crv_105,
    Stream16=crv_125,
    Stream17=crv_53,
    Stream18=crv_77,
    Stream19=crv_102,
    Stream20=crv_123,
    Stream21=crv_146,
    Stream22=crv_58,
    Stream23=crv_86,
    Stream24=crv_113,
    Stream25=crv_133,
    Stream26=crv_152,
    Stream27=crv_173,
    Stream28=crv_90,
    Stream29=crv_116,
    Stream30=crv_136,
    Stream31=crv_156,
    Stream32=crv_175,
    Stream33=crv_195,
    Stream34=crv_140,
    Stream35=crv_160,
    Stream36=crv_180,
    Stream37=crv_200,
    Stream38=crv_215,
    Stream39=crv_167,
    Stream40=crv_187,
    Stream41=crv_206,
    Stream42=crv_220,
    Stream43=crv_191,
    Stream44=crv_211,
    Stream45=crv_226)

# ---- group: Facade
filter_3 = StreamFilter(
    Gate=ghpython_script_2.out,
    Stream0=crv_4,
    Stream1=crv_28,
    Stream2=crv_6,
    Stream3=crv_36,
    Stream4=crv_63,
    Stream5=crv_74,
    Stream6=crv_13,
    Stream7=crv_22,
    Stream8=crv_44,
    Stream9=crv_67,
    Stream10=crv_98,
    Stream11=crv_19,
    Stream12=crv_34,
    Stream13=crv_52,
    Stream14=crv_72,
    Stream15=crv_106,
    Stream16=crv_127,
    Stream17=crv_54,
    Stream18=crv_78,
    Stream19=crv_107,
    Stream20=crv_124,
    Stream21=crv_147,
    Stream22=crv_59,
    Stream23=crv_87,
    Stream24=crv_114,
    Stream25=crv_131,
    Stream26=crv_153,
    Stream27=crv_174,
    Stream28=crv_94,
    Stream29=crv_119,
    Stream30=crv_139,
    Stream31=crv_159,
    Stream32=crv_179,
    Stream33=crv_198,
    Stream34=crv_143,
    Stream35=crv_164,
    Stream36=crv_183,
    Stream37=crv_203,
    Stream38=crv_218,
    Stream39=crv_168,
    Stream40=crv_188,
    Stream41=crv_207,
    Stream42=crv_222,
    Stream43=crv_192,
    Stream44=crv_212,
    Stream45=crv_227)

# ----
cluster = Cluster(
    A=area.Centroid,
    B=item_2.Item2,
    L=deconstruct_brep.Vertices,
    d1=boundary,
    d2=boundary_2,
    G=filter_3,
    G_2=filter,
    G_3=filter_2,
    hb_o=stream_filter_2,
    hb_c=stream_filter_3)  # -> slab, G_4, brep, brep_2, E, E_2, hb_o_2, hb_c_2

interior_wall = Geometry(cluster.brep)
window = Geometry(cluster.E)
slab = Geometry(cluster.slab)
facade = Geometry(cluster.brep_2)
roof = Geometry(cluster.G_4)
frame = Geometry(cluster.E_2)

group = Group(Objects=interior_wall)
group_2 = Group(Objects=window)
group_3 = Group(Objects=facade)
group_4 = Group(Objects=frame)
merge_3 = Merge(Data1=slab, Data2=roof, Data3=group, Data4=group_2, Data5=group_3, Data6=group_4)
bounding_box = BoundingBox(Content=merge_3, Plane=PlaneXY(0, 0, 0), UnionBox=True)  # -> Box, flatten(Box_2)
list_item_4 = ListItem(List=bounding_box.Box_2, Index=0, Wrap=True)
area_2 = Area(Geometry=list_item_4)  # -> Area, Centroid
rotate = Rotate(Geometry=merge_3, Angle=degrees(rotation_degree), Plane=area_2.Centroid)  # -> simplify(graft(Geometry)), Transform
explode_tree = ExplodeTree(Data=rotate.Geometry)  # -> Branch0, Branch1, Branch2, Branch3, Branch4, Branch5
close = Curve(cluster.hb_c_2)
open = Curve(cluster.hb_o_2)

# ---- group: Interior wall
stream_filter_6 = StreamFilter(
    Gate=ghpython_script_2.out,
    Stream1=interior_wall_length_4,
    Stream2=interior_wall_length,
    Stream3=interior_wall_length_7,
    Stream4=interior_wall_length_12,
    Stream5=interior_wall_length_15,
    Stream6=interior_wall_length_2,
    Stream7=interior_wall_length_5,
    Stream8=interior_wall_length_8,
    Stream9=interior_wall_length_13,
    Stream10=interior_wall_length_21,
    Stream11=interior_wall_length_3,
    Stream12=interior_wall_length_6,
    Stream13=interior_wall_length_11,
    Stream14=interior_wall_length_14,
    Stream15=interior_wall_length_20,
    Stream16=interior_wall_length_25,
    Stream17=interior_wall_length_9,
    Stream18=interior_wall_length_16,
    Stream19=interior_wall_length_19,
    Stream20=interior_wall_length_24,
    Stream21=interior_wall_length_29,
    Stream22=interior_wall_length_10,
    Stream23=interior_wall_length_17,
    Stream24=interior_wall_length_22,
    Stream25=interior_wall_length_26,
    Stream26=interior_wall_length_30,
    Stream27=interior_wall_length_34,
    Stream28=interior_wall_length_18,
    Stream29=interior_wall_length_23,
    Stream30=interior_wall_length_27,
    Stream31=interior_wall_length_31,
    Stream32=interior_wall_length_35,
    Stream33=interior_wall_length_39,
    Stream34=interior_wall_length_28,
    Stream35=interior_wall_length_33,
    Stream36=interior_wall_length_36,
    Stream37=interior_wall_length_40,
    Stream38=interior_wall_length_43,
    Stream39=interior_wall_length_32,
    Stream40=interior_wall_length_37,
    Stream41=interior_wall_length_41,
    Stream42=interior_wall_length_44,
    Stream43=interior_wall_length_38,
    Stream44=interior_wall_length_42,
    Stream45=interior_wall_length_45)

# ----
extrude = Extrude(Base=close, Direction=unit_z)
extrude_2 = Extrude(Base=open, Direction=unit_z_2)
join_curves = JoinCurves(Curves=[close, open], Preserve=False)

# ---- group: wall
ungroup = Ungroup(Group=explode_tree.Branch4)

# ---- group: Window
ungroup_2 = Ungroup(Group=explode_tree.Branch3)

# ---- group: Interior
ungroup_3 = Ungroup(Group=explode_tree.Branch1)

# ---- group: Frame
ungroup_4 = Ungroup(Group=explode_tree.Branch5)

# ---- group: Floor
ungroup_5 = Ungroup(Group=explode_tree.Branch0)

# ---- group: Roof
ungroup_6 = Ungroup(Group=explode_tree.Branch2)

# ----
roof_2 = Brep(ungroup_6)
deconstruct_brep_2 = DeconstructBrep(Brep=roof_2)  # -> Faces, Edges, Vertices
geometry_2 = Geometry(extrude)
geometry_3 = Geometry(extrude_2)
floor = Brep(ungroup_5)
list_item_5 = ListItem(List=deconstruct_brep_2.Faces, Index="5", Wrap=True)
deconstruct_brep_3 = DeconstructBrep(Brep=floor)  # -> Faces, Edges, Vertices
area_3 = Area(Geometry=list_item_5)  # -> Area, Centroid
rotate_2 = Rotate(Geometry=join_curves, Angle=degrees(rotation_degree), Plane=area_3.Centroid)  # -> simplify(graft(Geometry)), Transform
rotate_3 = Rotate(Geometry=geometry_2, Angle=degrees(rotation_degree), Plane=area_3.Centroid)  # -> simplify(graft(Geometry)), Transform
rotate_4 = Rotate(Geometry=geometry_3, Angle=degrees(rotation_degree), Plane=area_3.Centroid)  # -> simplify(graft(Geometry)), Transform

terrasse = Integer(stream_filter)
total_window_numb = Integer(stream_filter_4)
wall_total_numb = Integer(stream_filter_5)
interior_wall_2 = Integer(stream_filter_6)

inner_srf = Surface(rotate_2.Geometry)
move = Move(Geometry=inner_srf, Motion=unit_z_3)  # -> Geometry, Transform
brep = Brep(ungroup_3)
list_item_6 = ListItem(List=deconstruct_brep_3.Faces, Index=0, Wrap=True)

# ---- group: Geometry output
brep_2 = Brep(simplify([ungroup_2, ungroup, ungroup_6, ungroup_3, ungroup_4, ungroup_5]))
brep_wireframe = BrepWireframe(Brep=brep_2, Density=-1)
create_material = CreateMaterial(
    Diffuse=ColourSwatch(SwatchColor=RGB(86, 127, 112)),
    Specular=RGB(255, 255, 255),
    Emission=RGB(0, 0, 0),
    Transparency=Slider(0.51, range=0..1),
    Shine=0)
create_material_2 = CreateMaterial(
    Diffuse=ColourSwatch(SwatchColor=RGB(168, 145, 118)),
    Specular=RGB(255, 255, 255),
    Emission=RGB(0, 0, 0),
    Transparency=Slider(0.48, range=0..1),
    Shine=0)
colour_swatch = ColourSwatch(SwatchColor=RGB(201, 194, 153))
colour_swatch_2 = ColourSwatch(SwatchColor=RGB(153, 147, 112))
day_light_mesh = Mesh()
custom_preview = CustomPreview(Geometry=ungroup_2, Material=create_material)
custom_preview_lineweights_2 = CustomPreviewLineweights(Geometry=brep_wireframe, Shader=ColourSwatch(SwatchColor=RGB(0, 0, 0)), Thickness=2, Absolute=False)

# ---- group: Number of Panels
total_wall_panels_number = Panel(wall_total_numb)

# ----
total_interior_wall_length = Panel(interior_wall_2)

# ---- group: Area Calculation
area_4 = Area(Geometry=list_item_6)  # -> Area, Centroid
area_m2 = Panel(area_4.Area)

# ---- group: Number of Panels
terrasse_m2_22 = Panel(terrasse)

total_windows_number = Panel(total_window_numb)

# ----
dimensions = Dimensions(Surface=list_item_6)  # -> UDimension, VDimension
length_x_m = Panel(dimensions.UDimension)
length_y_m = Panel(dimensions.VDimension)

# ---- group: floor
floor_2 = Brep(list_item_6)

# ---- group: ceiling
roof_3 = Brep(list_item_5)

# ----
int_wall = Brep(brep)
integer_2 = Integer(total_interior_wall_length)
outer_line = Brep([floor_2, roof_3, brep])
expression = Expression(x=total_windows_number, Expression="x * 1000")
expression_2 = Expression(x=terrasse, Expression="x * 350")

# ---- group: Geometry output / Wall
custom_preview_2 = CustomPreview(Geometry=ungroup, Material=colour_swatch)

# ---- group: Geometry output / Interior
custom_preview_3 = CustomPreview(Geometry=ungroup_3, Material=colour_swatch_2)

# ---- group: Geometry output / Roof
custom_preview_4 = CustomPreview(Geometry=[ungroup_6, ungroup_4], Material=create_material_2)

# ---- group: Mesh grid
number_slider_3 = Slider(8, range=0..20)
number_slider_4 = Slider(8, range=0..20)
surface = Surface(inner_srf)
divide = DivideDomain²(Domain=surface, UCount=number_slider_3, VCount=number_slider_4)
mesh_uv = MeshSurface(Surface=surface, UCount=number_slider_3, VCount=number_slider_4, Overhang=True, Equalize=False)  # -> simplify(Mesh)

# ----
terrace_cost = Panel(expression_2)
window_cost = Panel(expression)

# ---- group: NORTH ANGLE MEASURE
# Important toggle
number_slider_5 = Slider(5, range=0..10)

# ----
# *NOTA: 1 m2 = 10.764 Square foot
# SIP WOOD:17-30$/m2, here, 30$
# Wood window type Bay : 800-2700$, here 1000$, Terrasse composite 350$ / m2
multiplication_4 = Multiplication(A="1.22", B="2.44")
integer_3 = Integer(total_wall_panels_number)
multiplication_5 = Multiplication(A=multiplication_4, B=integer_3)
expression_3 = Expression(x=multiplication_5, Expression="x * 10.764 * 30")
integer_4 = Integer(expression_3)

multiplication_6 = Multiplication(A=multiplication_4, B=integer_2)
expression_4 = Expression(x=multiplication_6, Expression="x * 10.764 * 20")
integer_5 = Integer(expression_4)

mass_addition = MassAddition(Input=[integer_4, expression, expression_2, integer_5])  # -> Result, PartialResults
total_construction_cost = Panel(mass_addition.Result)

facade_wall_cost = Panel(expression_3)
interior_wall_3 = Panel(integer_5)

# ----
# INTERGRATED DAYLIGHT & ENERGY SIMULATION
# Honeybee default materials will be assigned
# based on surface type
# 0. Geometry Preparation
wall_surface_with_opening = Brep(rotate_4.Geometry)
ladybug = Ladybug_Ladybug()  # -> Vviiiiiiiiiizzz; plug-in component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
honeybee = Honeybee_Honeybee()  # -> Vviiiiiiiiiizzz; plug-in component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
walls_no_window = Brep(rotate_3.Geometry)
createhbsrfs = Honeybee_createHBSrfs(geometry=flatten(inner_srf), srfType="2")  # -> readMe, simplify(HBSurface); plug-in component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
createhbsrfs_2 = Honeybee_createHBSrfs(geometry=wall_surface_with_opening, srfType="0")  # -> readMe, simplify(HBSurface); plug-in component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
bldgprograms = Honeybee_bldgPrograms({"Office": 0, "Retail": 1, "MidriseApartment": 2, "PrimarySchool": 3, "SecondarySchool": 4, "SmallHotel": 5, "LargeHotel": 6, "Hospital": 7, "Outpatient": 8, "Warehouse": 9, "SuperMarket": 10, "FullServiceRestaurant": 11, "QuickServiceRestaurant": 12}, selected="MidriseApartment")
createhbsrfs_3 = Honeybee_createHBSrfs(geometry=move.Geometry, srfType="1")  # -> readMe, simplify(HBSurface); plug-in component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
createhbsrfs_4 = Honeybee_createHBSrfs(geometry=walls_no_window, srfType="0")  # -> readMe, simplify(HBSurface); plug-in component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
createhbsrfs_5 = Honeybee_createHBSrfs(geometry=int_wall, srfType="0")  # -> readMe, simplify(HBSurface); plug-in component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
listzoneprograms = Honeybee_ListZonePrograms(bldgProgram=bldgprograms)  # -> MidriseApartmentZonePrograms; plug-in component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
isotrim = Isotrim(Surface=surface, Domain=divide)
Z = UnitZ(Factor=Slider(0.03, range=0..0.1))
item_3 = ListItem(List=listzoneprograms, Index=0, Wrap=True)
move_2 = Move(Geometry=isotrim, Motion=Z)  # -> Geometry, Transform
value_list = ValueList({"Ils-de-France": 0, "SAN PAULO": 1, "Concepcion, Chile": 2}, selected="Ils-de-France")
panel_15 = Panel(item_3)
area_5 = Area(Geometry=move_2.Geometry)  # -> Area, simplify(Centroid)
Z_2 = UnitZ(Factor=area_5.Centroid)
amp = Amplitude(Vector=Z_2, Amplitude=1)  # -> simplify(Vector)
list_length_3 = ListLength(List=area_5.Centroid)
division_2 = Division(A=list_length_3, B=2)
analysisperiod = Ladybug_AnalysisPeriod(fromHour="8", toHour="18")  # -> out, analysisPeriod; plug-in component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
occupancygenerator = Honeybee_DaysimOccupancyGenerator(occupancyPeriod=analysisperiod.analysisPeriod, weekendDays=[1, 2], writeTheOcc=Toggle(True))  # -> occupancyFile; plug-in component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

ghpython_script_3 = GhPythonScript(x=value_list)  # -> out; disabled
# ---------- ghpython_script_3: Python ----------
import Rhino.Geometry as rg

if x == 0:
    print("Paris")
elif x == 1:
    print("San_Paulo")
else:
    print("Concepcion")
# ---------- end ghpython_script_3 ----------
panel_16 = Panel(ghpython_script_3)  # disabled

area_6 = Area(Geometry=wall_surface_with_opening)  # -> Area, Centroid
scale = Scale(Geometry=wall_surface_with_opening, Center=area_6.Centroid, Factor=Slider(0.9, range=0..1))  # -> Geometry, Transform

lng = ListLength(List=isotrim)
series_11 = Series(Start=1, Step=1, Count=lng)
concat = Concatenate(FragmentA="mesh", FragmentB=series_11)

panel_17 = Panel(concat)

expression_5 = Expression(x=area_4.Area, Expression="x / 8.125")

# ---- group: Integer
# *NOTA: Construction time SIP house:
# 8 days.
# Let's say, general house size 65m2.
# 65m2 / 8days = 8.125 m2 / 1 day
ghpython_script_4 = GhPythonScript(R=expression_5)  # -> out; disabled
# ---------- ghpython_script_4: Python ----------
import Rhino.Geometry as rg

if R < 1:
    print(int(1))
else: 
    print(R)
# ---------- end ghpython_script_4 ----------
integer_6 = Integer(expression_5)

# ----
construction_time_days = Panel(integer_6)

glass = Brep(scale.Geometry)
preview = CustomPreview(Geometry=glass, Shader=ColourSwatch(SwatchColor=RGBA(80, 222, 255, 160)))
addhbglz = Honeybee_addHBGlz(HBObj=flatten(createhbsrfs_2.HBSurface), childSurfaces=flatten(glass))  # -> simplify(HBObjWGLZ); plug-in component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
merge_4 = Merge(Data1=createhbsrfs_4.HBSurface, Data2=createhbsrfs_3.HBSurface, Data3=createhbsrfs.HBSurface, Data4=addhbglz)

merge_5 = Merge(
    Data1=createhbsrfs_4.HBSurface,
    Data2=createhbsrfs_3.HBSurface,
    Data3=createhbsrfs.HBSurface,
    Data4=addhbglz,
    Data5=createhbsrfs_5.HBSurface)
stream_filter_7 = StreamFilter(Gate=ghpython_script, Stream0=merge_4, Stream1=merge_5)

# ---- group: collect all honeybee surfaces
brep_3 = Brep(flatten(stream_filter_7))

# ----
panel_18 = Panel(stream_filter_7)

epw_paris = Panel("https://www.energyplus.net/weather-download/europe_wmo_region_6/FRA//FRA_Paris.Orly.071490_IWEC/all")
epw_san_paulo = Panel("http://climate.onebuilding.org/WMO_Region_3_South_America/BRA_Brazil/SP_Sao_Paulo/BRA_SP_Sao.Paulo.869100_TMYx.zip")
epw_concepcion_chile = Panel("http://climate.onebuilding.org/WMO_Region_3_South_America/CHL_Chile/BI_Bio-Bio/CHL_BI_Concepcion.856830_TMYx.zip")
point = Point(Point(14.88130308, -17.26022244, 0))
number_slider_6 = Slider(24, range=0..100)
epwmap = LBEPWmap(epw_map=Toggle(False))  # -> Output; plug-in component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
northarrow = Ladybug_North(north=number_slider_6, centerPt=point, scale=".05")  # -> northSign; plug-in component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

# ---- group: NORTH ANGLE MEASURE (continued)
data = Data(northarrow)
north = Geometry(data)
list_item_7 = ListItem(List=north, Index=0, Wrap=True)  # -> Item, Item1, Item2
curve_3 = Curve(list_item_7.Item1)
end_points = EndPoints(Curve=curve_3)  # -> Start, End
vector_2pt = Vector2Pt(PointA=end_points.Start, PointB=end_points.End, Unitize=False)  # -> Vector, Length
line_sdl = LineSDL(Start=end_points.End, Direction=vector_2pt.Vector, Length=2)
rotate_5 = Rotate(Geometry=line_sdl, Angle=expr("-x", degrees(rotation_degree)), Plane=point)  # -> Geometry, Transform
curve_4 = Curve(rotate_5.Geometry)
angle_2 = Angle(VectorA=line_sdl, VectorB=curve_4)  # -> Angle, Reflex
# NOTE
custom_preview_lineweights_3 = CustomPreviewLineweights(Geometry=curve_4, Shader=ColourSwatch(SwatchColor=RGB(0, 0, 0)), Thickness=number_slider_5, Absolute=False)
degrees = Degrees(Radians=angle_2.Angle)
ghpython_script_5 = GhPythonScript(x=degrees, y=rotation_degree)  # -> out, a
# ---------- ghpython_script_5: Python ----------
import Rhino.Geometry as rg

if y <= 180:
    a = int(x)
elif y >180:
    a = int(y)
# ---------- end ghpython_script_5 ----------
panel_19 = Panel(ghpython_script_5.a)

# ----
integer_7 = Integer(ghpython_script_5.a)
rotation = Data(integer_7)
panel_20 = Panel(rotation)

area_7 = Area(Geometry=boundary_surfaces)  # -> Area, Centroid

division_3 = Division(A=area_7.Area, B="10000")
site_surface_m2 = Panel(division_3)

ma = MassAddition(Input=flatten(division_3))  # -> Result, PartialResults
total_site_area = Number(ma.Result)

# ----
# 1. Weather file
# 3-2. Run Annual Daylight
# 2. Generate Grid
# NOTA: TO ACTIVATE SIMULATION, ENABLE THIS!
# 3-1. Simulation Parameters
stream_filter_8 = StreamFilter(Gate=value_list, Stream0=epw_paris, Stream1=epw_san_paulo, Stream2=epw_concepcion_chile)
list = ValueList({"VeryLow": "1,512,256,128,0.15,0.004", "Low": "2,512,256,128,0.15,0.004", "Medium": "4,1024,256,256,0.1,0.004", "High": "7,4096,512,1024,0.1,0.001"}, selected="VeryLow")
text_split = TextSplit(Text=list, Separators=",")
list_item_8 = ListItem(List=text_split, Index=0, Wrap=True)  # -> Item, Item1, Item2, Item3, Item4
flip = Flip()  # -> Surface, Result; disabled
radparameters = Honeybee_RADParameters(quality=0, ab=list_item_8.Item, ad=list_item_8.Item1, as=list_item_8.Item2, ar=list_item_8.Item3, aa=list_item_8.Item4)  # -> readMe, radParameters; plug-in component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
item_4 = ListItem(List=area_5.Centroid, Index=division_2, Wrap=True)  # -> Item, Item1
toggle = BooleanToggle(True)
sph = Sphere(Base=item_4.Item, Radius=Slider(10, range=0..10))
workingdir_2 = Panel("C:\Users\kimky\Desktop\tmp\S4-STUDIO\Daylight_Autonomy")
lightingcontrol = Honeybee_LightingControlRecipe(
    controlType="5",
    sensorPoints=item_4.Item,
    lightingPower=250,
    lightingSetpoint=300,
    ballastLossFactor=20,
    standbyPower=3,
    delayTime=5)  # -> lightingControlGroup; plug-in component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

epw_stat = Ladybug_OpenEPWAndSTATWeatherFiles(weatherFileURL=stream_filter_8)  # -> epwFile, statFile; disabled; plug-in component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

createhbzones = Honeybee_createHBZones(name="HOUSE ENERGY SIMULATION", zoneProgram=item_3, HBSurfaces=flatten(brep_3), isConditioned=True)  # -> readMe, HBZone; plug-in component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
wires = BrepWireframe(Brep=[outer_line, brep_3], Density=-1)

annualdaylightsimulation = Honeybee_AnnualDaylightSimulation(
    north=number_slider_6,
    epwWeatherFile=epw_stat.epwFile,
    testPoints=area_5.Centroid,
    ptsVectors=amp,
    testMesh=mesh_uv,
    radParameters=radparameters.radParameters)  # -> analysisRecipe; plug-in component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
rundaylightanalysis = Honeybee_RunDaylightSimulation(
    HBObjects=flatten(brep_3),
    analysisRecipe=annualdaylightsimulation,
    writeRad=toggle,
    runRad=toggle,
    numOfCPUs=Slider(4, range=0..10),
    workingDir=workingdir_2,
    overwriteResults=True)  # -> readMe, analysisType, resultsUnit, results, testPts, resultFiles, radGeoFile, studyFolder, done; plug-in component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
gethbzoneepschedules = Honeybee_GetZoneEnergyPlusSchedules(HBZone=createhbzones.HBZone)  # -> occupancySchedule, occupancyActivitySch, heatingSetPtSchedule, coolingSetPtSchedule, lightingSchedule, equipmentSchedule, infiltrationSchedule; plug-in component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

# ----
# 4. Daylight Autonomy
post_process_rusults = BooleanToggle(True)
readannualresultsi = Honeybee_ReadAnnualResultI(
    illFilesAddress=rundaylightanalysis.resultFiles,
    testPoints=simplify(rundaylightanalysis.testPts),
    occupancyFiles=occupancygenerator,
    DLAIllumThresholds=300,
    runIt=post_process_rusults)  # -> DLA, UDLI_Less_100, UDLI_100_2000, UDLI_More_2000, CDA, sDA, annualProfiles, htmReport; plug-in component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
larger_than = LargerThan(FirstNumber=readannualresultsi.DLA, SecondNumber="50")  # -> LargerThan, OrEqualTo
gradientlibrary = Ladybug_GradientLibrary(gradIndex=Slider(0, range=0..100))  # -> customColors; plug-in component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
gate_not = GateNot(A=larger_than.OrEqualTo)
legend = Legend(Colour=gradientlibrary, Tags=["One Fish", "Two Fish", "Red Fish", "Blue Fish"], LegendType=1)
legendpar = Ladybug_LegendParameters(
    lowBound="0",
    highBound="100",
    numSegments=Slider(6, range=0..10),
    customColors=flatten(gradientlibrary),
    fontSize=Slider(0.02, range=0..0.1))  # -> legendPar; plug-in component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
cull_pattern = CullPattern(List=mesh_uv, CullPattern=larger_than.OrEqualTo)
mesh_colours = MeshColours(Mesh=cull_pattern, Colours=ColourSwatch(SwatchColor=RGB(255, 244, 97)))
mesh_join = MeshJoin(Meshes=mesh_colours)
recolormesh = Ladybug_RecolorMesh(
    analysisResult=readannualresultsi.DLA,
    inputMesh=mesh_uv,
    legendPar=legendpar,
    analysisTitle=rundaylightanalysis.analysisType,
    legendTitle=rundaylightanalysis.resultsUnit)  # -> out, newMesh, newLegend, legendBasePt, meshColors, legendColors; plug-in component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

# ----
# 7. Energy Simulation
# Generate lighting Schedule
toggle_2 = BooleanToggle(True)
readannualresultsi_2 = Honeybee_ReadAnnualResultI(
    illFilesAddress=rundaylightanalysis.resultFiles,
    testPoints=simplify(rundaylightanalysis.testPts),
    occupancyFiles=gethbzoneepschedules.lightingSchedule,
    DLAIllumThresholds=300,
    lightingControlGroups=lightingcontrol,
    runIt=toggle_2)  # -> DLA, UDLI_Less_100, UDLI_100_2000, UDLI_More_2000, CDA, sDA, annualProfiles, htmReport; plug-in component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
setepzoneschedules = Honeybee_SetEnergyPlusZoneSchedules(HBZones=createhbzones.HBZone, lightingSchedules=readannualresultsi_2.annualProfiles)  # -> schedules, simplify(HBZones); plug-in component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
toggle_3 = BooleanToggle(True)
epoutput = Honeybee_GenerateEPOutput(
    zoneEnergyUse=toggle_3,
    zoneGainsAndLosses=toggle_3,
    zoneComfortMetrics="False",
    surfaceTempAnalysis="False",
    surfaceEnergyAnalysis=toggle_3)  # -> report, flatten(simulationOutputs); plug-in component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
toggle_4 = BooleanToggle(True)
runenergysimulation = Honeybee_RunEnergySimulation(
    north=number_slider_6,
    epwFile=epw_stat.epwFile,
    HBZones=flatten(setepzoneschedules.HBZones),
    simulationOutputs=flatten(epoutput.simulationOutputs),
    writeIdf=toggle_4,
    runEnergyPlus=toggle_4)  # -> readMe, idfFileAddress, resultFileAddress, eioFileAddress, rddFileAddress, htmlReport, studyFolder; plug-in component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
readepresult = Honeybee_ReadEPResult(resultFileAddress=runenergysimulation.resultFileAddress)  # -> totalThermalLoad, thermalLoadBalance, cooling, heating, electricLight, electricEquip, fanElectric, pumpElectric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; plug-in component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
selectandaveragedata = Ladybug_AverageData(annualHourlyData=[readepresult.cooling, readepresult.electricLight, readepresult.heating])  # -> readMe, selHourlyData, averagedDaily, averagedMonthly, avrMonthlyPerHour, avrMonthlyMinPerHour, avrMonthlyMaxPerHour; plug-in component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
strnum = Ladybug_SeparateData(inputList=flatten(readepresult.electricLight))  # -> numbers, strings; plug-in component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
strnum_2 = Ladybug_SeparateData(inputList=flatten(readepresult.cooling))  # -> numbers, strings; plug-in component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
strnum_3 = Ladybug_SeparateData(inputList=flatten(readepresult.heating))  # -> numbers, strings; plug-in component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
ma_2 = MassAddition(Input=strnum.numbers)  # -> Result, PartialResults
ma_3 = MassAddition(Input=strnum_2.numbers)  # -> Result, PartialResults
ma_4 = MassAddition(Input=strnum_3.numbers)  # -> Result, PartialResults
point_2 = Point(Point(24.26180731, -17.51868464, 0))
legendpar_2 = Ladybug_LegendParameters(fontSize=Slider(0.005, range=0..0.01))  # -> legendPar; plug-in component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
barchart = Ladybug_MonthlyBarChart(
    inputData=flatten(selectandaveragedata.averagedMonthly),
    stackValues=Toggle(True),
    plotFromZero=Toggle(True),
    basePoint=point_2,
    xScale=number_slider_2,
    yScale=number_slider_2,
    legendPar=legendpar_2)  # -> readMe, dataMesh, dataCurves, dataCrvColors, graphAxes, graphLabels, title, titleBasePt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; plug-in component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

# ----
# sDA - no blinds
# (Spatial Daylight Autonomy)
mesh = Mesh(mesh_join)

legend_2 = Geometry([barchart.legend, barchart.legendBasePt, barchart.comfortBand, barchart.comfortLegend])
graph = Geometry([barchart.title, barchart.graphLabels, barchart.graphAxes, barchart.dataMesh, barchart.titleBasePt])

mass_addition_2 = MassAddition(Input=[ma_4.Result, ma_3.Result, ma_2.Result])  # -> Result, PartialResults
annual_total_electriclight_kw = Panel(ma_2.Result)
annual_total_cooling_kw = Panel(ma_3.Result)
annual_total_heating_kw = Panel(ma_4.Result)
annual_total_electric_kw = Panel(mass_addition_2.Result)

wlc_minimize_construction_cost = Number(mass_addition.Result)
construction_time = Number(integer_6)
area_8 = Number(area_4.Area)  # disabled
electricity_consumption = Number(mass_addition_2.Result)
interiorwall_cost = Integer(interior_wall_3)
totalcooling = Number(annual_total_cooling_kw)
totalheating = Number(annual_total_heating_kw)
window_cost_2 = Integer(window_cost)
electriclight = Number(annual_total_electriclight_kw)
window_n = Data(total_windows_number)
terrace_cost_2 = Integer(terrace_cost)
facade_cost = Integer(facade_wall_cost)
da_mesh_grid = Number(readannualresultsi.DLA)
wall_n = Data(total_wall_panels_number)
sda = Number(readannualresultsi.sDA)
len_y = Data(length_y_m)
len_x = Data(length_x_m)

integer_8 = Integer(area_8)  # disabled
text = Text(terrace_cost_2)
integer_9 = Integer(electriclight)
integer_10 = Integer(totalcooling)
integer_11 = Integer(totalheating)
integer_12 = Integer(sda)
panel_21 = Panel(integer_8)  # disabled
integer_13 = Integer(electricity_consumption)
ghpython_script_6 = GhPythonScript(x=text)  # -> out
# ---------- ghpython_script_6: Python ----------
import Rhino.Geometry as rg

if x is None:
    print(0)
# ---------- end ghpython_script_6 ----------
integer_14 = Integer(da_mesh_grid)
panel_22 = Panel(construction_time)
panel_23 = Panel(wlc_minimize_construction_cost)
panel_24 = Panel(integer_9)
panel_25 = Panel(integer_10)
panel_26 = Panel(integer_11)
panel_27 = Panel(integer_12)
panel_28 = Panel(integer_13)
panel_29 = Panel(len_x)
panel_30 = Panel(len_y)
panel_31 = Panel(wall_n)
panel_32 = Panel(window_n)
panel_33 = Panel(interiorwall_cost)
panel_34 = Panel(ghpython_script_6)
panel_35 = Panel(window_cost_2)
panel_36 = Panel(integer_14)
panel_37 = Panel(facade_cost)

# ----
# sDA
sda_per_space = Panel(readannualresultsi.sDA)

# ----
# DA
mesh_2 = Mesh([recolormesh.newMesh, recolormesh.newLegend])

panel_38 = Panel(gethbzoneepschedules.lightingSchedule)
panel_39 = Panel(readannualresultsi.DLA)
panel_40 = Panel(readepresult.totalThermalLoad)
panel_41 = Panel(recolormesh.meshColors)
panel_42 = Panel(mesh_2)

labels = Panel("""City
ConstructionTime
ConstructionCost
Rotation
LengthX
LengthY
Wall_num
Window_num
sDA
TotalElec
Light
Cooling
Heating
TerraceCost
WindowCost
ExtCost
IntCost""")
merge_6 = Merge(
    Data1=flatten(construction_time),
    Data2=flatten(wlc_minimize_construction_cost),
    Data3=flatten(panel_20),
    Data4=flatten(panel_29),
    Data5=flatten(panel_30),
    Data6=flatten(panel_31),
    Data7=flatten(panel_32),
    Data8=flatten(panel_27),
    Data9=flatten(panel_28),
    Data10=flatten(panel_24),
    Data11=flatten(panel_25),
    Data12=flatten(panel_26),
    Data13=flatten(panel_34),
    Data14=flatten(panel_35),
    Data15=flatten(panel_37),
    Data16=flatten(panel_33),
    Data17=flatten(panel_36))
ghpython_script_7 = GhPythonScript(x=value_list)  # -> out
# ---------- ghpython_script_7: Python ----------
import Rhino.Geometry as rg

if x == 0:
    print("Ils-de-France")
elif x == 1:
    print("San_Paulo")
else:
    print("Concepcion")
# ---------- end ghpython_script_7 ----------
panel_43 = Panel(ghpython_script_7)
list_length_4 = ListLength(List=merge_6)
workingdir_3 = Panel("C:\Users\kimky\Desktop\tmp\DATASET_V7_studio.csv")
insert_items = InsertItems(List=merge_6, Item=panel_43, Indices=expr("x+1", list_length_4), Wrap=True)
join = TextJoin(Text=insert_items, Join=",")
num = Number(number_slider)
panel_44 = Panel(insert_items)

merge_7 = Merge(Data1=flatten(labels), Data2=flatten(panel_17))

join_2 = TextJoin(Text=merge_7, Join=",")
export_robotmotion_3_r3_multi = PythonScript(toggle=Toggle(True), path=workingdir_3, x=join, labs=join_2, y=num)
# ---------- export_robotmotion_3_r3_multi: Python ----------
#script by Gabriella Rossi / CITA
import os
from os import listdir
from os.path import isfile, join
from scriptcontext import sticky as st

if True:
    #Create file
    filename = str(path)
    fil = open(filename, 'a+')
    
    if y < 1 :

        #write header and first line
        fil.write(labs)
        fil.write('\n' + x)
    else:
        #just write line
        fil.write('\n' + x)

    fil.close()
# ---------- end export_robotmotion_3_r3_multi ----------

panel_45 = Panel(merge_7)
concatenate = Concatenate(FragmentA=panel_45, FragmentB=panel_44)
panel_46 = Panel(concatenate)
merge_8 = Merge(Data1=labels, Data2=panel_44)

panel_47 = Panel("How are you? ")
get_string = GetString(AtLeast=1, AtMost=2147483647)
pt = Point(Point(-4371.132221, 32662.61474, 0))
bool = Boolean(True)
c_script = CSharpScript(face="Verdana", bold=bool, size=Slider(1, range=0..1), content=merge_8, pl=pt)  # -> out, A; inputs face: String, bold: Boolean, italics: Boolean, size: Double, content: String, pl: Plane
# ---------- c_script: C# usings ----------
using System.IO;
using System.Linq;
using System.Data;
using System.Drawing;
using System.Reflection;
using System.Windows.Forms;
using System.Xml;
using System.Xml.Linq;
using System.Runtime.InteropServices;

using Rhino.DocObjects;
using Rhino.Collections;
using GH_IO;
using GH_IO.Serialization;
# ---------- c_script: C# ----------
    if(size == 0)
      size = 1;

    if(!string.IsNullOrEmpty(face) && size > 0 && !string.IsNullOrEmpty(content) &&
      pl.IsValid)
    {
      using (var doc = Rhino.RhinoDoc.CreateHeadless(null))
      {
        var te = doc.Objects.AddText(content, pl, size, face, bold, italics);
        var txt = doc.Objects.Find(te) as Rhino.DocObjects.TextObject;

        if(txt != null)
        {
          var tt = txt.Geometry as Rhino.Geometry.TextEntity;
          A = tt.Explode();
        }
      }
    }
# ---------- end c_script ----------

# ----
# TITLE
# GENERATIVE OUTPUT
# ERROR
# QUESTION
# OUTPUT
# INPUT
panel_48 = Panel(merge_8)

# ---- group: RH_OUT:text_lines
crv_230 = Curve(c_script.A)

# ---- group: TEXT _ Average in Curve
unit_y = UnitY(Factor=Slider(0, range=0..100))
move_3 = Move(Geometry=crv_230, Motion=unit_y)  # -> Geometry, Transform

# ----
custom_preview_lineweights_4 = CustomPreviewLineweights(Geometry=move_3.Geometry, Shader=ColourSwatch(SwatchColor=RGB(0, 0, 0)), Absolute=False)

# ==== cluster Cluster
d1 = ClusterInput()
d2 = ClusterInput()
merge = Merge(Data1=d1, Data2=d2)
item = ListItem(List=merge, Index=0, Wrap=True)
L = ClusterInput()
Z = UnitZ(Factor="2.44")
item_2 = ListItem(List=L, Index=0, Wrap=True)  # -> Item, Item1, Item2, Item3
explode = Explode(Curve=item, Recursive=True)  # -> Segments, Vertices
item_3 = ListItem(List=explode.Vertices, Index=3, Wrap=True)
vec2pt = Vector2Pt(PointA=item_3, PointB=item_2.Item, Unitize=False)  # -> Vector, Length
G = ClusterInput()
hb_o = ClusterInput()
hb_c = ClusterInput()
G_2 = ClusterInput()
G_3 = ClusterInput()
move = Move(Geometry=merge, Motion=vec2pt.Vector)  # -> Geometry, Transform
move_2 = Move(Geometry=G, Motion=vec2pt.Vector)  # -> Geometry, Transform
move_3 = Move(Geometry=G_2, Motion=vec2pt.Vector)  # -> Geometry, Transform
move_4 = Move(Geometry=hb_o, Motion=vec2pt.Vector)  # -> Geometry, Transform
move_5 = Move(Geometry=G_3, Motion=vec2pt.Vector)  # -> Geometry, Transform
move_6 = Move(Geometry=hb_c, Motion=vec2pt.Vector)  # -> Geometry, Transform
item_4 = ListItem(List=move.Geometry, Index=0, Wrap=True)
area = Area(Geometry=item_4)  # -> Area, Centroid
explode_2 = Explode(Curve=item_4, Recursive=True)  # -> Segments, Vertices
crv_cp = CurveClosestPoint(Point=area.Centroid, Curve=explode_2.Segments)  # -> Point, Parameter, Distance
A = ClusterInput()
B = ClusterInput()
item_5 = ListItem(List=crv_cp.Point, Index=0, Wrap=True)  # -> Item, Item1, Item2, Item3
vec2pt_2 = Vector2Pt(PointA=A, PointB=B, Unitize=False)  # -> Vector, Length
vec2pt_3 = Vector2Pt(PointA=area.Centroid, PointB=item_5.Item3, Unitize=False)  # -> Vector, Length
angle = Angle(VectorA=vec2pt_2.Vector, VectorB=vec2pt_3.Vector)  # -> Angle, Reflex
rotate = Rotate(Geometry=move.Geometry, Angle=angle.Angle, Plane=area.Centroid)  # -> Geometry, Transform
rotate_2 = Rotate(Geometry=move_2.Geometry, Angle=angle.Angle, Plane=area.Centroid)  # -> Geometry, Transform
rotate_3 = Rotate(Geometry=move_3.Geometry, Angle=angle.Angle, Plane=area.Centroid)  # -> Geometry, Transform
rotate_4 = Rotate(Geometry=move_5.Geometry, Angle=angle.Angle, Plane=area.Centroid)  # -> Geometry, Transform
rotate_5 = Rotate(Geometry=move_4.Geometry, Angle=angle.Angle, Plane=area.Centroid)  # -> Geometry, Transform
rotate_6 = Rotate(Geometry=move_6.Geometry, Angle=angle.Angle, Plane=area.Centroid)  # -> Geometry, Transform
item_6 = ListItem(List=rotate.Geometry, Index=0, Wrap=True)
cull_i = CullIndex(List=rotate.Geometry, Indices=0, Wrap=True)
addition = Addition(A="2.44", B="0.2")
boundary = BoundarySurfaces(Edges=item_6)
Z_2 = UnitZ(Factor="-.2")
Z_3 = UnitZ(Factor=addition)

# ---- group: Slab
extr = Extrude(Base=boundary, Direction=Z_2)

# ---- group: Windows
extr_2 = Extrude(Base=rotate_3.Geometry, Direction=Z)

# ---- group: Roof
move_7 = Move(Geometry=extr, Motion=Z_3)  # -> Geometry, Transform

# ---- group: Profiles
extr_3 = Extrude(Base=rotate_4.Geometry, Direction=Z)

# ---- group: Facades
extr_4 = Extrude(Base=rotate_2.Geometry, Direction=Z)

# ---- group: Interior partitions
extr_5 = Extrude(Base=cull_i, Direction=Z)

# ----
slab = ClusterOutput(extr)
E = ClusterOutput(extr_2)
E_2 = ClusterOutput(extr_3)
hb_o_2 = ClusterOutput(rotate_5.Geometry)
hb_c_2 = ClusterOutput(rotate_6.Geometry)
G_4 = ClusterOutput(move_7.Geometry)
cap_holes = CapHoles(Brep=extr_5)
cap_holes_2 = CapHoles(Brep=extr_4)
brep = ClusterOutput(cap_holes)
brep_2 = ClusterOutput(cap_holes_2)
