# Grasshopper definition STUDIO V7_2021.06.02_ML-GEOMETRY.gh (Grasshopper 1.0.7)
# Copyright: BiB in Paris, 2021
# plug-ins: Bifocals, Human, Pufferfish, Hops, Triceratops

boolean_toggle = BooleanToggle(True)
# NOTE
note = Panel("")
# KPF GH Standards
# Inputs
input_data = Panel("")
# USER INPUT
input_data_2 = Panel("")
# CURVE INPUT FROM USER
# INPUT FOR
# APPSERVER
get_geometry = GetGeometry(AtLeast=1, AtMost=2147483647, Filter=1074004029)
get_point = GetPoint(AtLeast=1, AtMost=2147483647, Realtime=True)
# OUTPUT
# NUMERIC DATA
action_panel = Panel("")
button = Button()
curve = Curve(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)

# ---- group: Point house
point = Point(Point(-2433.26565, 1922.78462, 0))

# ----
# OUTPUT
# GEOMETRY
geometry = Panel("")
panel = Panel("SITE")
panel_2 = Panel("LOCATION")
deconstruct = Deconstruct(Point=point)  # -> XComponent, YComponent, ZComponent
# HOPS
cost = Slider(38482, range=5486..55176)
rotation_degree = Slider(40, range=0..150)
dash_pattern = DashPattern(Curve=curve, Pattern=Slider(100, range=0..100))  # -> Dashes, Gaps
construct_point = ConstructPoint(XCoordinate=deconstruct.XComponent, YCoordinate=deconstruct.YComponent, ZCoordinate=0)
explode = Explode(Curve=curve, Recursive=True)  # -> Segments, Vertices
panel_3 = Panel("http://127.0.0.1:5000/ ")
custom_preview_lineweights = CustomPreviewLineweights(
    Geometry=dash_pattern.Dashes,
    Shader=ColourSwatch(SwatchColor=RGB(255, 0, 0)),
    Thickness=Slider(5, range=0..10),
    Absolute=False)
boundary_surfaces = BoundarySurfaces(Edges=explode.Segments)
# OPTIMIZATION
# SOLVER
result_panel = Panel("")
stack_data = StackData(Data=["Lighting(kW)/year : ", "Heating_electricity(kW)/year : ", "Cooling_electricity(kW)/year : "], Stack=1)
construct_domain = ConstructDomain(DomainStart=0, DomainEnd=1)

# ----
# GRAPH FOR
# APPSERVER
area = Area(Geometry=boundary_surfaces)  # -> Area, Centroid
division = Division(A=area.Area, B="10000")
ma = MassAddition(Input=flatten(division))  # -> Result, PartialResults
site_surface_m2 = Panel(division)
total_site_area = Number(ma.Result)

random = Random(Range="1.0", Number=4, Seed=2)  # -> simplify(graft(Random))
explode_tree = ExplodeTree(Data=random)  # -> Branch0, Branch1, Branch2, Branch3

# ---- group: Size of panel(cm)
number_slider = Slider(122, range=0..122)
number_slider_2 = Slider(0, range=0..20)

# ----
panel_4 = Panel("PRE-FAB MODELS")

# ---- group: Roof Thickness
roof_thk = Slider(15, range=0..25)
floor_thk = Slider(10, range=0..25)

# ---- group: WALL THICKNESS(cm)
wall_thk = Slider(15, range=5..40)
wall_height = Panel("244")

# ----
window_frame_thk = Panel("10")
window_frame_thk_2 = Panel("2")
window_frame_scale = Panel("0.92")

# ---- group: Height of panels
Z = UnitZ(Factor=wall_height)

# ---- group: One panel
# *NOTA: 1 m2 = 10.764 Square foot
# SIP WOOD:17-30$/m2, here, 20$
# Wood window type Bay : 800-2700$, here 1000$
multiplication = Multiplication(A=number_slider, B=wall_height)
division_2 = Division(A=multiplication, B="10000")
area_m2 = Panel(division_2)

# ----
rotation = Data(rotation_degree)
panel_5 = Panel("VISUALISATION")
nickname = RelativePath()
panel_6 = Panel(nickname)
number_slider_3 = Slider(660, range=0..1000)
construct_point_2 = ConstructPoint(XCoordinate=number_slider_3, YCoordinate=0, ZCoordinate=0)
unit_z = UnitZ(Factor=number_slider_3)
number_slider_4 = Slider(20, range=0..100)
panel_7 = Panel("/materials/roof_slates_02_1k_jpg/roof_slates_02_rough_1k.jpg")
swatch = ColourSwatch(SwatchColor=RGB(250, 180, 213))
swatch_2 = ColourSwatch(SwatchColor=RGB(230, 222, 168))
panel_8 = Panel("/Lserver/materials/brown_planks_05_2k_jpg/brown_planks_05_diff_2k.jpg")
panel_9 = Panel("/materials/roof_slates_02_1k_jpg/roof_slates_02_diff_1k.jpg")
panel_10 = Panel("/Lserver/materials/brown_planks_05_2k_jpg/brown_planks_05_rough_2k.jpg")
panel_11 = Panel("/Lserver/materials/brown_planks_05_2k_jpg/brown_planks_05_nor_2k.jpg")
concat = Concatenate(FragmentA=nickname, FragmentB="/Lserver/materials/plywood_2k_jpg/plywood_nor_2k.jpg")
imgsettings = ImageSettings(Saturation=1, Contrast=Slider(-0.81, range=-1..1), Lightness=Slider(0.39, range=-1..1))
concat_2 = Concatenate(FragmentA=nickname, FragmentB="/Lserver/materials/plywood_2k_jpg/plywood_diff_2k.jpg")
texturesettings = TextureSettings(
    WrapS=0,
    WrapT=0,
    RepeatU=number_slider_4,
    RepeatV=number_slider_4,
    OffsetU=1,
    OffsetV=1,
    CenterU=1,
    CenterV=1,
    Rotation=0)
brep = Brep([<brep referenced from the Rhino model> x2])
crv = Curve([<curve referenced from the Rhino model> x2])
mesh = Mesh([<mesh referenced from the Rhino model> x6])
pt = Point([<point referenced from the Rhino model> x8])
texture = Texture(ImagePath=concat_2, ImageSettings=imgsettings)
texture_2 = Texture(ImagePath=concat, ImageSettings=imgsettings)
standardmat = MeshStandardMaterial(Color=swatch, Opacity=1, Roughness=1, Metalness=0.5, Emissive=RGB(0, 0, 0), EmissiveIntensity=1)
mesh_2 = Mesh([<mesh referenced from the Rhino model> x133])
standardmat_2 = MeshStandardMaterial(Color=swatch_2, Opacity=1, Roughness=1, Metalness=0.5, Emissive=RGB(0, 0, 0), EmissiveIntensity=1)
pointsmat = PointsMaterial(Color=swatch_2, Size=Slider(0.05, range=0..0.1), SizeAttenuation=True, AlphaTest=0.5)
linebasicmat = LineBasicMaterial(Color=swatch, LineWidth=1)
crv_2 = Curve([<curve referenced from the Rhino model> x34])
brep_2 = Brep(boundary_surfaces)
standardmat_3 = MeshStandardMaterial(
    Color=ColourSwatch(SwatchColor=RGB(145, 145, 145)),
    Opacity=1,
    Roughness=1,
    Metalness=0.5,
    Emissive=RGB(0, 0, 0),
    EmissiveIntensity=1)
standardmat_4 = MeshStandardMaterial(
    Color=ColourSwatch(SwatchColor=RGB(112, 112, 112)),
    Opacity=1,
    Roughness=1,
    Metalness=0.5,
    Emissive=RGB(0, 0, 0),
    EmissiveIntensity=1)
linedashmat = LineDashedMaterial(
    Color=ColourSwatch(SwatchColor=RGB(86, 156, 196)),
    LineWidth=1,
    DashSize=Slider(1, range=0..1),
    GapSize=Slider(0.5, range=0..1))
topoly = CurveToPolyline(Curve=crv, ToleranceDistance=0, ToleranceAngle=Slider(0.1, range=0..1))  # -> Polyline, Segments
brep_3 = Brep([<brep referenced from the Rhino model> x2])
linebasicmat_2 = LineBasicMaterial(Color=ColourSwatch(SwatchColor=RGB(173, 173, 173)), LineWidth=1)
mesh_3 = Mesh(brep)
crv_3 = Curve([<curve referenced from the Rhino model> x3])
imgsettings_2 = ImageSettings(Saturation=1, Contrast=Slider(-0.81, range=-1..1), Lightness=Slider(0.39, range=-1..1))
concat_3 = Concatenate(FragmentA=nickname, FragmentB=panel_10)
concat_4 = Concatenate(FragmentA=nickname, FragmentB=panel_8)
concat_5 = Concatenate(FragmentA=nickname, FragmentB=panel_11)
imgsettings_3 = ImageSettings(Saturation=1, Contrast=Slider(-0.75, range=-1..1), Lightness=0)
concat_6 = Concatenate(FragmentA=nickname, FragmentB=panel_7)
concat_7 = Concatenate(FragmentA=nickname, FragmentB=panel_9)
concat_8 = Concatenate(FragmentA=nickname, FragmentB="/materials/roof_slates_02_1k_jpg/roof_slates_02_nor_1k.jpg")
number_slider_5 = Slider(0.7, range=0..1)
number_slider_6 = Slider(2.2, range=0..10)
mesh_4 = Mesh(Mesh=mesh_2, Name="furniture", Material=standardmat, DecimalAccuracy=3)
mesh_5 = Mesh(Mesh=mesh, Name="objects", Material=standardmat_2, DecimalAccuracy=3)
line = Line(Line=flatten(crv_3), LineMaterial=linedashmat, DecimalAccuracy=3)
line_2 = Line(Line=flatten(topoly.Polyline), Name="driveway", LineMaterial=linebasicmat_2, DecimalAccuracy=3)
mesh_6 = Mesh(brep_2)
line_3 = Line(Line=crv_2, Name="strings", LineMaterial=linebasicmat, DecimalAccuracy=3)
texture_3 = Texture(ImagePath=concat_3, MapSettings=texturesettings)
mesh_7 = Mesh(Mesh=brep_3, Name="pavers", Material=standardmat_3, DecimalAccuracy=3)
points = Points(Points=pt, Name="sparks", PointsMaterial=pointsmat, DecimalAccuracy=3)
texture_4 = Texture(ImagePath=concat_4, ImageSettings=imgsettings_2, MapSettings=texturesettings)
texture_5 = Texture(ImagePath=concat_5, MapSettings=texturesettings)
mesh_8 = Mesh(Mesh=mesh_3, Name="concrete", Material=standardmat_4, DecimalAccuracy=3)
texture_6 = Texture(ImagePath=concat_6)
texture_7 = Texture(ImagePath=concat_7, ImageSettings=imgsettings_3)
texture_8 = Texture(ImagePath=concat_8)
shadowmat = ShadowMaterial(Color=RGB(0, 0, 0), Opacity=Slider(0.1, range=0..1))
neg = Negative(Value=Slider(588, range=0..10000))
neg_2 = Negative(Value=Slider(5659, range=0..10000))
meshstandardmaterial_maps = MeshStandardMaterialMaps(Map=texture, AlphaTest=0.5, BumpScale=1, DisplacementScale=1, NormalMap=texture_2, EnvMapIntensity=1, AoMapIntensity=1)
pt_2 = Point(Point(3012.330751, -5088.933709, 3274.054541))
meshstandardmaps = MeshStandardMaterialMaps(
    Map=texture_4,
    AlphaTest=0.5,
    BumpScale=1,
    DisplacementScale=1,
    NormalMap=texture_5,
    EnvMapIntensity=1,
    RoughnessMap=texture_3,
    AoMapIntensity=1)
meshstandardmaps_2 = MeshStandardMaterialMaps(
    Map=texture_7,
    AlphaTest=0.5,
    BumpScale=1,
    DisplacementScale=1,
    NormalMap=texture_8,
    EnvMapIntensity=1,
    RoughnessMap=texture_6,
    AoMapIntensity=1)
mesh_9 = Mesh(Mesh=mesh_6, Material=shadowmat, DecimalAccuracy=3)
hemilight = HempisphereLight(
    Color=ColourSwatch(SwatchColor=RGB(237, 248, 255)),
    GroundColor=ColourSwatch(SwatchColor=RGB(217, 205, 189)),
    Intensity=Slider(22, range=0..100))

# ----
# Floor
panel_12 = Panel("meshStandardMaterial")
standardmat_5 = MeshStandardMaterial(
    Color=ColourSwatch(SwatchColor=RGB(186, 186, 186)),
    Opacity=1,
    Roughness=1,
    Metalness=0.5,
    Emissive=RGB(0, 0, 0),
    EmissiveIntensity=1)
mesh_10 = Mesh(Mesh=mesh_6, Name=panel_12, Material=standardmat_5, DecimalAccuracy=3)

directionallight = DirectionalLight(
    Position=pt_2,
    Color=RGB(255, 255, 255),
    Intensity=Slider(70, range=0..100),
    CastShadow=Toggle(True),
    ShadowTop=Slider(5562, range=0..10000),
    ShadowBottom=neg,
    ShadowRight=Slider(3697, range=0..10000),
    ShadowLeft=neg_2,
    ShadowNear=0,
    ShadowFar=Slider(10000, range=0..10000))  # -> Helper, Light
preview = CustomPreview(
    Geometry=directionallight.Helper,
    Material={diffuse=RGB(221, 160, 221), emission=RGB(66, 48, 66), shine=0.5, specular=RGB(255, 255, 255), transparency=0})
standardmat_6 = MeshStandardMaterial(
    Color=ColourSwatch(SwatchColor=RGB(255, 249, 217)),
    Opacity=1,
    Roughness=1,
    Metalness=0.5,
    Emissive=RGB(0, 0, 0),
    EmissiveIntensity=1,
    Maps=meshstandardmaps)
standardmat_7 = MeshStandardMaterial(
    Color=ColourSwatch(SwatchColor=RGB(140, 132, 112)),
    Opacity=1,
    Roughness=Slider(0.7, range=0..1),
    Metalness=Slider(0.2, range=0..1),
    Emissive=RGB(0, 0, 0),
    EmissiveIntensity=1,
    Maps=meshstandardmaterial_maps)
standardmat_8 = MeshStandardMaterial(
    Color=ColourSwatch(SwatchColor=RGB(209, 206, 180)),
    Opacity=1,
    Roughness=1,
    Metalness=0.5,
    Emissive=RGB(0, 0, 0),
    EmissiveIntensity=1)
standardmat_9 = MeshStandardMaterial(
    Color=ColourSwatch(SwatchColor=RGB(230, 230, 230)),
    Opacity=1,
    Roughness=1,
    Metalness=0.5,
    Emissive=RGB(0, 0, 0),
    EmissiveIntensity=1)
standardmat_10 = MeshStandardMaterial(
    Color=ColourSwatch(SwatchColor=RGB(115, 115, 115)),
    Opacity=1,
    Roughness=1,
    Metalness=0.5,
    Emissive=RGB(0, 0, 0),
    EmissiveIntensity=1,
    Maps=meshstandardmaps_2)
basicmat = MeshBasicMaterial(Color=ColourSwatch(SwatchColor=RGB(0, 0, 0)))
brep_4 = Brep([<brep referenced from the Rhino model> x11])
brep_5 = Brep([<brep referenced from the Rhino model> x11])
standardmat_11 = MeshStandardMaterial(
    Color=ColourSwatch(SwatchColor=RGB(224, 224, 224)),
    Opacity=1,
    Roughness=Slider(0.5, range=0..1),
    Metalness=0.5,
    Emissive=RGB(0, 0, 0),
    EmissiveIntensity=1)
brep_6 = Brep([<brep referenced from the Rhino model> x12])
brep_7 = Brep([<brep referenced from the Rhino model> x58])
brep_8 = Brep([<brep referenced from the Rhino model> x2])
merge = Merge(Data1=mesh_4, Data2=line_3, Data3=mesh_5, Data4=points)
merge_2 = Merge(Data1=mesh_8, Data2=mesh_7, Data3=line_2, Data4=line)
mesh_11 = Mesh(Mesh=brep_7, Name="joists", Material=standardmat_8, DecimalAccuracy=3)
mesh_12 = Mesh(Mesh=brep_4, Name="plaster", Material=standardmat_9, DecimalAccuracy=3)
mesh_13 = Mesh(Mesh=brep_5, Name="shingles", Material=standardmat_10, DecimalAccuracy=3)
mesh_14 = Mesh(Mesh=brep_6, Name="black", Material=basicmat, DecimalAccuracy=3)
mesh_15 = Mesh(Mesh=brep_8, Name="counters", Material=standardmat_11, DecimalAccuracy=3)
merge_3 = Merge(Data1=mesh_9, Data2=directionallight.Light, Data3=hemilight)

# ---- group: Server Your Website
concat_9 = Concatenate(FragmentA=nickname, FragmentB="/Lserver/www")
http = HTTPServer(Path=concat_9, Run=Toggle(True))

# ----
panel_13 = Panel(concat_9)

construction_time = Slider(34, range=1..47)

hops = Hops(
    ConstructionCost=cost,
    RotationAngleFromNorth=rotation_degree,
    ConstructionTime=construction_time,
    CacheResultsInMemory=True,
    CacheSolveResults=True,
    RemoteDefinitionLocation="http://127.0.0.1:5000/runML3",
    RemoteSolveVersion=(0, 1, 0),
    ShowInput_Enabled=False,
    ShowInput_Path=False,
    SynchronousSolve=True)  # -> LengthX, LengthY, WallPanelsNumber, WindowPanelsNumber, SpatialDaylightAutonomy, TotalElectricityConsumption, LightElectricityConsumption, CoolingElectricityConsumption, HeatingElectricityConsumption
panel_14 = Panel(hops.HeatingElectricityConsumption)
panel_15 = Panel(hops.LightElectricityConsumption)
panel_16 = Panel(hops.CoolingElectricityConsumption)

y_panels = Data(hops.LengthY)
x_panels = Data(hops.LengthX)
sda = Data(hops.SpatialDaylightAutonomy)
electricity = Data(hops.TotalElectricityConsumption)
panel_17 = Panel(sda)
panel_18 = Panel(electricity)

stack_data_2 = StackData(Data=[panel_15, panel_16, panel_14], Stack=1)
bounds = Bounds(Numbers=hops.WindowPanelsNumber)
division_3 = Division(A=hops.WindowPanelsNumber, B=100)
bounds_2 = Bounds(Numbers=hops.WallPanelsNumber)

number_slider_7 = Slider(400, range=0..1000)
panel_19 = Panel(stack_data_2)
panel_20 = Panel(stack_data)
point_2 = Point(Point(616.1651131, 796.9389297, 0))
cluster = Cluster_2(
    R_3=Slider(271, range=0..1000),
    R=number_slider_7,
    point=point_2,
    A=Slider(67, range=0..100),
    integer=panel_19,
    A_2=Slider(44, range=0..100),
    data=panel_20,
    R_2=number_slider_7)  # -> i, K, A_3, i_2, integer_3, G_2, label_color_2, data_3, G
gradient = Gradient(
    LowerLimit=cluster.i,
    UpperLimit=cluster.i_2,
    Parameter=cluster.K,
    stops=[0: RGB(74, 61, 210), 0: RGB(255, 0, 0), 0: RGB(164, 78, 194), 0: RGB(22, 129, 145), 0: RGB(200, 1, 135), 0: RGB(234, 19, 70), 0: RGB(0, 43, 240), 0: RGB(255, 255, 0), 0: RGB(0, 128, 0), 0.0116: RGB(58, 142, 227), 1: RGB(255, 0, 255)])
preview_2 = CustomPreview(Geometry=cluster.A_3, Shader=gradient)
tag = TextTag(Location=cluster.G_2, Text=cluster.integer_3, Colour=cluster.label_color_2)
tag_2 = TextTag(Location=cluster.G, Text=cluster.data_3, Colour=cluster.label_color_2)

remap_numbers = RemapNumbers(Value=hops.WindowPanelsNumber, Source=bounds, Target=construct_domain)  # -> Mapped, Clipped
panel_21 = Panel(division_3)
remap_numbers_2 = RemapNumbers(Value=hops.WallPanelsNumber, Source=bounds_2, Target=Domain(0, 1))  # -> Mapped, Clipped
panel_22 = Panel(bounds_2)
subtraction = Subtraction(A="1.0", B=panel_21)
x_panels_2 = Number(x_panels)
y_panels_2 = Number(y_panels)
ghpython_script = GhPythonScript(x=x_panels_2)  # -> out, a
# ---------- ghpython_script: Python ----------
import Rhino.Geometry as rg

if x <= 0:
    a = "ERROR! The If cost is high, give high number for cost,too"
    print(a)

else:
    a = int(x)
    print(int(a))
# ---------- end ghpython_script ----------
ghpython_script_2 = GhPythonScript(x=y_panels_2)  # -> out, a; same code as ghpython_script

# ----
# OUTPUT FOR
# APPSERVER
output_message = Panel(ghpython_script_2.a)
output_message_2 = Panel(ghpython_script.a)
get_string = GetString(output_message_2, AtLeast=1, AtMost=2147483647)
get_string_2 = GetString(output_message, AtLeast=1, AtMost=2147483647)

panel_23 = Panel(ghpython_script.a)
panel_24 = Panel(ghpython_script_2.a)
series = Series(Start=number_slider_2, Step=number_slider, Count=ghpython_script.a)
# FLOOR & ROOF
series_2 = Series(Start=number_slider_2, Step=number_slider, Count=ghpython_script_2.a)
construct_point_3 = ConstructPoint(XCoordinate=0, YCoordinate=series, ZCoordinate=0)
construct_point_4 = ConstructPoint(XCoordinate=series_2, YCoordinate=0, ZCoordinate=0)
list_length = ListLength(List=construct_point_3)  # -> expr("-1", Length)
list_length_2 = ListLength(List=construct_point_4)  # -> expr("-1", Length)
list_item = ListItem(List=construct_point_3, Index=list_length, Wrap=True)
construct_point_5 = ConstructPoint(XCoordinate=series_2, YCoordinate=list_item, ZCoordinate=0)
list_item_2 = ListItem(List=construct_point_4, Index=list_length_2, Wrap=True)
construct_point_6 = ConstructPoint(XCoordinate=list_item_2, YCoordinate=series, ZCoordinate=0)
cluster_2 = Cluster(
    L_3=construct_point_5,
    L=construct_point_5,
    L_4=construct_point_5,
    L_5=construct_point_4,
    L_2=construct_point_4,
    L_6=construct_point_4)  # -> i, i_2, i_3, i_4
y2 = Data(construct_point_6)
x1 = Data(construct_point_4)
x2 = Data(construct_point_5)
y1 = Data(construct_point_3)
_4point_surface = _4PointSurface(CornerA=cluster_2.i, CornerB=cluster_2.i_2, CornerC=cluster_2.i_4, CornerD=cluster_2.i_3)

# ---- group: floor
floor = Brep(_4point_surface)

# ----
number_slider_8 = Slider(9, range=0..20)
surface = Surface(floor)
divide = DivideDomain²(Domain=surface, UCount=number_slider_8, VCount=number_slider_8)
mesh_uv = MeshSurface(Surface=surface, UCount=number_slider_8, VCount=number_slider_8, Overhang=True, Equalize=False)  # -> simplify(Mesh)

# ---- group: Floor & Roof
Z_2 = UnitZ(Factor=expr("-x", floor_thk))
Z_3 = UnitZ(Factor=roof_thk)
move = Move(Geometry=_4point_surface, Motion=Z)  # -> Geometry, Transform
area_2 = Area(Geometry=move.Geometry)  # -> Area, Centroid
roof = Panel("1.1")
scale = Scale(Geometry=move.Geometry, Center=area_2.Centroid, Factor=roof)  # -> Geometry, Transform
extr = Extrude(Base=scale.Geometry, Direction=Z_3)

# ---- group: ceiling
roof_2 = Brep(move.Geometry)

# ----
wall_1 = WALL1(
    window_frame_thk=window_frame_thk,
    window_panel_thk=window_frame_thk_2,
    w_frame_scale=window_frame_scale,
    split_values=remap_numbers.Mapped,
    point=y1,
    wall_height=wall_height,
    wall_thickness=wall_thk)  # -> w_panel_frame, w_panel, w_panel_surface_for_simulation, window_frame_for_simulation, wall_surface_for_simulation, walls
wall2 = WALL2(
    window_frame_thk=window_frame_thk,
    window_panel_thk=window_frame_thk_2,
    w_frame_scale=window_frame_scale,
    split_values=explode_tree.Branch1,
    point=y2,
    wall_height=wall_height,
    wall_thickness=wall_thk)  # -> w_panel_frame, w_panel, w_panel_surface_for_simulation, window_frame_for_simulation, wall_surface_for_simulation, walls
wall3 = WALL3(
    factor=window_frame_thk,
    factor_2=window_frame_thk_2,
    w_frame_scale=window_frame_scale,
    split_values=remap_numbers_2.Mapped,
    point=x1,
    wall_height=wall_height,
    wall_thickness_yaxis=wall_thk)  # -> w_panel_frame, w_panel, w_panel_surface_for_simulation, window_frame_for_simulation, wall_surface_for_simulation, walls
wall4 = WALL4(
    window_frame_thk=window_frame_thk,
    window_panel_thk=window_frame_thk_2,
    w_frame_scale=window_frame_scale,
    split_values=explode_tree.Branch3,
    point=x2,
    wall_height=wall_height,
    wall_thickness=wall_thk)  # -> w_panel_frame, w_panel, w_panel_surface_for_simulation, window_frame_for_simulation, wall_surface_for_simulation, walls
extr_2 = Extrude(Base=_4point_surface, Direction=Z_2)

# ----
# sDA - no blinds
mesh_color_file_from_hops = Data()
split = TextSplit(Text=mesh_color_file_from_hops, Separators=",")
# LADYBUG
larger = LargerThan(FirstNumber=split, SecondNumber="50")  # -> LargerThan, OrEqualTo
cullf = CullFaces(Mesh=mesh_uv, Pattern=larger.OrEqualTo)
mcol = MeshColours(Mesh=cullf, Colours=ColourSwatch(SwatchColor=RGB(255, 219, 77)))
mjoin = MeshJoin(Meshes=mcol)
mesh_16 = Mesh(mjoin)

win_frame1 = Geometry(wall_1.w_panel_frame)
window1 = Geometry(wall_1.w_panel)
win_frame2 = Geometry(wall2.w_panel_frame)
win_frame3 = Geometry(wall3.w_panel_frame)
win_frame4 = Geometry(wall4.w_panel_frame)
wall1 = Geometry(wall_1.walls)
window2 = Geometry(wall2.w_panel)
window3 = Geometry(wall3.w_panel)
window4 = Geometry(wall4.w_panel)
wall2_2 = Geometry(wall2.walls)
wall3_2 = Geometry(wall3.walls)
wall4_2 = Geometry(wall4.walls)
roof_3 = Geometry(extr)
floor_2 = Geometry(extr_2)
merge_4 = Merge(
    Data1=win_frame1,
    Data2=window1,
    Data3=wall1,
    Data4=win_frame2,
    Data5=window2,
    Data6=wall2_2,
    Data7=win_frame3,
    Data8=window3,
    Data9=wall3_2,
    Data10=win_frame4,
    Data11=window4,
    Data12=wall4_2,
    Data13=roof_3,
    Data14=floor_2)
lng = ListLength(List=wall4_2)
lng_2 = ListLength(List=window1)
lng_3 = ListLength(List=wall1)
lng_4 = ListLength(List=window2)
lng_5 = ListLength(List=wall2_2)
lng_6 = ListLength(List=win_frame3)
lng_7 = ListLength(List=wall3_2)
lng_8 = ListLength(List=window4)
merge_5 = Merge(Data1=roof_3, Data2=floor_2)
merge_6 = Merge(Data1=win_frame1, Data2=win_frame2, Data3=win_frame3, Data4=win_frame4)
merge_7 = Merge(Data1=window1, Data2=window2, Data3=window3, Data4=window4)
merge_8 = Merge(Data1=wall1, Data2=wall2_2, Data3=wall3.walls, Data4=wall4.walls)
merge_9 = Merge(Data1=merge_8, Data2=merge_6)
group = Group(Objects=merge_7)
group_2 = Group(Objects=merge_5)
group_3 = Group(Objects=merge_9)
move_2 = Move(Geometry=[group_2, group_3, group], Motion=construct_point)  # -> Geometry, Transform

dimensions = Dimensions(Surface=_4point_surface)  # -> UDimension, VDimension
division_4 = Division(A=dimensions.UDimension, B="100")
division_5 = Division(A=dimensions.VDimension, B="100")
length_x_m = Panel(division_4)
length_y_m = Panel(division_5)

# ---- group: Number of Panels
addition = Addition(A=lng_2, B=lng_4, C=lng_6, D=lng_8)
total_windows_number = Panel(addition)

addition_2 = Addition(A=lng_3, B=lng_5, C=lng_7, D=lng)
total_wall_panels_number = Panel(addition_2)

# ---- group: Area Calculation
area_3 = Area(Geometry=move.Geometry)  # -> Area, Centroid
division_6 = Division(A=area_3.Area, B="10000")
area_m2_2 = Panel(division_6)

# ----
bounding_box = BoundingBox(Content=move_2.Geometry, Plane=PlaneXY(0, 0, 0), UnionBox=True)  # -> flatten(Box), Box_2
# *NOTA: Construction time SIP house:
# 8 days.
# Let's say, general house size 65m2.
# 65m2 / 8days = 8.125 m2 / 1 day
integer = Integer([division_6, division_5])
cull_index = CullIndex(List=bounding_box.Box, Indices=0, Wrap=True)
area_4 = Area(Geometry=cull_index)  # -> Area, Centroid
expression = Expression(x=addition, Expression="x * 1000")

multiplication_2 = Multiplication(A=total_wall_panels_number, B=area_m2)
expression_2 = Expression(x=multiplication_2, Expression="x * 10.764 * 20")
integer_2 = Integer(expression_2)
mass_addition = MassAddition(Input=[integer_2, expression])  # -> Result, PartialResults
total_construction_cost = Panel(mass_addition.Result)

pdecon = Deconstruct(Point=area_4.Centroid)  # -> XComponent, YComponent, ZComponent
pt_3 = ConstructPoint(XCoordinate=pdecon.XComponent, YCoordinate=pdecon.YComponent, ZCoordinate=0)
# Important toggle
# NOTE
rotate = Rotate(Geometry=move_2.Geometry, Angle=degrees(rotation), Plane=area_4.Centroid)  # -> simplify(graft(Geometry)), Transform
final_geometry = Geometry(rotate.Geometry)

# ----
# sDA
sda_per_space = Panel(mesh_16)

panel_25 = Panel(final_geometry)
explode_tree_2 = ExplodeTree(Data=simplify(final_geometry))  # -> Branch0, _0000, _0001

# ---- group: wall
ungroup = Ungroup(Group=explode_tree_2._0000)

# ---- group: Roof
ungroup_2 = Ungroup(Group=explode_tree_2.Branch0)

# ---- group: Window
ungroup_3 = Ungroup(Group=explode_tree_2._0001)

# ----
move_3 = Move(Geometry=area_4.Centroid, Motion=construct_point_2)  # -> Geometry, Transform
brep_9 = Brep(floor_2)
brep_10 = Brep(merge_8)
# TITLE
# ERROR
# QUESTION
# OUTPUT
# INPUT
mesh_17 = Mesh(Mesh=brep_9, Name="Deck wood floors", Material=standardmat_6, DecimalAccuracy=3)
mesh_18 = Mesh(Mesh=brep_10, Name="SIP Wall", Material=standardmat_7, DecimalAccuracy=3)
merge_10 = Merge(Data1=mesh_17, Data2=mesh_18, Data3=mesh_11, Data4=mesh_12, Data5=mesh_13, Data6=mesh_14, Data8=mesh_15)  # disabled
merge_11 = Merge(Data1=mesh_18, Data2=merge_3, Data3=mesh_10, Data4=mesh_17)

# ---- group: Create and Export Scene
button_2 = Button()
scene = CompileScene(Objects=merge_11)
serialize = SerializeObject(Object3d=scene, Minify=False, Run=button_2)
concat_10 = Concatenate(FragmentA=nickname, FragmentB="/Lserver/www/assets")
writetxt = WriteTextFile(Path=concat_10, FileName="project.json", Data=serialize, Write=button_2)

# ----
# GENERATIVE OUTPUT
panel_26 = Panel(concat_10)

# ----
# INTERGRATED DAYLIGHT & ENERGY SIMULATION
# Colored Mesh-sDA(no blinds)
# Colored Mesh-DA
# 1. Weather file
# NOTA: TO ACTIVATE SIMULATION, ENABLE THIS!
honeybee = Honeybee_Honeybee()  # -> Vviiiiiiiiiizzz; plug-in component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
ladybug = Ladybug_Ladybug()  # -> Vviiiiiiiiiizzz; plug-in component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
all_walls_srf = Merge(
    Data1=wall_1.wall_surface_for_simulation,
    Data2=wall2.wall_surface_for_simulation,
    Data3=wall3.wall_surface_for_simulation,
    Data4=wall4.wall_surface_for_simulation)
window_frame = Merge(
    Data1=wall_1.window_frame_for_simulation,
    Data2=wall2.window_frame_for_simulation,
    Data3=wall3.window_frame_for_simulation,
    Data4=wall4.window_frame_for_simulation)
all_windows = Merge(
    Data1=wall_1.w_panel_surface_for_simulation,
    Data2=wall2.w_panel_surface_for_simulation,
    Data3=wall3.w_panel_surface_for_simulation,
    Data4=wall4.w_panel_surface_for_simulation)
wall_surface_with_opening = Brep(window_frame)
walls_no_window = Brep(all_walls_srf)
createhbsrfs = Honeybee_createHBSrfs(geometry=flatten(floor), srfType="2")  # -> readMe, simplify(HBSurface); plug-in component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
bldgprograms = Honeybee_bldgPrograms({"Office": 0, "Retail": 1, "MidriseApartment": 2, "PrimarySchool": 3, "SecondarySchool": 4, "SmallHotel": 5, "LargeHotel": 6, "Hospital": 7, "Outpatient": 8, "Warehouse": 9, "SuperMarket": 10, "FullServiceRestaurant": 11, "QuickServiceRestaurant": 12}, selected="MidriseApartment")
createhbsrfs_2 = Honeybee_createHBSrfs(geometry=wall_surface_with_opening, srfType="0")  # -> readMe, simplify(HBSurface); plug-in component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
createhbsrfs_3 = Honeybee_createHBSrfs(geometry=walls_no_window, srfType="0")  # -> readMe, simplify(HBSurface); plug-in component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
createhbsrfs_4 = Honeybee_createHBSrfs(geometry=roof_2, srfType="1")  # -> readMe, simplify(HBSurface); plug-in component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
glass = Brep(all_windows)
addhbglz = Honeybee_addHBGlz(HBObj=flatten(createhbsrfs_2.HBSurface), childSurfaces=flatten(glass))  # -> simplify(HBObjWGLZ); plug-in component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
listzoneprograms = Honeybee_ListZonePrograms(bldgProgram=bldgprograms)  # -> MidriseApartmentZonePrograms; plug-in component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
merge_12 = Merge(Data1=createhbsrfs_3.HBSurface, Data2=createhbsrfs_4.HBSurface, Data3=createhbsrfs.HBSurface, Data4=addhbglz)
item = ListItem(List=listzoneprograms, Index=0, Wrap=True)
panel_27 = Panel(item)
value_list = ValueList({"PARIS": 0, "SAN PAULO": 1, "Concepcion, Chile": 2}, selected="PARIS")
isotrim = Isotrim(Surface=surface, Domain=divide)
Z_4 = UnitZ(Factor=Slider(30, range=0..100))
list = ValueList({"VeryLow": "1,512,256,128,0.15,0.004", "Low": "2,512,256,128,0.15,0.004", "Medium": "4,1024,256,256,0.1,0.004", "High": "7,4096,512,1024,0.1,0.001"}, selected="VeryLow")
move_4 = Move(Geometry=isotrim, Motion=Z_4)  # -> Geometry, Transform
text_split = TextSplit(Text=list, Separators=",")
area_5 = Area(Geometry=move_4.Geometry)  # -> Area, simplify(Centroid)
list_item_3 = ListItem(List=text_split, Index=0, Wrap=True)  # -> Item, Item1, Item2, Item3, Item4
Z_5 = UnitZ(Factor=area_5.Centroid)
point_list = PointList(Points=area_5.Centroid, Size=50)
radparameters = Honeybee_RADParameters(quality=0, ab=list_item_3.Item, ad=list_item_3.Item1, as=list_item_3.Item2, ar=list_item_3.Item3, aa=list_item_3.Item4)  # -> readMe, radParameters; plug-in component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
amp = Amplitude(Vector=Z_5, Amplitude=1)  # -> simplify(Vector)
roundd = RoundToDecimalPlace(NumberX=split, DecimalPlace=Slider(2, range=0..10), RoundType=0)  # -> Rounded, Difference
toggle = BooleanToggle(True)
workingdir = Panel("C:\Users\kimky\Desktop\tmp\S4-STUDIO\Daylight_Autonomy")

# ---- group: collect all honeybee surfaces
brep_11 = Brep(flatten(merge_12))

# ----
epw_paris = Panel("https://www.energyplus.net/weather-download/europe_wmo_region_6/FRA//FRA_Paris.Orly.071490_IWEC/all")
epw_san_paulo = Panel("http://climate.onebuilding.org/WMO_Region_3_South_America/BRA_Brazil/SP_Sao_Paulo/BRA_SP_Sao.Paulo.869100_TMYx.zip")
epw_concepcion_chile = Panel("http://climate.onebuilding.org/WMO_Region_3_South_America/CHL_Chile/BI_Bio-Bio/CHL_BI_Concepcion.856830_TMYx.zip")
number_slider_9 = Slider(24, range=0..100)
epwmap = LBEPWmap(epw_map=Toggle(False))  # -> Output; plug-in component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
northarrow = Ladybug_North(north=number_slider_9, scale=".05")  # -> northSign; plug-in component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

createhbzones = Honeybee_createHBZones(name="HOUSE ENERGY SIMULATION", zoneProgram=item, HBSurfaces=flatten(brep_11), isConditioned=True)  # -> readMe, HBZone; plug-in component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
stream_filter = StreamFilter(Gate=value_list, Stream0=epw_paris, Stream1=epw_san_paulo, Stream2=epw_concepcion_chile)
wires = BrepWireframe(Brep=createhbzones.HBZone, Density=-1)

epw_stat = Ladybug_OpenEPWAndSTATWeatherFiles(weatherFileURL=stream_filter)  # -> epwFile, statFile; disabled; plug-in component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

annualdaylightsimulation = Honeybee_AnnualDaylightSimulation(
    north=number_slider_9,
    epwWeatherFile=epw_stat.epwFile,
    testPoints=area_5.Centroid,
    ptsVectors=amp,
    testMesh=mesh_uv,
    radParameters=radparameters.radParameters)  # -> analysisRecipe; plug-in component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
rundaylightanalysis = Honeybee_RunDaylightSimulation(
    HBObjects=flatten(brep_11),
    analysisRecipe=annualdaylightsimulation,
    writeRad=toggle,
    runRad=toggle,
    numOfCPUs=Slider(4, range=0..10),
    workingDir=workingdir,
    overwriteResults=True)  # -> readMe, analysisType, resultsUnit, results, testPts, resultFiles, radGeoFile, studyFolder, done; plug-in component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

gradientlibrary = Ladybug_GradientLibrary(gradIndex=Slider(0, range=0..100))  # -> customColors; plug-in component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
legend = Legend(Colour=gradientlibrary, Tags=["One Fish", "Two Fish", "Red Fish", "Blue Fish"], LegendType=1)
legendpar = Ladybug_LegendParameters(lowBound="0", highBound="100", numSegments=Slider(6, range=0..10), customColors=flatten(gradientlibrary))  # -> legendPar; plug-in component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
recolormesh = Ladybug_RecolorMesh(
    analysisResult=roundd.Rounded,
    inputMesh=mesh_uv,
    legendPar=legendpar,
    analysisTitle=rundaylightanalysis.analysisType,
    legendTitle=rundaylightanalysis.resultsUnit)  # -> out, newMesh, newLegend, legendBasePt, meshColors, legendColors; plug-in component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

mesh_19 = Mesh(recolormesh.newMesh)
X = UnitX(Factor=Slider(13, range=0..15))
move_5 = Move(Motion=X)  # -> Geometry, Transform
move_6 = Move(Geometry=mesh_19, Motion=X)  # -> Geometry, Transform
move_7 = Move(Motion=X)  # -> Geometry, Transform
points_2 = PointList(Points=move_7.Geometry)

# ----
# DA
mesh_20 = Mesh([recolormesh.newMesh, recolormesh.newLegend])

# ---- group: Mesh moving
move_8 = Move(Geometry=mesh_20, Motion=construct_point)  # -> Geometry, Transform
rotate_2 = Rotate(Geometry=move_8.Geometry, Angle=degrees(rotation), Plane=pt_3)  # -> Geometry, Transform

# ---- group: Geometry output
brep_12 = Brep(simplify([ungroup_3, ungroup, ungroup_2]))
brep_wireframe = BrepWireframe(Brep=brep_12, Density=-1)
create_material = CreateMaterial(
    Diffuse=ColourSwatch(SwatchColor=RGB(86, 127, 112)),
    Specular=RGB(255, 255, 255),
    Emission=RGB(0, 0, 0),
    Transparency=Slider(0.51, range=0..1),
    Shine=0)
create_material_2 = CreateMaterial(
    Diffuse=ColourSwatch(SwatchColor=RGB(252, 218, 1)),
    Specular=RGB(255, 255, 255),
    Emission=RGB(0, 0, 0),
    Transparency=Slider(1, range=0..1),
    Shine=0)
day_light_mesh = Mesh(rotate_2.Geometry)
custom_preview = CustomPreview(Geometry=ungroup_3, Material=create_material)
custom_preview_2 = CustomPreview(Geometry=ungroup, Material=ColourSwatch(SwatchColor=RGB(201, 194, 153)))
custom_preview_lineweights_2 = CustomPreviewLineweights(Geometry=brep_wireframe, Shader=ColourSwatch(SwatchColor=RGB(0, 0, 0)), Thickness=2, Absolute=False)

# ----
custom_preview_3 = CustomPreview(Geometry=ungroup_2, Material=create_material_2)

expression_3 = Expression(x=division_6, Expression="x / 8.125")

# ---- group: Integer
ghpython_script_3 = GhPythonScript(R=expression_3)  # -> out; disabled
# ---------- ghpython_script_3: Python ----------
import Rhino.Geometry as rg

if R < 1:
    print(int(1))
else: 
    print(R)
# ---------- end ghpython_script_3 ----------
integer_3 = Integer(expression_3)

# ----
construction_time_days = Panel(integer_3)

minimize_electricity_consumption = Number()
wlc_minimize_construction_cost = Number(mass_addition.Result)
construction_time_2 = Number(integer_3)
len_y = Data(length_y_m)
sda_2 = Number(mesh_16)
len_x = Data(division_4)
area_6 = Number(division_6)

integer_4 = Integer(rotation)
rotation_2 = Data(integer_4)
integer_5 = Integer(area_6)
integer_6 = Integer(sda_2)
integer_7 = Integer(minimize_electricity_consumption)
panel_28 = Panel(integer_5)
panel_29 = Panel(construction_time_2)
panel_30 = Panel(wlc_minimize_construction_cost)
panel_31 = Panel(integer_7)
panel_32 = Panel(integer_6)
panel_33 = Panel(rotation_2)
panel_34 = Panel(len_x)
panel_35 = Panel(len_y)
panel_36 = Panel("DATA ")
number_slider_10 = Slider(30, range=0..100)

labels = Panel("""City
Area
ConstTime
ConstCost
Rotation
LenX
LenY
Electricity
sDA""")
ghpython_script_4 = GhPythonScript(x=value_list)  # -> out
# ---------- ghpython_script_4: Python ----------
import Rhino.Geometry as rg

if x == 0:
    print("Ils-de-France")
elif x == 1:
    print("San_Paulo")
else:
    print("Concepcion")
# ---------- end ghpython_script_4 ----------
merge_13 = Merge(
    Data1=flatten(panel_28),
    Data2=flatten(construction_time_2),
    Data3=flatten(wlc_minimize_construction_cost),
    Data4=flatten(panel_33),
    Data5=flatten(panel_34),
    Data6=flatten(panel_35),
    Data7=flatten(panel_31),
    Data8=flatten(panel_32))
list_length_3 = ListLength(List=merge_13)
panel_37 = Panel(ghpython_script_4)
workingdir_2 = Panel("C:\Users\kimky\Desktop\tmp\DATASET V2_studio.csv")
join = TextJoin(Text=labels, Join=",")
insert_items = InsertItems(List=merge_13, Item=panel_37, Indices=expr("x+1", list_length_3), Wrap=True)
join_2 = TextJoin(Text=insert_items, Join=",")
panel_38 = Panel(insert_items)
num = Number()
export_robotmotion_3_r3_multi = PythonScript(toggle=Toggle(True), path=workingdir_2, x=join_2, labs=join, y=num)
# ---------- export_robotmotion_3_r3_multi: Python ----------
#script by Gabriella Rossi / CITA
import os
from os import listdir
from os.path import isfile, join
from scriptcontext import sticky as st

if True:
    #Create file
    filename = str(path)
    fil = open(filename, 'a+')
    
    if y < 1 :

        #write header and first line
        fil.write(labs)
        fil.write('\n' + x)
    else:
        #just write line
        fil.write('\n' + x)

    fil.close()
# ---------- end export_robotmotion_3_r3_multi ----------

# ----
# OUTPUT INFO
concatenate = Concatenate(FragmentA=labels, FragmentB=panel_38)
panel_39 = Panel(concatenate)

merge_14 = Merge(Data1=labels, Data2=panel_38)
panel_40 = Panel(merge_14)

panel_41 = Panel("How are you? ")
slider = Slider(11, range=0..11)
get_string_3 = GetString(AtLeast=1, AtMost=2147483647)
pt_4 = Point(Point(-4371.132221, 32662.61474, 0))
bool = Boolean(True)
c_script = CSharpScript(face="Verdana", bold=bool, size=Slider(1000, range=0..1000), content=merge_14, pl=pt_4)  # -> out, A; inputs face: String, bold: Boolean, italics: Boolean, size: Double, content: String, pl: Plane
# ---------- c_script: C# usings ----------
using System.IO;
using System.Linq;
using System.Data;
using System.Drawing;
using System.Reflection;
using System.Windows.Forms;
using System.Xml;
using System.Xml.Linq;
using System.Runtime.InteropServices;

using Rhino.DocObjects;
using Rhino.Collections;
using GH_IO;
using GH_IO.Serialization;
# ---------- c_script: C# ----------
    if(size == 0)
      size = 1;

    if(!string.IsNullOrEmpty(face) && size > 0 && !string.IsNullOrEmpty(content) &&
      pl.IsValid)
    {
      using (var doc = Rhino.RhinoDoc.CreateHeadless(null))
      {
        var te = doc.Objects.AddText(content, pl, size, face, bold, italics);
        var txt = doc.Objects.Find(te) as Rhino.DocObjects.TextObject;

        if(txt != null)
        {
          var tt = txt.Geometry as Rhino.Geometry.TextEntity;
          A = tt.Explode();
        }
      }
    }
# ---------- end c_script ----------

# ---- group: RH_OUT:text_lines
crv_4 = Curve(c_script.A)

# ---- group: TEXT _ Average in Curve
unit_y = UnitY(Factor=Slider(11, range=0..100))
move_9 = Move(Geometry=crv_4, Motion=unit_y)  # -> Geometry, Transform

# ----
custom_preview_lineweights_3 = CustomPreviewLineweights(Geometry=move_9.Geometry, Shader=ColourSwatch(SwatchColor=RGB(0, 0, 0)), Absolute=False)

# ==== cluster WALL1
window_frame_thk = ClusterInput()
window_panel_thk = ClusterInput()

# ---- group: Cluster Input
wall_thickness = ClusterInput()

# ----
w_frame_scale = ClusterInput()

# ---- group: Cluster Input
wall_height = ClusterInput()

# ----
split_values = ClusterInput()

# ---- group: Cluster Input
point = ClusterInput()

# ----
Z = UnitZ(WallHeight=wall_height)
move = Move(Geometry=point, Motion=Z)  # -> Geometry, Transform
shift = ShiftList(List=move.Geometry, Shift=1, Wrap=True)
box = Box2Pt(PointA=point, PointB=shift, Plane=PlaneXY(0, 0, 0))
cull_i = CullIndex(List=box, Indices=-1, Wrap=True)
X = UnitX(WallThickness=wall_thickness)

X_2 = UnitX(WindowFrameTHK=window_frame_thk)
X_3 = UnitX(WindowPanelTHK=window_panel_thk)
random_split_list = RandomSplitList(MasterList=cull_i, Seed=50, SplitValues=split_values)  # -> WindowFrameForSimulation, WallSurfaceForSimulation
panel_frame = PanelFrame(Panel=random_split_list.WindowFrameForSimulation, WFrameScale=w_frame_scale)  # -> WPanelFrame, WPanelSurfaceForSimulation
extrude = Extrude(Base=random_split_list.WallSurfaceForSimulation, Direction=X)
is_planar = IsPlanar(Surface=panel_frame.WPanelSurfaceForSimulation, Interior=True)  # -> Planar, Plane
plane_normal = PlaneNormal(Origin=Point(0, 0, 0), ZAxis=is_planar.Plane)
extrude_2 = Extrude(Base=panel_frame.WPanelFrame, Direction=X_2)
amplitude = Amplitude(Vector=plane_normal, Amplitude="4")
move_2 = Move(Geometry=panel_frame.WPanelSurfaceForSimulation, Motion=amplitude)  # -> Geometry, Transform
extrude_3 = Extrude(Base=move_2.Geometry, Direction=X_3)
w_panel_surface_for_simulation = ClusterOutput(panel_frame.WPanelSurfaceForSimulation)
window_frame_for_simulation = ClusterOutput(random_split_list.WindowFrameForSimulation)
w_panel_frame = ClusterOutput(extrude_2)
w_panel = ClusterOutput(extrude_3)
wall_surface_for_simulation = ClusterOutput(random_split_list.WallSurfaceForSimulation)

# ---- group: Cluster Output
walls = ClusterOutput(extrude)

# ==== cluster WALL3
factor = ClusterInput()
factor_2 = ClusterInput()
w_frame_scale = ClusterInput()
split_values = ClusterInput()

# ---- group: Cluster Input
wall_height = ClusterInput()

wall_thickness_yaxis = ClusterInput()

point = ClusterInput()

# ----
Z = UnitZ(WallHeight=wall_height)
move = Move(Geometry=point, Motion=Z)  # -> Geometry, Transform
shift = ShiftList(List=move.Geometry, Shift=1, Wrap=True)
box = Box2Pt(PointA=point, PointB=shift, Plane=PlaneXY(0, 0, 0))
cull_i = CullIndex(List=box, Indices=-1, Wrap=True)

unit_y = UnitY(Factor=factor)
unit_y_2 = UnitY(Factor=factor_2)
unit_y_3 = UnitY(WallThicknessYaxis=wall_thickness_yaxis)
random_split_list = RandomSplitList(MasterList=cull_i, Seed=50, SplitValues=split_values)  # -> WindowFrameForSimulation, WallSurfaceForSimulation
panel_frame = PanelFrame(Panel=random_split_list.WindowFrameForSimulation, WFrameScale=w_frame_scale)  # -> WPanelFrame, WPanelSurfaceForSimulation
extrude = Extrude(Base=random_split_list.WallSurfaceForSimulation, Direction=unit_y_3)
is_planar = IsPlanar(Surface=panel_frame.WPanelSurfaceForSimulation, Interior=True)  # -> Planar, Plane
plane_normal = PlaneNormal(Origin=Point(0, 0, 0), ZAxis=is_planar.Plane)
amplitude = Amplitude(Vector=plane_normal, Amplitude=expr("-x", "4"))
extrude_2 = Extrude(Base=panel_frame.WPanelFrame, Direction=unit_y)
move_2 = Move(Geometry=panel_frame.WPanelSurfaceForSimulation, Motion=amplitude)  # -> Geometry, Transform
extrude_3 = Extrude(Base=move_2.Geometry, Direction=unit_y_2)
w_panel_surface_for_simulation = ClusterOutput(panel_frame.WPanelSurfaceForSimulation)
window_frame_for_simulation = ClusterOutput(random_split_list.WindowFrameForSimulation)
wall_surface_for_simulation = ClusterOutput(random_split_list.WallSurfaceForSimulation)
w_panel_frame = ClusterOutput(extrude_2)
w_panel = ClusterOutput(extrude_3)

# ---- group: Cluster Output
walls = ClusterOutput(extrude)

# ==== cluster WALL2
window_frame_thk = ClusterInput()
window_panel_thk = ClusterInput()
wall_thickness = ClusterInput()
w_frame_scale = ClusterInput()
wall_height = ClusterInput()
split_values = ClusterInput()
point = ClusterInput()
Z = UnitZ(WallHeight=wall_height)
move = Move(Geometry=point, Motion=Z)  # -> Geometry, Transform
shift = ShiftList(List=move.Geometry, Shift=1, Wrap=True)
box = Box2Pt(PointA=point, PointB=shift, Plane=PlaneXY(0, 0, 0))
cull_i = CullIndex(List=box, Indices=-1, Wrap=True)
X = UnitX(WindowFrameTHK=expr("-x", window_frame_thk))
X_2 = UnitX(WallThickness=expr("-x", wall_thickness))
X_3 = UnitX(WindowPanelTHK=expr("-x", window_panel_thk))
is_planar = IsPlanar(Surface=cull_i, Interior=True)  # -> Planar, Plane
plane_normal = PlaneNormal(Origin=Point(0, 0, 0), ZAxis=is_planar.Plane)
amplitude = Amplitude(Vector=plane_normal, Amplitude="15")
random_split_list = RandomSplitList(MasterList=cull_i, Seed=50, SplitValues=split_values)  # -> WindowFrameForSimulation, WallSurfaceForSimulation
move_2 = Move(Geometry=cull_i, Motion=amplitude)  # -> Geometry, Transform
panel_frame = PanelFrame(Panel=random_split_list.WindowFrameForSimulation, WFrameScale=w_frame_scale)  # -> WPanelFrame, WPanelSurfaceForSimulation
extrude = Extrude(Base=random_split_list.WallSurfaceForSimulation, Direction=X_2)
is_planar_2 = IsPlanar(Surface=panel_frame.WPanelSurfaceForSimulation, Interior=True)  # -> Planar, Plane
plane_normal_2 = PlaneNormal(Origin=Point(0, 0, 0), ZAxis=is_planar_2.Plane)
amplitude_2 = Amplitude(Vector=expr("-x", plane_normal_2), Amplitude="4")
extrude_2 = Extrude(Base=panel_frame.WPanelFrame, Direction=X)
move_3 = Move(Geometry=panel_frame.WPanelSurfaceForSimulation, Motion=amplitude_2)  # -> Geometry, Transform
extrude_3 = Extrude(Base=move_3.Geometry, Direction=X_3)
w_panel_frame = ClusterOutput(extrude_2)
w_panel_surface_for_simulation = ClusterOutput(panel_frame.WPanelSurfaceForSimulation)
w_panel = ClusterOutput(extrude_3)
window_frame_for_simulation = ClusterOutput(random_split_list.WindowFrameForSimulation)
wall_surface_for_simulation = ClusterOutput(random_split_list.WallSurfaceForSimulation)
walls = ClusterOutput(extrude)

# ==== cluster WALL4
window_frame_thk = ClusterInput()
window_panel_thk = ClusterInput()

# ---- group: Cluster Input
wall_thickness = ClusterInput()

# ----
w_frame_scale = ClusterInput()

# ---- group: Cluster Input
wall_height = ClusterInput()

# ----
split_values = ClusterInput()

# ---- group: Cluster Input
point = ClusterInput()

# ----
Z = UnitZ(WallHeight=wall_height)
move = Move(Geometry=point, Motion=Z)  # -> Geometry, Transform
shift = ShiftList(List=move.Geometry, Shift=1, Wrap=True)
box = Box2Pt(PointA=point, PointB=shift, Plane=PlaneXY(0, 0, 0))
unit_y = UnitY(WallThickness=expr("-x", wall_thickness))
unit_y_2 = UnitY(WindowFrameTHK=expr("-x", window_frame_thk))
unit_y_3 = UnitY(WindowPanelTHK=expr("-x", window_panel_thk))
cull_i = CullIndex(List=box, Indices=-1, Wrap=True)
is_planar = IsPlanar(Surface=cull_i, Interior=True)  # -> Planar, Plane
plane_normal = PlaneNormal(Origin=Point(0, 0, 0), ZAxis=is_planar.Plane)
amplitude = Amplitude(Vector=plane_normal, Amplitude="15")
random_split_list = RandomSplitList(MasterList=cull_i, Seed=50, SplitValues=split_values)  # -> WindowFrameForSimulation, WallSurfaceForSimulation
move_2 = Move(Geometry=cull_i, Motion=amplitude)  # -> Geometry, Transform
panel_frame = PanelFrame(Panel=random_split_list.WindowFrameForSimulation, WFrameScale=w_frame_scale)  # -> WPanelFrame, WPanelSurfaceForSimulation
extrude = Extrude(Base=random_split_list.WallSurfaceForSimulation, Direction=unit_y)
is_planar_2 = IsPlanar(Surface=panel_frame.WPanelSurfaceForSimulation, Interior=True)  # -> Planar, Plane
plane_normal_2 = PlaneNormal(Origin=Point(0, 0, 0), ZAxis=is_planar_2.Plane)
amplitude_2 = Amplitude(Vector=plane_normal_2, Amplitude="4")
extrude_2 = Extrude(Base=panel_frame.WPanelFrame, Direction=unit_y_2)
move_3 = Move(Geometry=panel_frame.WPanelSurfaceForSimulation, Motion=amplitude_2)  # -> Geometry, Transform
extrude_3 = Extrude(Base=move_3.Geometry, Direction=unit_y_3)
w_panel_surface_for_simulation = ClusterOutput(panel_frame.WPanelSurfaceForSimulation)
window_frame_for_simulation = ClusterOutput(random_split_list.WindowFrameForSimulation)
wall_surface_for_simulation = ClusterOutput(random_split_list.WallSurfaceForSimulation)
w_panel_frame = ClusterOutput(extrude_2)
w_panel = ClusterOutput(extrude_3)

# ---- group: Cluster Output
walls = ClusterOutput(extrude)

# ==== cluster Cluster
L = ClusterInput()
L_2 = ClusterInput()
lng = ListLength(List=L)  # -> expr("-1", Length)
lng_2 = ListLength(List=L_2)  # -> expr("-1", Length)
L_3 = ClusterInput()
L_4 = ClusterInput()
L_5 = ClusterInput()
L_6 = ClusterInput()
item = ListItem(List=L_3, Index=lng, Wrap=True)
item_2 = ListItem(List=L_4, Index=0, Wrap=True)
item_3 = ListItem(List=L_5, Index=lng_2, Wrap=True)
item_4 = ListItem(List=L_6, Index=0, Wrap=True)
i = ClusterOutput(item)
i_2 = ClusterOutput(item_2)
i_3 = ClusterOutput(item_3)
i_4 = ClusterOutput(item_4)

# ==== cluster Cluster_2
point = ClusterInput()
point_2 = Point(point)
data = ClusterInput()
integer = ClusterInput()
data_2 = Data(data)
integer_2 = Integer(integer)
data_3 = ClusterOutput(data_2)
outline_color = ColourSwatch(SwatchColor=RGB(0, 0, 0))
label_color = ColourSwatch(SwatchColor=RGB(0, 0, 0))
list_length = ListLength(List=data_2)
integer_3 = ClusterOutput(integer_2)
ma = MassAddition(Input=integer_2)  # -> Result, PartialResults
label_color_2 = ClusterOutput(label_color)
ma_2 = MassAddition(Input=list_length)  # -> Result, PartialResults
division = Division(A=integer_2, B=ma.Result)
A = ClusterInput()
division_2 = Division(A=list_length, B=ma_2.Result)
multiplication = Multiplication(A=A, B=2)
ma_3 = MassAddition(Input=division)  # -> Result, PartialResults
ma_4 = MassAddition(Input=division_2)  # -> Result, PartialResults
R = ClusterInput()
R_2 = ClusterInput()
cir = Circle(Plane=point_2, Radius=R)
cir_2 = Circle(Plane=point_2, Radius=R_2)
shatter = Shatter(Curve=reparameterize(cir_2), Parameters=ma_3.PartialResults)
shatter_2 = Shatter(Curve=reparameterize(cir), Parameters=ma_3.PartialResults)
num = Number(0.5)
num_2 = Number(0.5)
eval = EvaluateCurve(Curve=reparameterize(cir), Parameter=ma_3.PartialResults)  # -> Point, Tangent, Angle
planar = PlanarSrf(Edges=cir)
area = Area(Geometry=cir)  # -> Area, Centroid
eval_2 = EvaluateCurve(Curve=reparameterize(shatter), Parameter=num)  # -> Point, Tangent, Angle
area_2 = Area(Geometry=cir_2)  # -> Area, Centroid
eval_3 = EvaluateCurve(Curve=reparameterize(shatter_2), Parameter=num_2)  # -> Point, Tangent, Angle
vec2pt = Vector2Pt(PointA=area_2.Centroid, PointB=eval_2.Point, Unitize=False)  # -> Vector, Length
ln = Line(StartPoint=area.Centroid, EndPoint=eval.Point)
vec2pt_2 = Vector2Pt(PointA=area.Centroid, PointB=eval_3.Point, Unitize=False)  # -> Vector, Length
amp = Amplitude(Vector=vec2pt.Vector, Amplitude=multiplication)
A_2 = ClusterInput()
R_3 = ClusterInput()
amp_2 = Amplitude(Vector=vec2pt_2.Vector, Amplitude=A_2)
cir_3 = Circle(Plane=point_2, Radius=R_3)
srfsplit = SurfaceSplit(Surface=planar, Curves=ln)
move = Move(Geometry=eval_2.Point, Motion=amp)  # -> Geometry, Transform
move_2 = Move(Geometry=eval_3.Point, Motion=amp_2)  # -> Geometry, Transform
vdis = VectorDisplay(Anchor=eval_3.Point, Vector=move_2.Geometry)
G = ClusterOutput(move.Geometry)
srfsplit_2 = SurfaceSplit(Surface=srfsplit, Curves=cir_3)
G_2 = ClusterOutput(move_2.Geometry)
list_item = ListItem(List=srfsplit_2, Index=1, Wrap=True)  # -> flatten(Item)
area_3 = Area(Geometry=list_item)  # -> Area, Centroid
sort = SortList(Keys=area_3.Area, ValuesA=list_item)  # -> Keys, ValuesA
edges = BrepEdges(Brep=list_item)  # -> Naked, Interior, NonManifold
K = ClusterOutput(sort.Keys)
A_3 = ClusterOutput(sort.ValuesA)
list_item_2 = ListItem(List=sort.Keys, Index=0, Wrap=True)
list_item_3 = ListItem(List=reverse(sort.Keys), Index=0, Wrap=True)
preview = CustomPreview(Geometry=edges.Naked, Shader=outline_color)
i = ClusterOutput(list_item_2)
i_2 = ClusterOutput(list_item_3)
