# Grasshopper definition STUDIO V9_2021.06.17_ML-GEOMETRY.gh (Grasshopper 1.0.7)
# Copyright: BiB in Paris, 2021
# plug-ins: Bifocals, Human, Pufferfish, Hops

boolean_toggle = BooleanToggle(True)
# NOTE
note = Panel("")
# KPF GH Standards
# Inputs
input_data = Panel("")
# USER INPUT
input_data_2 = Panel("")
# CURVE INPUT FROM USER
# INPUT FOR
# APPSERVER
get_geometry = GetGeometry(AtLeast=1, AtMost=2147483647, Filter=1074004029)
get_point = GetPoint(AtLeast=1, AtMost=2147483647, Realtime=True)
point = Point(Point(14.88130308, -17.26022244, 0))
# OUTPUT
# NUMERIC DATA
action_panel = Panel("")
button = Button()
curve = Curve(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)

# ---- group: Point house
point_2 = Point(Point(-2433.26565, 1922.78462, 0))

# ----
northarrow = Ladybug_North(north=Slider(24, range=0..100), centerPt=point, scale=".05")  # -> northSign; plug-in component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
cost = Slider(55949, range=12000..107800)
rotation_degree = Slider(70, range=0..359)

# ---- group: NORTH ANGLE MEASURE
data = Data(northarrow)
north = Geometry(data)
list_item = ListItem(List=north, Index=0, Wrap=True)  # -> Item, Item1, Item2
curve_2 = Curve(list_item.Item1)
end_points = EndPoints(Curve=curve_2)  # -> Start, End
vector_2pt = Vector2Pt(PointA=end_points.Start, PointB=end_points.End, Unitize=False)  # -> Vector, Length
line_sdl = LineSDL(Start=end_points.End, Direction=vector_2pt.Vector, Length=2)
rotate = Rotate(Geometry=line_sdl, Angle=expr("-x", degrees(rotation_degree)), Plane=point)  # -> Geometry, Transform
curve_3 = Curve(rotate.Geometry)
angle = Angle(VectorA=line_sdl, VectorB=curve_3)  # -> Angle, Reflex
custom_preview_lineweights = CustomPreviewLineweights(Geometry=curve_3, Shader=ColourSwatch(SwatchColor=RGB(0, 0, 0)), Thickness=Slider(5, range=0..10), Absolute=False)
degrees = Degrees(Radians=angle.Angle)
ghpython_script = GhPythonScript(x=degrees, y=rotation_degree)  # -> out, a
# ---------- ghpython_script: Python ----------
import Rhino.Geometry as rg

if y <= 180:
    a = int(x)
elif y >180:
    a = int(y)
# ---------- end ghpython_script ----------
panel = Panel(ghpython_script.a)

# ----
construction_time_day = Slider(15, range=1..30)
# OUTPUT
# GEOMETRY
geometry = Panel("")
panel_2 = Panel("SITE")
panel_3 = Panel("LOCATION")
deconstruct = Deconstruct(Point=point_2)  # -> XComponent, YComponent, ZComponent
panel_4 = Panel("http://127.0.0.1:5000/ ")
hops = Hops(
    ConstructionTime=construction_time_day,
    ConstructionCost=cost,
    RotationAngleFromNorth=rotation_degree,
    CacheResultsInMemory=True,
    CacheSolveResults=True,
    RemoteDefinitionLocation="http://127.0.0.1:5000/runML11",
    RemoteSolveVersion=(0, 1, 0),
    ShowInput_Enabled=False,
    ShowInput_Path=False,
    SynchronousSolve=True)  # -> LengthX, LengthY, WallPanelsNumber, WindowPanelsNumber, SpatialDaylightAutonomy, TotalElectricityConsumption, LightElectricityConsumption, CoolingElectricityConsumption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
dash_pattern = DashPattern(Curve=curve, Pattern=Slider(100, range=0..100))  # -> Dashes, Gaps
construct_point = ConstructPoint(XCoordinate=deconstruct.XComponent, YCoordinate=deconstruct.YComponent, ZCoordinate=0)
explode = Explode(Curve=curve, Recursive=True)  # -> Segments, Vertices
custom_preview_lineweights_2 = CustomPreviewLineweights(
    Geometry=dash_pattern.Dashes,
    Shader=ColourSwatch(SwatchColor=RGB(255, 0, 0)),
    Thickness=Slider(5, range=0..10),
    Absolute=False)
panel_5 = Panel(hops.HeatingElectricityConsumption)
panel_6 = Panel(hops.LightElectricityConsumption)
panel_7 = Panel(hops.CoolingElectricityConsumption)
boundary_surfaces = BoundarySurfaces(Edges=explode.Segments)
# OPTIMIZATION
# SOLVER
result_panel = Panel("")
sda = Data(hops.SpatialDaylightAutonomy)
electricity = Data(hops.TotalElectricityConsumption)
stack_data = StackData(Data=[panel_6, panel_7, panel_5], Stack=1)
stack_data_2 = StackData(Data=["Lighting(kW)/year : ", "Heating_electricity(kW)/year : ", "Cooling_electricity(kW)/year : "], Stack=1)
panel_8 = Panel(sda)
panel_9 = Panel(electricity)
construct_domain = ConstructDomain(DomainStart=0, DomainEnd=1)
bounds = Bounds(Numbers=hops.WindowPanelsNumber)
division = Division(A=hops.WindowPanelsNumber, B=100)
bounds_2 = Bounds(Numbers=hops.WallPanelsNumber)
y_panels = Data(hops.LengthY)
x_panels = Data(hops.LengthX)

number_slider = Slider(400, range=0..1000)
panel_10 = Panel(stack_data)
# GRAPH FOR
# APPSERVER
panel_11 = Panel(stack_data_2)
# OUTPUT FOR
# APPSERVER
point_3 = Point(Point(616.1651131, 796.9389297, 0))
cluster = Cluster(
    R_3=Slider(271, range=0..1000),
    R=number_slider,
    point=point_3,
    A=Slider(67, range=0..100),
    integer=panel_10,
    A_2=Slider(44, range=0..100),
    data=panel_11,
    R_2=number_slider)  # -> i, K, A_3, i_2, integer_3, G_2, label_color_2, data_3, G
gradient = Gradient(
    LowerLimit=cluster.i,
    UpperLimit=cluster.i_2,
    Parameter=cluster.K,
    stops=[0: RGB(74, 61, 210), 0: RGB(255, 0, 0), 0: RGB(164, 78, 194), 0: RGB(22, 129, 145), 0: RGB(200, 1, 135), 0: RGB(234, 19, 70), 0: RGB(0, 43, 240), 0: RGB(255, 255, 0), 0: RGB(0, 128, 0), 0.0116: RGB(58, 142, 227), 1: RGB(255, 0, 255)])
preview = CustomPreview(Geometry=cluster.A_3, Shader=gradient)
tag = TextTag(Location=cluster.G_2, Text=cluster.integer_3, Colour=cluster.label_color_2)
tag_2 = TextTag(Location=cluster.G, Text=cluster.data_3, Colour=cluster.label_color_2)

remap_numbers = RemapNumbers(Value=hops.WindowPanelsNumber, Source=bounds, Target=construct_domain)  # -> Mapped, Clipped
panel_12 = Panel(division)
remap_numbers_2 = RemapNumbers(Value=hops.WallPanelsNumber, Source=bounds_2, Target=Domain(0, 1))  # -> Mapped, Clipped
panel_13 = Panel(bounds_2)

x = Integer(hops.LengthX)
y = Integer(hops.LengthY)

# ----
# OUTPUT INFO
concatenate = Concatenate()
subtraction = Subtraction(A="1.0", B=panel_12)

area = Area(Geometry=boundary_surfaces)  # -> Area, Centroid
division_2 = Division(A=area.Area, B="10000")
ma = MassAddition(Input=flatten(division_2))  # -> Result, PartialResults
site_surface_m2 = Panel(division_2)
total_site_area = Number(ma.Result)

panel_14 = Panel(concatenate)
ghpython_script_2 = GhPythonScript(x=x_panels)  # -> out, a
# ---------- ghpython_script_2: Python ----------
import Rhino.Geometry as rg

if x <= 0:
    a = "ERROR! If cost is high, give high number for cost,too"
    print(a)

else:
    a = int(x)
    print(int(a))
# ---------- end ghpython_script_2 ----------
ghpython_script_3 = GhPythonScript(x=y_panels)  # -> out, a
# ---------- ghpython_script_3: Python ----------
import Rhino.Geometry as rg

if x <= 0:
    a = "ERROR!  If cost is high, give high number for cost,too"
    print(a)

else:
    a = int(x)
    print(int(a))
# ---------- end ghpython_script_3 ----------

output_message = Panel(ghpython_script_3.a)
output_message_2 = Panel(ghpython_script_2.a)
get_string = GetString(output_message_2, AtLeast=1, AtMost=2147483647)
get_string_2 = GetString(output_message, AtLeast=1, AtMost=2147483647)

panel_15 = Panel(ghpython_script_2.a)
panel_16 = Panel(ghpython_script_3.a)
cluster_2 = Cluster_5(plane=PlaneXY(0, 0, 0), x=x, y=y, rotation_angle=rotation_degree)  # -> floor_2, roof_2, interior_wall_2, facade_2, window_2, frame_2, hb_o, hb_c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
group = Group(Objects=cluster_2.roof_2)
group_2 = Group(Objects=cluster_2.interior_wall_2)
group_3 = Group(Objects=cluster_2.facade_2)
group_4 = Group(Objects=cluster_2.window_2)
group_5 = Group(Objects=cluster_2.frame_2)

# ---- group: Geometry output
brep = Brep(simplify([cluster_2.window_2, cluster_2.floor_2, cluster_2.roof_2, cluster_2.frame_2, cluster_2.facade_2, cluster_2.interior_wall_2]))
brep_wireframe = BrepWireframe(Brep=brep, Density=-1)
# Visualization
create_material = CreateMaterial(
    Diffuse=ColourSwatch(SwatchColor=RGB(86, 127, 112)),
    Specular=RGB(255, 255, 255),
    Emission=RGB(0, 0, 0),
    Transparency=Slider(0.51, range=0..1),
    Shine=0)
create_material_2 = CreateMaterial(
    Diffuse=ColourSwatch(SwatchColor=RGB(168, 145, 118)),
    Specular=RGB(255, 255, 255),
    Emission=RGB(0, 0, 0),
    Transparency=Slider(0.8, range=0..1),
    Shine=0)
colour_swatch = ColourSwatch(SwatchColor=RGB(201, 194, 153))
colour_swatch_2 = ColourSwatch(SwatchColor=RGB(153, 147, 112))
custom_preview = CustomPreview(Geometry=cluster_2.window_2, Material=create_material)
custom_preview_lineweights_3 = CustomPreviewLineweights(Geometry=brep_wireframe, Shader=ColourSwatch(SwatchColor=RGB(0, 0, 0)), Thickness=2, Absolute=False)

# ----
join_curves = JoinCurves(Curves=[cluster_2.hb_o, cluster_2.hb_c], Preserve=False)
merge = Merge(Data1=cluster_2.floor_2, Data2=group, Data3=group_2, Data4=group_3, Data5=group_4, Data6=group_5)
unit_z = UnitZ(Factor="2.44")
unit_z_2 = UnitZ(Factor="2.44")
open = Curve(cluster_2.hb_o)
close = Curve(cluster_2.hb_c)
bounding_box = BoundingBox(Content=cluster_2.floor_2, Plane=PlaneXY(0, 0, 0), UnionBox=True)  # -> Box, flatten(Box_2)
extrude = Extrude(Base=close, Direction=unit_z)
extrude_2 = Extrude(Base=open, Direction=unit_z_2)
list_item_2 = ListItem(List=bounding_box.Box_2, Index=0, Wrap=True)
boundary_surfaces_2 = BoundarySurfaces(Edges=join_curves)
geometry_2 = Geometry(extrude)
number_slider_2 = Slider(4, range=0..10)
geometry_3 = Geometry(extrude_2)
area_2 = Area(Geometry=list_item_2)  # -> Area, Centroid

# ---- group: Geometry output / Wall
custom_preview_2 = CustomPreview(Geometry=cluster_2.facade_2, Material=colour_swatch)

# ---- group: Geometry output / Interior
custom_preview_3 = CustomPreview(Geometry=cluster_2.interior_wall_2, Material=colour_swatch_2)

# ---- group: Geometry output / Roof
custom_preview_4 = CustomPreview(Geometry=[cluster_2.roof_2, cluster_2.frame_2, cluster_2.floor_2], Material=create_material_2)

# ----
number_slider_3 = Slider(1, range=0..10)

explode_tree = ExplodeTree(Data=graft(cluster_2.floor_2))  # -> _00000, Branch1
deconstruct_brep = DeconstructBrep(Brep=explode_tree._00000)  # -> Faces, Edges, Vertices
list_item_3 = ListItem(List=deconstruct_brep.Faces, Index=0, Wrap=True)
curve_4 = Curve(list_item_3)
# Dimension
number_slider_4 = Slider(3, range=1..4)
explode_2 = Explode(Curve=curve_4, Recursive=True)  # -> flatten(Segments), Vertices
number_slider_5 = Slider(50, range=0..100)
number_slider_6 = Slider(20, range=0..100)
list_item_4 = ListItem(List=explode_2.Segments, Index=0, Wrap=True)
list_item_5 = ListItem(List=explode_2.Segments, Index=number_slider_4, Wrap=True)
end_points_2 = EndPoints(Curve=list_item_5)  # -> Start, End
end_points_3 = EndPoints(Curve=list_item_4)  # -> Start, End
aligned_dimension = AlignedDimension(
    Plane=PlaneXY(0, 0, 0),
    PointA=end_points_2.Start,
    PointB=end_points_2.End,
    Offset=number_slider_2,
    Text="{0:0.00}",
    Size=number_slider_3)
aligned_dimension_2 = AlignedDimension(
    Plane=PlaneXY(0, 0, 0),
    PointA=end_points_3.Start,
    PointB=end_points_3.End,
    Offset=number_slider_2,
    Text="{0:0.00}",
    Size=number_slider_3)

brep_2 = Brep(cluster_2.interior_wall_2)
rotate_2 = Rotate(Geometry=boundary_surfaces_2, Angle=degrees(rotation_degree), Plane=area_2.Centroid)  # -> simplify(graft(Geometry)), Transform
rotate_3 = Rotate(Geometry=geometry_2, Angle=degrees(rotation_degree), Plane=area_2.Centroid)  # -> simplify(graft(Geometry)), Transform
rotate_4 = Rotate(Geometry=geometry_3, Angle=degrees(rotation_degree), Plane=area_2.Centroid)  # -> simplify(graft(Geometry)), Transform
floor = Brep(cluster_2.floor_2)
unit_z_3 = UnitZ(Factor="2.44")
deconstruct_brep_2 = DeconstructBrep(Brep=floor)  # -> Faces, Edges, Vertices
honeybee = Honeybee_Honeybee()  # -> Vviiiiiiiiiizzz; plug-in component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
move = Move(Geometry=rotate_2.Geometry, Motion=unit_z_3)  # -> Geometry, Transform
list_item_6 = ListItem(List=deconstruct_brep_2.Faces, Index=0, Wrap=True)
wall_surface_with_opening = Brep(rotate_4.Geometry)
area_3 = Area(Geometry=wall_surface_with_opening)  # -> Area, Centroid
scale = Scale(Geometry=wall_surface_with_opening, Center=area_3.Centroid, Factor=Slider(0.9, range=0..1))  # -> Geometry, Transform

# ---- group: ceiling
roof = Brep(move.Geometry)

# ---- group: floor
floor_2 = Brep(rotate_2.Geometry)

# ----
wall_total_numb = Integer(cluster_2.facade_number)
total_window_numb = Integer(cluster_2.window_number)
terrasse = Integer(cluster_2.terrace_area)
interior_wall = Integer(cluster_2.interior_wall_length)

# ---- group: Number of Panels
total_wall_panels_number = Panel(wall_total_numb)

# Important toggle
# NOTE
# OUTPUT DATA
terrasse_m2 = Panel(terrasse)

total_windows_number = Panel(total_window_numb)

# ----
dimensions = Dimensions(Surface=list_item_6)  # -> UDimension, VDimension
length_x_m = Panel(dimensions.UDimension)
length_y_m = Panel(dimensions.VDimension)

lng = ListLength()
series = Series(Start=1, Step=1, Count=lng)
concat = Concatenate(FragmentA="mesh", FragmentB=series)

# ----
# Analyzing geometries
# LADYBUG
# INTERGRATED DAYLIGHT & ENERGY SIMULATION
# Colored Mesh-sDA(no blinds)
# Colored Mesh-DA
# 1. Weather file
# NOTA: TO ACTIVATE SIMULATION, ENABLE THIS!
honeybee_2 = Honeybee_Honeybee()  # -> Vviiiiiiiiiizzz; plug-in component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
ladybug = Ladybug_Ladybug()  # -> Vviiiiiiiiiizzz; plug-in component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
wall_surface_with_opening_2 = Brep(rotate_4.Geometry)
walls_no_window = Brep(rotate_3.Geometry)
int_wall = Brep(brep_2)
glass = Brep(scale.Geometry)
createhbsrfs = Honeybee_createHBSrfs(geometry=int_wall, srfType="0")  # -> readMe, simplify(HBSurface); plug-in component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
createhbsrfs_2 = Honeybee_createHBSrfs(geometry=flatten(floor_2), srfType="2")  # -> readMe, simplify(HBSurface); plug-in component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
bldgprograms = Honeybee_bldgPrograms({"Office": 0, "Retail": 1, "MidriseApartment": 2, "PrimarySchool": 3, "SecondarySchool": 4, "SmallHotel": 5, "LargeHotel": 6, "Hospital": 7, "Outpatient": 8, "Warehouse": 9, "SuperMarket": 10, "FullServiceRestaurant": 11, "QuickServiceRestaurant": 12}, selected="MidriseApartment")
createhbsrfs_3 = Honeybee_createHBSrfs(geometry=wall_surface_with_opening_2, srfType="0")  # -> readMe, simplify(HBSurface); plug-in component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
addhbglz = Honeybee_addHBGlz(HBObj=flatten(createhbsrfs_3.HBSurface), childSurfaces=flatten(glass))  # -> simplify(HBObjWGLZ); plug-in component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
createhbsrfs_4 = Honeybee_createHBSrfs(geometry=roof, srfType="1")  # -> readMe, simplify(HBSurface); plug-in component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
createhbsrfs_5 = Honeybee_createHBSrfs(geometry=walls_no_window, srfType="0")  # -> readMe, simplify(HBSurface); plug-in component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
listzoneprograms = Honeybee_ListZonePrograms(bldgProgram=bldgprograms)  # -> MidriseApartmentZonePrograms; plug-in component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
ghpython_script_4 = GhPythonScript(x=x, y=y)  # -> out
# ---------- ghpython_script_4: Python ----------
import Rhino.Geometry as rg

if (x==(3)) and (y==(3)):
    print(0)
else:
    print(1)
# ---------- end ghpython_script_4 ----------
merge_2 = Merge(
    Data1=createhbsrfs_5.HBSurface,
    Data2=createhbsrfs_4.HBSurface,
    Data3=createhbsrfs_2.HBSurface,
    Data4=addhbglz,
    Data5=createhbsrfs.HBSurface)
merge_3 = Merge(Data1=createhbsrfs_5.HBSurface, Data2=createhbsrfs_4.HBSurface, Data3=createhbsrfs_2.HBSurface, Data4=addhbglz)
stream_filter = StreamFilter(Gate=ghpython_script_4, Stream0=merge_3, Stream1=merge_2)
item = ListItem(List=listzoneprograms, Index=0, Wrap=True)
panel_17 = Panel(item)
value_list = ValueList({"PARIS": 0, "SAN PAULO": 1, "Concepcion, Chile": 2}, selected="PARIS")
mesh_color_file_from_hops = Data(hops.Colormesh)
number_slider_7 = Slider(8, range=0..20)
floor_3 = Surface(floor_2)
srf = Surface(floor_3)
divide = DivideDomain²(Domain=srf, UCount=number_slider_7, VCount=number_slider_7)
Z = UnitZ(Factor=Slider(0.3, range=0..1))
list = ValueList({"VeryLow": "1,512,256,128,0.15,0.004", "Low": "2,512,256,128,0.15,0.004", "Medium": "4,1024,256,256,0.1,0.004", "High": "1,4096,512,1024,0.1,0.001"}, selected="VeryLow")
subsrf = Isotrim(Surface=srf, Domain=divide)
move_2 = Move(Geometry=subsrf, Motion=Z)  # -> Geometry, Transform
split = TextSplit(Text=list, Separators=",")
toggle = BooleanToggle(True)
move_3 = Move(Geometry=srf, Motion=Z)  # -> Geometry, Transform
area_4 = Area(Geometry=move_2.Geometry)  # -> Area, simplify(Centroid)
item_2 = ListItem(List=split, Index=0, Wrap=True)  # -> Item, Item1, Item2, Item3, Item4
points = PointList(Points=area_4.Centroid)
Z_2 = UnitZ(Factor=area_4.Centroid)
workingdir = Panel("C:\Users\kimky\Desktop\tmp\S4-STUDIO\Daylight_Autonomy")
radparameters = Honeybee_RADParameters(quality=0, ab=item_2.Item, ad=item_2.Item1, as=item_2.Item2, ar=item_2.Item3, aa=item_2.Item4)  # -> readMe, radParameters; plug-in component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
mesh_uv = MeshSurface(Surface=move_3.Geometry, UCount=number_slider_7, VCount=number_slider_7, Overhang=True, Equalize=False)  # -> simplify(Mesh)
amp = Amplitude(Vector=Z_2, Amplitude=1)  # -> simplify(Vector)

# ---- group: collect all honeybee surfaces
brep_3 = Brep(flatten(stream_filter))

# ----
# sDA - no blinds
panel_18 = Panel(",")
split_2 = TextSplit(Text=simplify(flatten(mesh_color_file_from_hops)), Separators=panel_18)
larger = LargerThan(FirstNumber=split_2, SecondNumber="50")  # -> LargerThan, OrEqualTo
cullf = CullFaces(Mesh=mesh_uv, Pattern=larger.OrEqualTo)
mcol = MeshColours(Mesh=cullf, Colours=ColourSwatch(SwatchColor=RGB(255, 219, 77)))
mjoin = MeshJoin(Meshes=mcol)
mesh = Mesh(mjoin)

# ----
# sDA
sda_per_space = Panel(mesh)

epw_paris = Panel("https://www.energyplus.net/weather-download/europe_wmo_region_6/FRA//FRA_Paris.Orly.071490_IWEC/all")
epw_san_paulo = Panel("http://climate.onebuilding.org/WMO_Region_3_South_America/BRA_Brazil/SP_Sao_Paulo/BRA_SP_Sao.Paulo.869100_TMYx.zip")
epw_concepcion_chile = Panel("http://climate.onebuilding.org/WMO_Region_3_South_America/CHL_Chile/BI_Bio-Bio/CHL_BI_Concepcion.856830_TMYx.zip")
number_slider_8 = Slider(24, range=0..100)
epwmap = LBEPWmap(epw_map=Toggle(False))  # -> Output; plug-in component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
northarrow_2 = Ladybug_North(north=number_slider_8, scale=".05")  # -> northSign; plug-in component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

wires = BrepWireframe(Brep=brep_3, Density=-1)
createhbzones = Honeybee_createHBZones(name="HOUSE ENERGY SIMULATION", zoneProgram=item, HBSurfaces=flatten(brep_3), isConditioned=True)  # -> readMe, HBZone; plug-in component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
stream_filter_2 = StreamFilter(Gate=value_list, Stream0=epw_paris, Stream1=epw_san_paulo, Stream2=epw_concepcion_chile)
roundd = RoundToDecimalPlace(NumberX=split_2, DecimalPlace=Slider(2, range=0..10), RoundType=0)  # -> Rounded, Difference

epw_stat = Ladybug_OpenEPWAndSTATWeatherFiles(weatherFileURL=stream_filter_2)  # -> epwFile, statFile; disabled; plug-in component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

annualdaylightsimulation = Honeybee_AnnualDaylightSimulation(
    north=number_slider_8,
    epwWeatherFile=epw_stat.epwFile,
    testPoints=area_4.Centroid,
    ptsVectors=amp,
    testMesh=mesh_uv,
    radParameters=radparameters.radParameters)  # -> analysisRecipe; plug-in component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
rundaylightanalysis = Honeybee_RunDaylightSimulation(
    HBObjects=flatten(brep_3),
    analysisRecipe=annualdaylightsimulation,
    writeRad=toggle,
    runRad=toggle,
    numOfCPUs=Slider(4, range=0..10),
    workingDir=workingdir,
    overwriteResults=True)  # -> readMe, analysisType, resultsUnit, results, testPts, resultFiles, radGeoFile, studyFolder, done; plug-in component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

gradientlibrary = Ladybug_GradientLibrary(gradIndex=Slider(0, range=0..100))  # -> customColors; plug-in component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
legend = Legend(Colour=gradientlibrary, Tags=["One Fish", "Two Fish", "Red Fish", "Blue Fish"], LegendType=1)
legendpar = Ladybug_LegendParameters(lowBound="0", highBound="100", numSegments=Slider(6, range=0..10), customColors=flatten(gradientlibrary))  # -> legendPar; plug-in component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
recolormesh = Ladybug_RecolorMesh(
    analysisResult=mesh_color_file_from_hops,
    inputMesh=mesh_uv,
    legendPar=legendpar,
    analysisTitle=rundaylightanalysis.analysisType,
    legendTitle=rundaylightanalysis.resultsUnit)  # -> out, newMesh, newLegend, legendBasePt, meshColors, legendColors; plug-in component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

mesh_2 = Mesh(recolormesh.newMesh)
X = UnitX(Factor=Slider(13, range=0..15))
move_4 = Move(Motion=X)  # -> Geometry, Transform
move_5 = Move(Geometry=mesh_2, Motion=X)  # -> Geometry, Transform
move_6 = Move(Motion=X)  # -> Geometry, Transform
points_2 = PointList(Points=move_6.Geometry)

# ----
# DA
mesh_3 = Mesh([recolormesh.newMesh, recolormesh.newLegend])

# ----
# *NOTA: Construction time SIP house:
# 8 days.
# Let's say, general house size 65m2.
# 65m2 / 8days = 8.125 m2 / 1 day
panel_19 = Panel("1.22")
total_interior_wall_length = Panel(interior_wall)
area_m2 = Panel(cluster_2.area_3)
integer = Integer(total_interior_wall_length)
expression = Expression(x=terrasse, Expression="x * 350")
expression_2 = Expression(x=total_windows_number, Expression="x * 1000")
ghpython_script_5 = GhPythonScript(x=expression)  # -> out
# ---------- ghpython_script_5: Python ----------
import Rhino.Geometry as rg

if x is None:
    print(0)
else:
    print(x)
# ---------- end ghpython_script_5 ----------
integer_2 = Integer(ghpython_script_5)
integer_3 = Integer(expression_2)
panel_20 = Panel(ghpython_script_5)
terrace_cost = Panel(expression)
window_cost = Panel(expression_2)

# ----
# *NOTA: 1 m2 = 10.764 Square foot
# SIP WOOD:17-30$/m2, here, 30$
# Wood window type Bay : 800-2700$, here 1000$, Terrasse composite 350$ / m2
multiplication = Multiplication(A=panel_19, B="2.44")
integer_4 = Integer(total_wall_panels_number)
multiplication_2 = Multiplication(A=multiplication, B=integer_4)
expression_3 = Expression(x=multiplication_2, Expression="x * 10.764 * 30")
integer_5 = Integer(expression_3)

multiplication_3 = Multiplication(A=multiplication, B=integer)
expression_4 = Expression(x=multiplication_3, Expression="x * 10.764 * 20")
integer_6 = Integer(expression_4)
facade_wall_cost = Panel(expression_3)
interior_wall_2 = Panel(integer_6)

mass_addition = MassAddition(Input=flatten([integer_5, integer_6, integer_3, integer_2]))  # -> Result, PartialResults
total_construction_cost = Panel(mass_addition.Result)

expression_5 = Expression(x=cluster_2.area_3, Expression="x / 8.125")

# ---- group: Integer
ghpython_script_6 = GhPythonScript(R=expression_5)  # -> out; disabled
# ---------- ghpython_script_6: Python ----------
import Rhino.Geometry as rg

if R < 1:
    print(int(1))
else: 
    print(R)
# ---------- end ghpython_script_6 ----------
integer_7 = Integer(expression_5)

# ----
construction_time_days = Panel(integer_7)

wlc_minimize_construction_cost = Number(mass_addition.Result)
construction_time = Number(integer_7)
area_5 = Number(cluster_2.area_3)  # disabled
electricity_consumption = Number()
interiorwall_cost = Integer(interior_wall_2)
totalcooling = Number()
totalheating = Number()
window_cost_2 = Integer(window_cost)
window_n = Data(total_windows_number)
electriclight = Number()
terrace_cost_2 = Integer(terrace_cost)
da_mesh_grid = Number()
facade_cost = Integer(facade_wall_cost)
wall_n = Data(total_wall_panels_number)
sda_2 = Number()
len_y = Data(length_y_m)
len_x = Data(length_x_m)

integer_8 = Integer(ghpython_script.a)
rotation = Data(integer_8)
integer_9 = Integer(area_5)  # disabled
text = Text(terrace_cost_2)
integer_10 = Integer(electriclight)
integer_11 = Integer(totalcooling)
integer_12 = Integer(totalheating)
integer_13 = Integer(sda_2)
ghpython_script_7 = GhPythonScript(x=text)  # -> out
# ---------- ghpython_script_7: Python ----------
import Rhino.Geometry as rg

if x is None:
    print(0)
# ---------- end ghpython_script_7 ----------
panel_21 = Panel(integer_9)  # disabled
integer_14 = Integer(electricity_consumption)
integer_15 = Integer(da_mesh_grid)
panel_22 = Panel(rotation)
panel_23 = Panel(construction_time)
panel_24 = Panel(wlc_minimize_construction_cost)
panel_25 = Panel(integer_10)
panel_26 = Panel(integer_11)
panel_27 = Panel(integer_12)
panel_28 = Panel(integer_13)
panel_29 = Panel(integer_14)
panel_30 = Panel(len_x)
panel_31 = Panel(len_y)
panel_32 = Panel(interiorwall_cost)
panel_33 = Panel(wall_n)
panel_34 = Panel(window_n)
panel_35 = Panel(ghpython_script_7)
panel_36 = Panel(window_cost_2)
panel_37 = Panel(integer_15)
panel_38 = Panel(facade_cost)
panel_39 = Panel(concat)

labels = Panel("""City
ConstructionTime
ConstructionCost
Rotation
LengthX
LengthY
Wall_num
Window_num
sDA
TotalElec
Light
Cooling
Heating
TerraceCost
WindowCost
ExtCost
IntCost""")
merge_4 = Merge(
    Data1=flatten(construction_time),
    Data2=flatten(wlc_minimize_construction_cost),
    Data3=flatten(panel_22),
    Data4=flatten(panel_30),
    Data5=flatten(panel_31),
    Data6=flatten(panel_33),
    Data7=flatten(panel_34),
    Data8=flatten(panel_28),
    Data9=flatten(panel_29),
    Data10=flatten(panel_25),
    Data11=flatten(panel_26),
    Data12=flatten(panel_27),
    Data13=flatten(panel_35),
    Data14=flatten(panel_36),
    Data15=flatten(panel_38),
    Data16=flatten(panel_32),
    Data17=flatten(panel_37))
ghpython_script_8 = GhPythonScript()  # -> out
# ---------- ghpython_script_8: Python ----------
import Rhino.Geometry as rg

if x == 0:
    print("Ils-de-France")
elif x == 1:
    print("San_Paulo")
else:
    print("Concepcion")
# ---------- end ghpython_script_8 ----------
panel_40 = Panel(ghpython_script_8)
list_length = ListLength(List=merge_4)
workingdir_2 = Panel("C:\Users\kimky\Desktop\tmp\DATASET_V7_studio.csv")
insert_items = InsertItems(List=merge_4, Item=panel_40, Indices=expr("x+1", list_length), Wrap=True)
join = TextJoin(Text=insert_items, Join=",")
num = Number()
panel_41 = Panel(insert_items)

merge_5 = Merge(Data1=flatten(labels), Data2=flatten(panel_39))
panel_42 = Panel(merge_5)
concatenate_2 = Concatenate(FragmentA=panel_42, FragmentB=panel_41)
panel_43 = Panel(concatenate_2)
merge_6 = Merge(Data1=labels, Data2=panel_41)
# TITLE
# GENERATIVE OUTPUT
# ERROR
# QUESTION
# OUTPUT
# INPUT
panel_44 = Panel(merge_6)

join_2 = TextJoin(Text=merge_5, Join=",")
export_robotmotion_3_r3_multi = PythonScript(toggle=Toggle(True), path=workingdir_2, x=join, labs=join_2, y=num)
# ---------- export_robotmotion_3_r3_multi: Python ----------
#script by Gabriella Rossi / CITA
import os
from os import listdir
from os.path import isfile, join
from scriptcontext import sticky as st

if True:
    #Create file
    filename = str(path)
    fil = open(filename, 'a+')
    
    if y < 1 :

        #write header and first line
        fil.write(labs)
        fil.write('\n' + x)
    else:
        #just write line
        fil.write('\n' + x)

    fil.close()
# ---------- end export_robotmotion_3_r3_multi ----------

panel_45 = Panel("How are you? ")
get_string_3 = GetString(AtLeast=1, AtMost=2147483647)
pt = Point(Point(-4371.132221, 32662.61474, 0))
bool = Boolean(True)
c_script = CSharpScript(face="Verdana", bold=bool, size=Slider(1, range=0..1), content=merge_6, pl=pt)  # -> out, A; inputs face: String, bold: Boolean, italics: Boolean, size: Double, content: String, pl: Plane
# ---------- c_script: C# usings ----------
using System.IO;
using System.Linq;
using System.Data;
using System.Drawing;
using System.Reflection;
using System.Windows.Forms;
using System.Xml;
using System.Xml.Linq;
using System.Runtime.InteropServices;

using Rhino.DocObjects;
using Rhino.Collections;
using GH_IO;
using GH_IO.Serialization;
# ---------- c_script: C# ----------
    if(size == 0)
      size = 1;

    if(!string.IsNullOrEmpty(face) && size > 0 && !string.IsNullOrEmpty(content) &&
      pl.IsValid)
    {
      using (var doc = Rhino.RhinoDoc.CreateHeadless(null))
      {
        var te = doc.Objects.AddText(content, pl, size, face, bold, italics);
        var txt = doc.Objects.Find(te) as Rhino.DocObjects.TextObject;

        if(txt != null)
        {
          var tt = txt.Geometry as Rhino.Geometry.TextEntity;
          A = tt.Explode();
        }
      }
    }
# ---------- end c_script ----------

# ---- group: RH_OUT:text_lines
crv = Curve(c_script.A)

# ---- group: TEXT _ Average in Curve
unit_y = UnitY(Factor=Slider(0, range=0..100))
move_7 = Move(Geometry=crv, Motion=unit_y)  # -> Geometry, Transform

# ----
custom_preview_lineweights_4 = CustomPreviewLineweights(Geometry=move_7.Geometry, Shader=ColourSwatch(SwatchColor=RGB(0, 0, 0)), Absolute=False)

# ==== cluster Cluster
point = ClusterInput()
point_2 = Point(point)
data = ClusterInput()
integer = ClusterInput()
data_2 = Data(data)
integer_2 = Integer(integer)
data_3 = ClusterOutput(data_2)
outline_color = ColourSwatch(SwatchColor=RGB(0, 0, 0))
label_color = ColourSwatch(SwatchColor=RGB(0, 0, 0))
list_length = ListLength(List=data_2)
integer_3 = ClusterOutput(integer_2)
ma = MassAddition(Input=integer_2)  # -> Result, PartialResults
label_color_2 = ClusterOutput(label_color)
ma_2 = MassAddition(Input=list_length)  # -> Result, PartialResults
division = Division(A=integer_2, B=ma.Result)
A = ClusterInput()
division_2 = Division(A=list_length, B=ma_2.Result)
multiplication = Multiplication(A=A, B=2)
ma_3 = MassAddition(Input=division)  # -> Result, PartialResults
ma_4 = MassAddition(Input=division_2)  # -> Result, PartialResults
R = ClusterInput()
R_2 = ClusterInput()
cir = Circle(Plane=point_2, Radius=R)
cir_2 = Circle(Plane=point_2, Radius=R_2)
shatter = Shatter(Curve=reparameterize(cir_2), Parameters=ma_3.PartialResults)
shatter_2 = Shatter(Curve=reparameterize(cir), Parameters=ma_3.PartialResults)
num = Number(0.5)
num_2 = Number(0.5)
eval = EvaluateCurve(Curve=reparameterize(cir), Parameter=ma_3.PartialResults)  # -> Point, Tangent, Angle
planar = PlanarSrf(Edges=cir)
area = Area(Geometry=cir)  # -> Area, Centroid
eval_2 = EvaluateCurve(Curve=reparameterize(shatter), Parameter=num)  # -> Point, Tangent, Angle
area_2 = Area(Geometry=cir_2)  # -> Area, Centroid
eval_3 = EvaluateCurve(Curve=reparameterize(shatter_2), Parameter=num_2)  # -> Point, Tangent, Angle
vec2pt = Vector2Pt(PointA=area_2.Centroid, PointB=eval_2.Point, Unitize=False)  # -> Vector, Length
ln = Line(StartPoint=area.Centroid, EndPoint=eval.Point)
vec2pt_2 = Vector2Pt(PointA=area.Centroid, PointB=eval_3.Point, Unitize=False)  # -> Vector, Length
amp = Amplitude(Vector=vec2pt.Vector, Amplitude=multiplication)
A_2 = ClusterInput()
R_3 = ClusterInput()
amp_2 = Amplitude(Vector=vec2pt_2.Vector, Amplitude=A_2)
cir_3 = Circle(Plane=point_2, Radius=R_3)
srfsplit = SurfaceSplit(Surface=planar, Curves=ln)
move = Move(Geometry=eval_2.Point, Motion=amp)  # -> Geometry, Transform
move_2 = Move(Geometry=eval_3.Point, Motion=amp_2)  # -> Geometry, Transform
vdis = VectorDisplay(Anchor=eval_3.Point, Vector=move_2.Geometry)
G = ClusterOutput(move.Geometry)
srfsplit_2 = SurfaceSplit(Surface=srfsplit, Curves=cir_3)
G_2 = ClusterOutput(move_2.Geometry)
list_item = ListItem(List=srfsplit_2, Index=1, Wrap=True)  # -> flatten(Item)
area_3 = Area(Geometry=list_item)  # -> Area, Centroid
sort = SortList(Keys=area_3.Area, ValuesA=list_item)  # -> Keys, ValuesA
edges = BrepEdges(Brep=list_item)  # -> Naked, Interior, NonManifold
K = ClusterOutput(sort.Keys)
A_3 = ClusterOutput(sort.ValuesA)
list_item_2 = ListItem(List=sort.Keys, Index=0, Wrap=True)
list_item_3 = ListItem(List=reverse(sort.Keys), Index=0, Wrap=True)
preview = CustomPreview(Geometry=edges.Naked, Shader=outline_color)
i = ClusterOutput(list_item_2)
i_2 = ClusterOutput(list_item_3)

# ==== cluster Cluster_5
plane = ClusterInput()
x = ClusterInput()
y = ClusterInput()
cluster = Cluster_2(plane=plane, x_size=x, y_size=y)  # -> vertices, C, item_2
rotation_angle = ClusterInput()

panel = Panel(x)
panel_2 = Panel(y)
ghpython_script = GhPythonScript(x=x, y=y)  # -> out, a
# ---------- ghpython_script: Python ----------
import Rhino.Geometry as rg

if (x==(3)) and (y==(3)):
    print(0)

if (x==(3)) and (y==(4)):
    print(1)


if (x==(4)) and (y==(3)):
    print(2)

if (x==(4)) and (y==(4)):
    print(3)


if (x==(4)) and (y==(5)):
    print(4)

if (x==(4)) and (y==(6)):
    print(5)


if (x==(5)) and (y==(3)):
    print(6)

if (x==(5)) and (y==(4)):
    print(7)


if (x==(5)) and (y==(5)):
    print(8)

if (x==(5)) and (y==(6)):
    print(9)


if (x==(5)) and (y==(7)):
    print(10)

if (x==(6)) and (y==(3)):
    print(11)


if (x==(6)) and (y==(4)):
    print(12)

if (x==(6)) and (y==(5)):
    print(13)


if (x==(6)) and (y==(6)):
    print(14)

if (x==(6)) and (y==(7)):
    print(15)


if (x==(6)) and (y==(8)):
    print(16)

if (x==(7)) and (y==(5)):
    print(17)


if (x==(7)) and (y==(6)):
    print(18)

if (x==(7)) and (y==(7)):
    print(19)


if (x==(7)) and (y==(8)):
    print(20)

if (x==(7)) and (y==(9)):
    print(21)


if (x==(8)) and (y==(5)):
    print(22)

if (x==(8)) and (y==(6)):
    print(23)


if (x==(8)) and (y==(7)):
    print(24)

if (x==(8)) and (y==(8)):
    print(25)


if (x==(8)) and (y==(9)):
    print(26)

if (x==(8)) and (y==(10)):
    print(27)


if (x==(9)) and (y==(6)):
    print(28)

if (x==(9)) and (y==(7)):
    print(29)


if (x==(9)) and (y==(8)):
    print(30)

if (x==(9)) and (y==(9)):
    print(31)


if (x==(9)) and (y==(10)):
    print(32)

if (x==(9)) and (y==(11)):
    print(33)


if (x==(10)) and (y==(8)):
    print(34)

if (x==(10)) and (y==(9)):
    print(35)


if (x==(10)) and (y==(10)):
    print(36)

if (x==(10)) and (y==(11)):
    print(37)


if (x==(10)) and (y==(12)):
    print(38)

if (x==(11)) and (y==(9)):
    print(39)


if (x==(11)) and (y==(10)):
    print(40)

if (x==(11)) and (y==(11)):
    print(41)


if (x==(11)) and (y==(12)):
    print(42)

if (x==(12)) and (y==(10)):
    print(43)


if (x==(12)) and (y==(11)):
    print(44)

if (x==(12)) and (y==(12)):
    print(45)
# ---------- end ghpython_script ----------

cluster_2 = Cluster_3(
    G_3=ghpython_script.out,
    G_4=ghpython_script.out,
    G_5=ghpython_script.out,
    G=ghpython_script.out,
    G_2=ghpython_script.out,
    gate_2=ghpython_script.out,
    gate_3=ghpython_script.out,
    gate_4=ghpython_script.out,
    gate=ghpython_script.out,
    gate_5=ghpython_script.out,
    gate_6=ghpython_script.out,
    G_6=ghpython_script.out,
    G_7=ghpython_script.out,
    G_9=ghpython_script.out,
    G_8=ghpython_script.out,
    G_10=ghpython_script.out)  # -> s_41_4, s_41_5, s_41_6, s_41_2, s_41_3, s_41_7, s_41_8, s_41_9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

cluster_3 = Cluster_4(
    A=cluster.C,
    B=cluster.item_2,
    L=cluster.vertices,
    d1=cluster_2.s_41_4,
    d2=cluster_2.s_41_5,
    G=cluster_2.s_41_6,
    G_2=cluster_2.s_41_2,
    G_3=cluster_2.s_41_3,
    hb_o=cluster_2.s_41_10,
    hb_c=cluster_2.s_41_11,
    G_8=cluster_2.s_41_12,
    G_5=cluster_2.s_41_13,
    G_6=cluster_2.s_41_15,
    G_4=cluster_2.s_41_14,
    G_7=cluster_2.s_41_16)  # -> slab, G_9, brep, brep_2, E, E_2, hb_o_2, hb_c_2, R

interior_wall = Geometry(cluster_3.brep)
window = Geometry(cluster_3.E)
roof = Geometry(cluster_3.R)
floor = Geometry(cluster_3.slab)
facade = Geometry(cluster_3.brep_2)
frame = Geometry(cluster_3.E_2)

group = Group(Objects=interior_wall)
group_2 = Group(Objects=window)
group_3 = Group(Objects=facade)
group_4 = Group(Objects=frame)
group_5 = Group(Objects=roof)
merge = Merge(Data1=floor, Data2=group_5, Data3=group, Data4=group_2, Data5=group_3, Data6=group_4)
bounding_box = BoundingBox(Content=merge, Plane=PlaneXY(0, 0, 0), UnionBox=True)  # -> Box, flatten(Box_2)
list_item = ListItem(List=bounding_box.Box_2, Index=0, Wrap=True)
area = Area(Geometry=list_item)  # -> Area, Centroid
join_curves = JoinCurves(Curves=[cluster_3.hb_o_2, cluster_3.hb_c_2], Preserve=False)
rotate = Rotate(Geometry=floor, Angle=degrees(rotation_angle), Plane=area.Centroid)  # -> simplify(graft(Geometry)), Transform
rotate_2 = Rotate(Geometry=interior_wall, Angle=degrees(rotation_angle), Plane=area.Centroid)  # -> simplify(graft(InteriorWall)), Transform
rotate_3 = Rotate(Geometry=roof, Angle=degrees(rotation_angle), Plane=area.Centroid)  # -> simplify(graft(Geometry)), Transform
rotate_4 = Rotate(Geometry=facade, Angle=degrees(rotation_angle), Plane=area.Centroid)  # -> simplify(graft(Geometry)), Transform
rotate_5 = Rotate(Geometry=window, Angle=degrees(rotation_angle), Plane=area.Centroid)  # -> simplify(graft(Geometry)), Transform
rotate_6 = Rotate(Geometry=frame, Angle=degrees(rotation_angle), Plane=area.Centroid)  # -> simplify(graft(Geometry)), Transform
area_2 = Area(Geometry=join_curves)  # -> Area, Centroid
floor_2 = ClusterOutput(rotate.Geometry)
facade_2 = ClusterOutput(rotate_4.Geometry)
roof_2 = ClusterOutput(rotate_3.Geometry)
interior_wall_2 = ClusterOutput(rotate_2.InteriorWall)
window_2 = ClusterOutput(rotate_5.Geometry)
frame_2 = ClusterOutput(rotate_6.Geometry)
facade_number = ClusterOutput(cluster_2.s_41_7)
window_number = ClusterOutput(cluster_2.s_41_8)
area_3 = ClusterOutput(area_2.Area)
hb_c = ClusterOutput(cluster_3.hb_c_2)
terrace_area = ClusterOutput(cluster_2.s_41_9)
interior_wall_length = ClusterOutput(cluster_2.s_41)
hb_o = ClusterOutput(cluster_3.hb_o_2)

# ==== cluster Cluster_2
x_size = ClusterInput()
y_size = ClusterInput()
plane = ClusterInput()
rectangle = Rectangle(Plane=plane, XSize=x_size, YSize=y_size, Radius=0)  # -> Rectangle, Length
curve = Curve(rectangle.Rectangle)
area = Area(Geometry=rectangle.Rectangle)  # -> Area, Centroid
C = ClusterOutput(area.Centroid)
explode = Explode(Curve=curve, Recursive=True)  # -> Segments, Vertices
deconstruct_brep = DeconstructBrep(Brep=curve)  # -> Faces, Edges, Vertices
crv_cp = CurveClosestPoint(Point=area.Centroid, Curve=explode.Segments)  # -> Point, Parameter, Distance
vertices = ClusterOutput(deconstruct_brep.Vertices)
item = ListItem(List=crv_cp.Point, Index=1, Wrap=True)  # -> Item, Item1, Item2
item_2 = ClusterOutput(item.Item2)

# ==== cluster Cluster_3
crv = Curve(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)
crv_2 = Curve(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)
crv_3 = Curve([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])
crv_4 = Curve([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])
total_wall = Panel("8")
total_win = Panel("4")
# 0
crv_5 = Curve(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)
crv_6 = Curve([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])
honeyb_close = Curve([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])
honeyb_open = Curve([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])
total_wall_2 = Panel("10")
total_win_2 = Panel("4")
interior_wall_length = Panel("3.7")
honeyb_close_2 = Curve([<curve referenced from the Rhino model> x4])
honeyb_close_3 = Curve([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])
honeyb_open_2 = Curve([<curve referenced from the Rhino model> x4])
# 2
crv_7 = Curve(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)
crv_8 = Curve([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])
crv_9 = Curve([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])
crv_10 = Curve([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])
crv_11 = Curve([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])
honeyb_close_4 = Curve([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])
honeyb_open_3 = Curve([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])
honeyb_open_4 = Curve([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])
crv_12 = Curve(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)
crv_13 = Curve(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)
# 6
crv_14 = Curve(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)
crv_15 = Curve([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])
crv_16 = Curve([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])
crv_17 = Curve([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])
crv_18 = Curve([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])
total_wall_3 = Panel("10")
total_win_3 = Panel("6")
crv_19 = Curve([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])
crv_20 = Curve([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])
crv_21 = Curve([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])
# 11
crv_22 = Curve(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)
crv_23 = Curve([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])
interior_wall_length_2 = Panel("5")
total_wall_4 = Panel("10")
total_win_4 = Panel("8")
interior_wall_length_3 = Panel("5")
honeyb_close_5 = Curve([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])
honeyb_open_5 = Curve([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])
honeyb_close_6 = Curve([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])
crv_24 = Curve(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)
honeyb_open_6 = Curve([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])
crv_25 = Curve(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)
crv_26 = Curve(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)
interior_wall_length_4 = Panel("3.7")
total_wall_5 = Panel("8")
total_win_5 = Panel("6")
crv_27 = Curve([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])
honeyb_close_7 = Curve([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])
crv_28 = Curve([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])
crv_29 = Curve([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])
crv_30 = Curve([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])
crv_31 = Curve([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])
crv_32 = Curve([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])
crv_33 = Curve(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)
crv_34 = Curve([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])
crv_35 = Curve([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])
honeyb_open_7 = Curve([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])
total_wall_6 = Panel("13")
total_win_6 = Panel("7")
# 1
crv_36 = Curve(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)
total_wall_7 = Panel("12")
total_win_7 = Panel("6")
crv_37 = Curve([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])
crv_38 = Curve([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])
crv_39 = Curve([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])
crv_40 = Curve(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)
crv_41 = Curve([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])
interior_wall_length_5 = Panel("8.5")
honeyb_close_8 = Curve([<curve referenced from the Rhino model> x4])
interior_wall_length_6 = Panel("8.5")
honeyb_open_8 = Curve([<curve referenced from the Rhino model> x4])
total_wall_8 = Panel("11")
total_win_8 = Panel("5")
crv_42 = Curve(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)
crv_43 = Curve([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])
crv_44 = Curve([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])
crv_45 = Curve([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])
crv_46 = Curve(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)
interior_wall_length_7 = Panel("3.7")
crv_47 = Curve([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])
honeyb_close_9 = Curve([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])
honeyb_open_9 = Curve([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])
honeyb_close_10 = Curve([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])
honeyb_open_10 = Curve([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])
honeyb_close_11 = Curve([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])
honeyb_open_11 = Curve([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])
crv_48 = Curve(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)
honeyb_close_12 = Curve([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])
honeyb_open_12 = Curve([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])
total_wall_9 = Panel("13")
total_win_9 = Panel("8")
crv_49 = Curve(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)
crv_50 = Curve([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])
crv_51 = Curve([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])
crv_52 = Curve([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])
crv_53 = Curve([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])
crv_54 = Curve(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)
interior_wall_length_8 = Panel("12.5")
honeyb_close_13 = Curve([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])
crv_55 = Curve(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)
honeyb_open_13 = Curve([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])
total_wall_10 = Panel("14")
total_win_10 = Panel("8.5")
total_wall_11 = Panel("13")
total_win_11 = Panel("11")
interior_wall_length_9 = Panel("17.8")
crv_56 = Curve([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])
crv_57 = Curve([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])
crv_58 = Curve([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])
# 17
crv_59 = Curve(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)
crv_60 = Curve([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])
crv_61 = Curve([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])
crv_62 = Curve([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])
crv_63 = Curve([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])
crv_64 = Curve(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)
crv_65 = Curve([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])
crv_66 = Curve(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)
interior_wall_length_10 = Panel("13.4")
interior_wall_length_11 = Panel("17.8")
total_wall_12 = Panel("13")
total_win_12 = Panel("11")
terrasse_m2 = Panel("7.8")
crv_67 = Curve(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)
crv_68 = Curve(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)
crv_69 = Curve([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])
total_wall_13 = Panel("11")
total_win_13 = Panel("7")
crv_70 = Curve([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])
crv_71 = Curve([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])
crv_72 = Curve([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])
crv_73 = Curve([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])
crv_74 = Curve([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])
# 3
crv_75 = Curve(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)
crv_76 = Curve([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])
crv_77 = Curve([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])
interior_wall_length_12 = Panel("8.5")
honeyb_close_14 = Curve([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])
honeyb_open_14 = Curve([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])
crv_78 = Curve(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)
crv_79 = Curve(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)
total_wall_14 = Panel("14")
total_win_14 = Panel("8")
crv_80 = Curve([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])
crv_81 = Curve([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])
crv_82 = Curve([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])
crv_83 = Curve([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])
honeyb_close_15 = Curve([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])
crv_84 = Curve(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)
honeyb_open_15 = Curve([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])
honeyb_close_16 = Curve([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])
honeyb_close_17 = Curve([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])
honeyb_open_16 = Curve([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])
interior_wall_length_13 = Panel("13.3")
honeyb_open_17 = Curve([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])
crv_85 = Curve(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)
honeyb_close_18 = Curve([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])
total_wall_15 = Panel("13")
total_win_15 = Panel("11")
crv_86 = Curve([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])
crv_87 = Curve([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])
crv_88 = Curve(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)
crv_89 = Curve([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])
crv_90 = Curve([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])
honeyb_open_18 = Curve([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])
crv_91 = Curve(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)
total_wall_16 = Panel("12")
total_win_16 = Panel("8")
crv_92 = Curve([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])
crv_93 = Curve([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])
total_wall_17 = Panel("13")
total_win_17 = Panel("13")
crv_94 = Curve([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])
crv_95 = Curve(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)
crv_96 = Curve([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])
crv_97 = Curve([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])
interior_wall_length_14 = Panel("14.6")
honeyb_close_19 = Curve([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])
honeyb_open_19 = Curve([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])
crv_98 = Curve([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])
crv_99 = Curve([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])
crv_100 = Curve([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])
interior_wall_length_15 = Panel("19")
# 5
# 4
crv_101 = Curve(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)
interior_wall_length_16 = Panel("8.5")
crv_102 = Curve(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)
interior_wall_length_17 = Panel("19")
total_wall_18 = Panel("13")
total_win_18 = Panel("13")
terrasse_m2_2 = Panel("9.3")
crv_103 = Curve([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])
crv_104 = Curve([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])
interior_wall_length_18 = Panel("19")
crv_105 = Curve([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])
crv_106 = Curve([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])
total_wall_19 = Panel("16")
total_win_19 = Panel("12")
terrasse_m2_3 = Panel("9.3")
crv_107 = Curve(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)
crv_108 = Curve(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)
crv_109 = Curve(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)
crv_110 = Curve([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])
crv_111 = Curve([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])
crv_112 = Curve([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])
crv_113 = Curve([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])
honeyb_close_20 = Curve([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])
honeyb_open_20 = Curve([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])
honeyb_close_21 = Curve([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])
crv_114 = Curve(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)
crv_115 = Curve(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)
crv_116 = Curve([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])
crv_117 = Curve([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])
crv_118 = Curve([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])
crv_119 = Curve([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])
honeyb_open_21 = Curve([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])
# 10
crv_120 = Curve(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)
honeyb_close_22 = Curve([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])
total_wall_20 = Panel("15")
total_win_20 = Panel("13")
honeyb_open_22 = Curve([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])
total_wall_21 = Panel("14")
total_win_21 = Panel("10")
total_wall_22 = Panel("14")
total_win_22 = Panel("12")
crv_121 = Curve([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])
crv_122 = Curve([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])
crv_123 = Curve(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)
crv_124 = Curve([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])
crv_125 = Curve([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])
crv_126 = Curve([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])
crv_127 = Curve([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])
crv_128 = Curve([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])
crv_129 = Curve(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)
crv_130 = Curve([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])
crv_131 = Curve(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)
interior_wall_length_19 = Panel("24.9")
interior_wall_length_20 = Panel("19.1")
interior_wall_length_21 = Panel("17.9")
honeyb_close_23 = Curve([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])
honeyb_open_23 = Curve([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])
crv_132 = Curve(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)
interior_wall_length_22 = Panel("24.9")
honeyb_close_24 = Curve([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])
honeyb_open_24 = Curve([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])
total_wall_23 = Panel("15")
total_win_23 = Panel("13")
terrasse_m2_4 = Panel("10.8")
crv_133 = Curve(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)
crv_134 = Curve([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])
crv_135 = Curve([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])
crv_136 = Curve([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])
crv_137 = Curve([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])
total_wall_24 = Panel("16")
total_win_24 = Panel("14")
terrasse_m2_5 = Panel("10.8")
crv_138 = Curve(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)
crv_139 = Curve(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)
crv_140 = Curve([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])
crv_141 = Curve([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])
crv_142 = Curve([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])
crv_143 = Curve([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])
interior_wall_length_23 = Panel("24.9")
honeyb_close_25 = Curve([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])
honeyb_close_26 = Curve([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])
honeyb_open_25 = Curve([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])
honeyb_open_26 = Curve([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])
total_wall_25 = Panel("15")
total_win_25 = Panel("13")
terrasse_m2_6 = Panel("9.5")
crv_144 = Curve(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)
crv_145 = Curve(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)
crv_146 = Curve([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])
crv_147 = Curve([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])
crv_148 = Curve([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])
crv_149 = Curve([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])
interior_wall_length_24 = Panel("24.9")
crv_150 = Curve(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)
total_wall_26 = Panel("13")
total_win_26 = Panel("13")
terrasse_m2_7 = Panel("9.5")
interior_wall_length_25 = Panel("19.1")
# 16
crv_151 = Curve(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)
crv_152 = Curve([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])
crv_153 = Curve([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])
crv_154 = Curve([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])
crv_155 = Curve([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])
honeyb_close_27 = Curve([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])
honeyb_open_27 = Curve([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])
crv_156 = Curve(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)
total_wall_27 = Panel("16")
total_win_27 = Panel("13")
terrasse_m2_8 = Panel("24")
interior_wall_length_26 = Panel("24.9")
crv_157 = Curve(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)
crv_158 = Curve([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])
crv_159 = Curve([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])
crv_160 = Curve([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])
crv_161 = Curve([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])
honeyb_close_28 = Curve([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])
honeyb_open_28 = Curve([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])
honeyb_close_29 = Curve([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])
honeyb_open_29 = Curve([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])
honeyb_close_30 = Curve([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])
total_wall_28 = Panel("14")
total_win_28 = Panel("22")
honeyb_open_30 = Curve([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])
crv_162 = Curve([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])
crv_163 = Curve([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])
crv_164 = Curve([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])
crv_165 = Curve([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])
total_wall_29 = Panel("17")
total_win_29 = Panel("14")
terrasse_m2_9 = Panel("24")
crv_166 = Curve(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)
crv_167 = Curve(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)
crv_168 = Curve([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])
crv_169 = Curve([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])
crv_170 = Curve([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])
crv_171 = Curve([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])
interior_wall_length_27 = Panel("45.3")
crv_172 = Curve(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)
interior_wall_length_28 = Panel("24.9")
crv_173 = Curve(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)
crv_174 = Curve(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)
interior_wall_length_29 = Panel("27")
total_wall_30 = Panel("15")
total_win_30 = Panel("15")
terrasse_m2_10 = Panel("9.5")
# 21
crv_175 = Curve(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)
crv_176 = Curve([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])
crv_177 = Curve([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])
crv_178 = Curve([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])
crv_179 = Curve([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])
crv_180 = Curve(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)
honeyb_close_31 = Curve([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])
honeyb_open_31 = Curve([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])
crv_181 = Curve([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])
crv_182 = Curve([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])
crv_183 = Curve([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])
crv_184 = Curve([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])
honeyb_close_32 = Curve([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])
crv_185 = Curve(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)
honeyb_open_32 = Curve([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])
total_wall_31 = Panel("16")
total_win_31 = Panel("15")
terrasse_m2_11 = Panel("25.5")
honeyb_close_33 = Curve([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])
interior_wall_length_30 = Panel("27")
honeyb_close_34 = Curve([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])
honeyb_open_33 = Curve([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])
honeyb_open_34 = Curve([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])
crv_186 = Curve(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)
crv_187 = Curve(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)
total_wall_32 = Panel("15")
total_win_32 = Panel("22")
terrasse_m2_12 = Panel("17")
crv_188 = Curve([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])
crv_189 = Curve([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])
crv_190 = Curve([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])
crv_191 = Curve(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)
crv_192 = Curve([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])
interior_wall_length_31 = Panel("46.5")
total_win_33 = Panel("16")
terrasse_m2_13 = Panel("26")
total_wall_33 = Panel("16")
crv_193 = Curve(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)
crv_194 = Curve([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])
crv_195 = Curve([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])
crv_196 = Curve([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])
crv_197 = Curve([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])
interior_wall_length_32 = Panel("45.3")
crv_198 = Curve(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)
total_wall_34 = Panel("14")
total_win_34 = Panel("23")
terrasse_m2_14 = Panel("16.8")
interior_wall_length_33 = Panel("26.5")
crv_199 = Curve([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])
crv_200 = Curve([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])
crv_201 = Curve([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])
crv_202 = Curve([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])
crv_203 = Curve(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)
honeyb_close_35 = Curve([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])
honeyb_open_35 = Curve([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])
crv_204 = Curve(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)
total_wall_35 = Panel("14")
total_win_35 = Panel("22")
crv_205 = Curve(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)
crv_206 = Curve([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])
crv_207 = Curve([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])
crv_208 = Curve([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])
crv_209 = Curve([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])
interior_wall_length_34 = Panel("45.3")
honeyb_close_36 = Curve([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])
honeyb_close_37 = Curve([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])
honeyb_open_36 = Curve([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])
honeyb_open_37 = Curve([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])
honeyb_close_38 = Curve([<curve referenced from the Rhino model> x6])
honeyb_open_38 = Curve([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])
crv_210 = Curve(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)
total_wall_36 = Panel("16")
total_win_36 = Panel("22")
terrasse_m2_15 = Panel("29.5")
crv_211 = Curve(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)
crv_212 = Curve([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])
crv_213 = Curve([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])
crv_214 = Curve([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])
crv_215 = Curve([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])
crv_216 = Curve(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)
crv_217 = Curve([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])
total_wall_37 = Panel("15")
total_win_37 = Panel("22")
terrasse_m2_16 = Panel("15")
interior_wall_length_35 = Panel("45.3")
crv_218 = Curve([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])
crv_219 = Curve([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])
crv_220 = Curve(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)
crv_221 = Curve([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])
crv_222 = Curve(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)
interior_wall_length_36 = Panel("46.5")
honeyb_close_39 = Curve([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])
honeyb_open_39 = Curve([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])
interior_wall_length_37 = Panel("45.3")
total_wall_38 = Panel("17")
total_win_38 = Panel("23")
terrasse_m2_17 = Panel("32.4")
crv_223 = Curve([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])
crv_224 = Curve([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])
crv_225 = Curve([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])
crv_226 = Curve(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)
crv_227 = Curve([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])
crv_228 = Curve(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)
interior_wall_length_38 = Panel("47.7")
total_wall_39 = Panel("17")
total_win_39 = Panel("24")
crv_229 = Curve([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])
crv_230 = Curve([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])
crv_231 = Curve([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])
crv_232 = Curve([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])
crv_233 = Curve(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)
honeyb_close_40 = Curve([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])
honeyb_close_41 = Curve([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])
honeyb_open_40 = Curve([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])
honeyb_open_41 = Curve([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])
crv_234 = Curve(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)
honeyb_close_42 = Curve([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])
honeyb_open_42 = Curve([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])
total_wall_40 = Panel("15")
total_win_40 = Panel("25")
terrasse_m2_18 = Panel("33.5")
crv_235 = Curve(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)
crv_236 = Curve([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])
crv_237 = Curve([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])
crv_238 = Curve([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])
crv_239 = Curve([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])
crv_240 = Curve(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)
total_wall_41 = Panel("14")
total_win_41 = Panel("23")
terrasse_m2_19 = Panel("16.5")
total_wall_42 = Panel("29")
total_win_42 = Panel("15")
crv_241 = Curve([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])
crv_242 = Curve([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])
crv_243 = Curve([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])
crv_244 = Curve([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])
crv_245 = Curve(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)
crv_246 = Curve(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)
interior_wall_length_39 = Panel("46.5")
crv_247 = Curve([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])
crv_248 = Curve([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])
crv_249 = Curve([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])
crv_250 = Curve(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)
crv_251 = Curve([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])
interior_wall_length_40 = Panel("46.5")
interior_wall_length_41 = Panel("77.6")
honeyb_close_43 = Curve([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])
crv_252 = Curve(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)
honeyb_open_43 = Curve([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])
total_wall_43 = Panel("28")
total_win_43 = Panel("18")
terrasse_m2_20 = Panel("35")
interior_wall_length_42 = Panel("78.8")
crv_253 = Curve([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])
crv_254 = Curve([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])
crv_255 = Curve([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])
crv_256 = Curve([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])
crv_257 = Curve(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)
honeyb_close_44 = Curve([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])
honeyb_open_44 = Curve([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])
honeyb_close_45 = Curve([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])
total_wall_44 = Panel("16")
total_win_44 = Panel("26")
terrasse_m2_21 = Panel("36.5")
crv_258 = Curve(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)
honeyb_open_45 = Curve([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])
crv_259 = Curve([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])
crv_260 = Curve([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])
crv_261 = Curve([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])
crv_262 = Curve([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])
crv_263 = Curve(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)
interior_wall_length_43 = Panel("47.7")
crv_264 = Curve(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)
crv_265 = Curve([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])
total_wall_45 = Panel("28")
total_win_45 = Panel("16")
crv_266 = Curve([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])
crv_267 = Curve([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])
crv_268 = Curve(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)
crv_269 = Curve([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])
interior_wall_length_44 = Panel("78.8")
honeyb_close_46 = Curve([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])
honeyb_open_46 = Curve([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])
total_wall_46 = Panel("28")
total_win_46 = Panel("20")
crv_270 = Curve(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)
crv_271 = Curve([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])
crv_272 = Curve([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])
crv_273 = Curve([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])
crv_274 = Curve([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])
crv_275 = Curve(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)
interior_wall_length_45 = Panel("81.2")
gate = ClusterInput()
stream_filter = StreamFilter(
    Gate=gate,
    Stream1=interior_wall_length_4,
    Stream2=interior_wall_length,
    Stream3=interior_wall_length_7,
    Stream4=interior_wall_length_12,
    Stream5=interior_wall_length_16,
    Stream6=interior_wall_length_3,
    Stream7=interior_wall_length_6,
    Stream8=interior_wall_length_8,
    Stream9=interior_wall_length_13,
    Stream10=interior_wall_length_21,
    Stream11=interior_wall_length_2,
    Stream12=interior_wall_length_5,
    Stream13=interior_wall_length_10,
    Stream14=interior_wall_length_14,
    Stream15=interior_wall_length_20,
    Stream16=interior_wall_length_25,
    Stream17=interior_wall_length_9,
    Stream18=interior_wall_length_15,
    Stream19=interior_wall_length_19,
    Stream20=interior_wall_length_24,
    Stream21=interior_wall_length_29,
    Stream22=interior_wall_length_11,
    Stream23=interior_wall_length_17,
    Stream24=interior_wall_length_22,
    Stream25=interior_wall_length_26,
    Stream26=interior_wall_length_30,
    Stream27=interior_wall_length_34,
    Stream28=interior_wall_length_18,
    Stream29=interior_wall_length_23,
    Stream30=interior_wall_length_28,
    Stream31=interior_wall_length_33,
    Stream32=interior_wall_length_37,
    Stream33=interior_wall_length_40,
    Stream34=interior_wall_length_27,
    Stream35=interior_wall_length_32,
    Stream36=interior_wall_length_35,
    Stream37=interior_wall_length_39,
    Stream38=interior_wall_length_43,
    Stream39=interior_wall_length_31,
    Stream40=interior_wall_length_36,
    Stream41=interior_wall_length_41,
    Stream42=interior_wall_length_44,
    Stream43=interior_wall_length_38,
    Stream44=interior_wall_length_42,
    Stream45=interior_wall_length_45)
s_41 = ClusterOutput(stream_filter)
G = ClusterInput()
G_2 = ClusterInput()
G_3 = ClusterInput()
G_4 = ClusterInput()
G_5 = ClusterInput()
gate_2 = ClusterInput()
gate_3 = ClusterInput()
gate_4 = ClusterInput()
gate_5 = ClusterInput()
gate_6 = ClusterInput()
G_6 = ClusterInput()
G_7 = ClusterInput()
G_8 = ClusterInput()
G_9 = ClusterInput()
G_10 = ClusterInput()
filter = StreamFilter(
    Gate=G,
    Stream0=crv_3,
    Stream1=crv_31,
    Stream2=crv_10,
    Stream3=crv_47,
    Stream4=crv_73,
    Stream5=crv_99,
    Stream6=crv_17,
    Stream7=crv_29,
    Stream8=crv_50,
    Stream9=crv_81,
    Stream10=crv_118,
    Stream11=crv_20,
    Stream12=crv_38,
    Stream13=crv_57,
    Stream14=crv_86,
    Stream15=crv_121,
    Stream16=crv_154,
    Stream17=crv_62,
    Stream18=crv_96,
    Stream19=crv_130,
    Stream20=crv_147,
    Stream21=crv_178,
    Stream22=crv_69,
    Stream23=crv_106,
    Stream24=crv_135,
    Stream25=crv_160,
    Stream26=crv_182,
    Stream27=crv_207,
    Stream28=crv_111,
    Stream29=crv_140,
    Stream30=crv_168,
    Stream31=crv_194,
    Stream32=crv_217,
    Stream33=crv_241,
    Stream34=crv_162,
    Stream35=crv_188,
    Stream36=crv_212,
    Stream37=crv_236,
    Stream38=crv_261,
    Stream39=crv_201,
    Stream40=crv_225,
    Stream41=crv_248,
    Stream42=crv_266,
    Stream43=crv_230,
    Stream44=crv_254,
    Stream45=crv_272)
filter_2 = StreamFilter(
    Gate=G_2,
    Stream0=crv_4,
    Stream1=crv_32,
    Stream2=crv_11,
    Stream3=crv_45,
    Stream4=crv_74,
    Stream5=crv_100,
    Stream6=crv_18,
    Stream7=crv_30,
    Stream8=crv_53,
    Stream9=crv_83,
    Stream10=crv_119,
    Stream11=crv_21,
    Stream12=crv_39,
    Stream13=crv_58,
    Stream14=crv_87,
    Stream15=crv_122,
    Stream16=crv_155,
    Stream17=crv_63,
    Stream18=crv_93,
    Stream19=crv_127,
    Stream20=crv_148,
    Stream21=crv_179,
    Stream22=crv_71,
    Stream23=crv_104,
    Stream24=crv_136,
    Stream25=crv_161,
    Stream26=crv_183,
    Stream27=crv_208,
    Stream28=crv_113,
    Stream29=crv_143,
    Stream30=crv_171,
    Stream31=crv_197,
    Stream32=crv_219,
    Stream33=crv_244,
    Stream34=crv_163,
    Stream35=crv_189,
    Stream36=crv_213,
    Stream37=crv_237,
    Stream38=crv_262,
    Stream39=crv_202,
    Stream40=crv_223,
    Stream41=crv_249,
    Stream42=crv_267,
    Stream43=crv_231,
    Stream44=crv_255,
    Stream45=crv_274)
boundary = StreamFilter(
    Gate=G_3,
    Stream0=crv_5,
    Stream1=crv_36,
    Stream2=crv_7,
    Stream3=crv_46,
    Stream4=crv_75,
    Stream5=crv_101,
    Stream6=crv_14,
    Stream7=crv_33,
    Stream8=crv_49,
    Stream9=crv_84,
    Stream10=crv_120,
    Stream11=crv_22,
    Stream12=crv_40,
    Stream13=crv_64,
    Stream14=crv_88,
    Stream15=crv_123,
    Stream16=crv_151,
    Stream17=crv_59,
    Stream18=crv_95,
    Stream19=crv_129,
    Stream20=crv_145,
    Stream21=crv_175,
    Stream22=crv_68,
    Stream23=crv_107,
    Stream24=crv_133,
    Stream25=crv_157,
    Stream26=crv_185,
    Stream27=crv_205,
    Stream28=crv_109,
    Stream29=crv_139,
    Stream30=crv_167,
    Stream31=crv_193,
    Stream32=crv_220,
    Stream33=crv_245,
    Stream34=crv_166,
    Stream35=crv_191,
    Stream36=crv_216,
    Stream37=crv_240,
    Stream38=crv_263,
    Stream39=crv_203,
    Stream40=crv_226,
    Stream41=crv_250,
    Stream42=crv_268,
    Stream43=crv_233,
    Stream44=crv_257,
    Stream45=crv_275)
boundary_2 = StreamFilter(
    Gate=G_4,
    Stream1=crv_34,
    Stream2=crv_8,
    Stream3=crv_43,
    Stream4=crv_76,
    Stream5=crv_98,
    Stream6=crv_15,
    Stream7=crv_27,
    Stream8=crv_51,
    Stream9=crv_80,
    Stream10=crv_116,
    Stream11=crv_19,
    Stream12=crv_37,
    Stream13=crv_65,
    Stream14=crv_89,
    Stream15=crv_124,
    Stream16=crv_152,
    Stream17=crv_60,
    Stream18=crv_92,
    Stream19=crv_126,
    Stream20=crv_146,
    Stream21=crv_176,
    Stream22=crv_70,
    Stream23=crv_103,
    Stream24=crv_134,
    Stream25=crv_158,
    Stream26=crv_181,
    Stream27=crv_206,
    Stream28=crv_110,
    Stream29=crv_141,
    Stream30=crv_169,
    Stream31=crv_195,
    Stream32=crv_218,
    Stream33=crv_242,
    Stream34=crv_164,
    Stream35=crv_190,
    Stream36=crv_214,
    Stream37=crv_238,
    Stream38=crv_259,
    Stream39=crv_199,
    Stream40=crv_224,
    Stream41=crv_247,
    Stream42=crv_265,
    Stream43=crv_229,
    Stream44=crv_253,
    Stream45=crv_271)
filter_3 = StreamFilter(
    Gate=G_5,
    Stream0=crv_6,
    Stream1=crv_35,
    Stream2=crv_9,
    Stream3=crv_44,
    Stream4=crv_77,
    Stream5=crv_97,
    Stream6=crv_16,
    Stream7=crv_28,
    Stream8=crv_52,
    Stream9=crv_82,
    Stream10=crv_117,
    Stream11=crv_23,
    Stream12=crv_41,
    Stream13=crv_56,
    Stream14=crv_90,
    Stream15=crv_125,
    Stream16=crv_153,
    Stream17=crv_61,
    Stream18=crv_94,
    Stream19=crv_128,
    Stream20=crv_149,
    Stream21=crv_177,
    Stream22=crv_72,
    Stream23=crv_105,
    Stream24=crv_137,
    Stream25=crv_159,
    Stream26=crv_184,
    Stream27=crv_209,
    Stream28=crv_112,
    Stream29=crv_142,
    Stream30=crv_170,
    Stream31=crv_196,
    Stream32=crv_221,
    Stream33=crv_243,
    Stream34=crv_165,
    Stream35=crv_192,
    Stream36=crv_215,
    Stream37=crv_239,
    Stream38=crv_260,
    Stream39=crv_200,
    Stream40=crv_227,
    Stream41=crv_251,
    Stream42=crv_269,
    Stream43=crv_232,
    Stream44=crv_256,
    Stream45=crv_273)
stream_filter_2 = StreamFilter(
    Gate=gate_2,
    Stream0=total_wall,
    Stream1=total_wall_5,
    Stream2=total_wall_2,
    Stream3=total_wall_8,
    Stream4=total_wall_13,
    Stream5=total_wall_16,
    Stream6=total_wall_3,
    Stream7=total_wall_7,
    Stream8=total_wall_9,
    Stream9=total_wall_14,
    Stream10=total_wall_21,
    Stream11=total_wall_4,
    Stream12=total_wall_6,
    Stream13=total_wall_10,
    Stream14=total_wall_15,
    Stream15=total_wall_22,
    Stream16=total_wall_26,
    Stream17=total_wall_11,
    Stream18=total_wall_17,
    Stream19=total_wall_20,
    Stream20=total_wall_25,
    Stream21=total_wall_30,
    Stream22=total_wall_12,
    Stream23=total_wall_18,
    Stream24=total_wall_23,
    Stream25=total_wall_27,
    Stream26=total_wall_31,
    Stream27=total_wall_35,
    Stream28=total_wall_19,
    Stream29=total_wall_24,
    Stream30=total_wall_29,
    Stream31=total_wall_33,
    Stream32=total_wall_37,
    Stream33=total_wall_41,
    Stream34=total_wall_28,
    Stream35=total_wall_32,
    Stream36=total_wall_36,
    Stream37=total_wall_40,
    Stream38=total_wall_44,
    Stream39=total_wall_34,
    Stream40=total_wall_38,
    Stream41=total_wall_42,
    Stream42=total_wall_45,
    Stream43=total_wall_39,
    Stream44=total_wall_43,
    Stream45=total_wall_46)
stream_filter_3 = StreamFilter(
    Gate=gate_3,
    Stream0=total_win,
    Stream1=total_win_5,
    Stream2=total_win_2,
    Stream3=total_win_8,
    Stream4=total_win_13,
    Stream5=total_win_16,
    Stream6=total_win_3,
    Stream7=total_win_7,
    Stream8=total_win_9,
    Stream9=total_win_14,
    Stream10=total_win_21,
    Stream11=total_win_4,
    Stream12=total_win_6,
    Stream13=total_win_10,
    Stream14=total_win_15,
    Stream15=total_win_22,
    Stream16=total_win_26,
    Stream17=total_win_11,
    Stream18=total_win_17,
    Stream19=total_win_20,
    Stream20=total_win_25,
    Stream21=total_win_30,
    Stream22=total_win_12,
    Stream23=total_win_18,
    Stream24=total_win_23,
    Stream25=total_win_27,
    Stream26=total_win_31,
    Stream27=total_win_35,
    Stream28=total_win_19,
    Stream29=total_win_24,
    Stream30=total_win_29,
    Stream31=total_win_33,
    Stream32=total_win_37,
    Stream33=total_win_41,
    Stream34=total_win_28,
    Stream35=total_win_32,
    Stream36=total_win_36,
    Stream37=total_win_40,
    Stream38=total_win_44,
    Stream39=total_win_34,
    Stream40=total_win_38,
    Stream41=total_win_42,
    Stream42=total_win_45,
    Stream43=total_win_39,
    Stream44=total_win_43,
    Stream45=total_win_46)
stream_filter_4 = StreamFilter(
    Gate=gate_4,
    Stream16=terrasse_m2_7,
    Stream20=terrasse_m2_6,
    Stream21=terrasse_m2_10,
    Stream22=terrasse_m2,
    Stream23=terrasse_m2_2,
    Stream24=terrasse_m2_4,
    Stream25=terrasse_m2_8,
    Stream26=terrasse_m2_11,
    Stream28=terrasse_m2_3,
    Stream29=terrasse_m2_5,
    Stream30=terrasse_m2_9,
    Stream31=terrasse_m2_13,
    Stream32=terrasse_m2_16,
    Stream33=terrasse_m2_19,
    Stream35=terrasse_m2_12,
    Stream36=terrasse_m2_15,
    Stream37=terrasse_m2_18,
    Stream38=terrasse_m2_21,
    Stream39=terrasse_m2_14,
    Stream40=terrasse_m2_17,
    Stream44=terrasse_m2_20)
stream_filter_5 = StreamFilter(
    Gate=gate_5,
    Stream0=honeyb_open_2,
    Stream1=honeyb_open_8,
    Stream2=honeyb_open_3,
    Stream3=honeyb_open_7,
    Stream4=honeyb_open_13,
    Stream5=honeyb_open_16,
    Stream6=honeyb_open,
    Stream7=honeyb_open_6,
    Stream8=honeyb_open_9,
    Stream9=honeyb_open_14,
    Stream10=honeyb_open_22,
    Stream11=honeyb_open_4,
    Stream12=honeyb_open_5,
    Stream13=honeyb_open_12,
    Stream14=honeyb_open_17,
    Stream15=honeyb_open_20,
    Stream16=honeyb_open_26,
    Stream17=honeyb_open_10,
    Stream18=honeyb_open_15,
    Stream19=honeyb_open_21,
    Stream20=honeyb_open_25,
    Stream21=honeyb_open_30,
    Stream22=honeyb_open_11,
    Stream23=honeyb_open_18,
    Stream24=honeyb_open_23,
    Stream25=honeyb_open_27,
    Stream26=honeyb_open_31,
    Stream27=honeyb_open_35,
    Stream28=honeyb_open_19,
    Stream29=honeyb_open_24,
    Stream30=honeyb_open_29,
    Stream31=honeyb_open_34,
    Stream32=honeyb_open_37,
    Stream33=honeyb_open_42,
    Stream34=honeyb_open_28,
    Stream35=honeyb_open_33,
    Stream36=honeyb_open_36,
    Stream37=honeyb_open_41,
    Stream38=honeyb_open_44,
    Stream39=honeyb_open_32,
    Stream40=honeyb_open_38,
    Stream41=honeyb_open_40,
    Stream42=honeyb_open_45,
    Stream43=honeyb_open_39,
    Stream44=honeyb_open_43,
    Stream45=honeyb_open_46)
stream_filter_6 = StreamFilter(
    Gate=gate_6,
    Stream0=honeyb_close_2,
    Stream1=honeyb_close_8,
    Stream2=honeyb_close_4,
    Stream3=honeyb_close_7,
    Stream4=honeyb_close_13,
    Stream5=honeyb_close_16,
    Stream6=honeyb_close,
    Stream7=honeyb_close_6,
    Stream8=honeyb_close_9,
    Stream9=honeyb_close_14,
    Stream10=honeyb_close_22,
    Stream11=honeyb_close_3,
    Stream12=honeyb_close_5,
    Stream13=honeyb_close_12,
    Stream14=honeyb_close_17,
    Stream15=honeyb_close_20,
    Stream16=honeyb_close_26,
    Stream17=honeyb_close_10,
    Stream18=honeyb_close_15,
    Stream19=honeyb_close_21,
    Stream20=honeyb_close_25,
    Stream21=honeyb_close_30,
    Stream22=honeyb_close_11,
    Stream23=honeyb_close_18,
    Stream24=honeyb_close_23,
    Stream25=honeyb_close_27,
    Stream26=honeyb_close_31,
    Stream27=honeyb_close_35,
    Stream28=honeyb_close_19,
    Stream29=honeyb_close_24,
    Stream30=honeyb_close_29,
    Stream31=honeyb_close_34,
    Stream32=honeyb_close_37,
    Stream33=honeyb_close_42,
    Stream34=honeyb_close_28,
    Stream35=honeyb_close_33,
    Stream36=honeyb_close_36,
    Stream37=honeyb_close_41,
    Stream38=honeyb_close_44,
    Stream39=honeyb_close_32,
    Stream40=honeyb_close_38,
    Stream41=honeyb_close_40,
    Stream42=honeyb_close_45,
    Stream43=honeyb_close_39,
    Stream44=honeyb_close_43,
    Stream45=honeyb_close_46)
filter_4 = StreamFilter(
    Gate=G_6,
    Stream0=crv,
    Stream1=crv_25,
    Stream2=crv_2,
    Stream3=crv_42,
    Stream4=crv_67,
    Stream5=crv_91,
    Stream6=crv_12,
    Stream7=crv_26,
    Stream8=crv_48,
    Stream9=crv_79,
    Stream10=crv_114,
    Stream11=crv_13,
    Stream12=crv_24,
    Stream13=crv_54,
    Stream14=crv_78,
    Stream15=crv_115,
    Stream16=crv_150,
    Stream17=crv_66,
    Stream18=crv_85,
    Stream19=crv_131,
    Stream20=crv_144,
    Stream21=crv_174,
    Stream22=crv_55,
    Stream23=crv_102,
    Stream24=crv_132,
    Stream25=crv_156,
    Stream26=crv_180,
    Stream28=crv_108,
    Stream29=crv_138,
    Stream30=crv_172,
    Stream31=crv_187)
filter_5 = StreamFilter(Gate=G_7, Stream27=crv_204, Stream32=crv_211, Stream33=crv_235, Stream37=crv_246, Stream38=crv_258)
filter_6 = StreamFilter(Gate=G_8, Stream41=crv_234, Stream42=crv_264, Stream44=crv_252)
filter_7 = StreamFilter(Gate=G_9, Stream34=crv_173, Stream35=crv_198, Stream36=crv_222, Stream39=crv_186, Stream40=crv_210, Stream43=crv_228)
filter_8 = StreamFilter(Gate=G_10, Stream45=crv_270)
s_41_2 = ClusterOutput(filter)
s_41_3 = ClusterOutput(filter_2)
s_41_4 = ClusterOutput(boundary)
s_41_5 = ClusterOutput(boundary_2)
s_41_6 = ClusterOutput(filter_3)
s_41_7 = ClusterOutput(stream_filter_2)
s_41_8 = ClusterOutput(stream_filter_3)
s_41_9 = ClusterOutput(stream_filter_4)
s_41_10 = ClusterOutput(stream_filter_5)
s_41_11 = ClusterOutput(stream_filter_6)
s_41_12 = ClusterOutput(filter_4)
s_41_13 = ClusterOutput(filter_5)
s_41_14 = ClusterOutput(filter_6)
s_41_15 = ClusterOutput(filter_7)
s_41_16 = ClusterOutput(filter_8)

# ==== cluster Cluster_4
d1 = ClusterInput()
d2 = ClusterInput()
merge = Merge(Data1=d1, Data2=d2)
item = ListItem(List=merge, Index=0, Wrap=True)
L = ClusterInput()
Z = UnitZ(Factor="2.44")
item_2 = ListItem(List=L, Index=0, Wrap=True)  # -> Item, Item1, Item2, Item3
explode = Explode(Curve=item, Recursive=True)  # -> Segments, Vertices
item_3 = ListItem(List=explode.Vertices, Index=3, Wrap=True)
vec2pt = Vector2Pt(PointA=item_3, PointB=item_2.Item, Unitize=False)  # -> Vector, Length
G = ClusterInput()
hb_o = ClusterInput()
hb_c = ClusterInput()
G_2 = ClusterInput()
G_3 = ClusterInput()
G_4 = ClusterInput()
G_5 = ClusterInput()
G_6 = ClusterInput()
G_7 = ClusterInput()
G_8 = ClusterInput()
move = Move(Geometry=merge, Motion=vec2pt.Vector)  # -> Geometry, Transform
move_2 = Move(Geometry=G, Motion=vec2pt.Vector)  # -> Geometry, Transform
move_3 = Move(Geometry=G_2, Motion=vec2pt.Vector)  # -> Geometry, Transform
move_4 = Move(Geometry=hb_o, Motion=vec2pt.Vector)  # -> Geometry, Transform
move_5 = Move(Geometry=G_3, Motion=vec2pt.Vector)  # -> Geometry, Transform
move_6 = Move(Geometry=hb_c, Motion=vec2pt.Vector)  # -> Geometry, Transform
move_7 = Move(Geometry=G_4, Motion=vec2pt.Vector)  # -> Geometry, Transform
move_8 = Move(Geometry=G_5, Motion=vec2pt.Vector)  # -> Geometry, Transform
move_9 = Move(Geometry=G_6, Motion=vec2pt.Vector)  # -> Geometry, Transform
move_10 = Move(Geometry=G_7, Motion=vec2pt.Vector)  # -> Geometry, Transform
move_11 = Move(Geometry=G_8, Motion=vec2pt.Vector)  # -> Geometry, Transform
item_4 = ListItem(List=move.Geometry, Index=0, Wrap=True)
area = Area(Geometry=item_4)  # -> Area, Centroid
explode_2 = Explode(Curve=item_4, Recursive=True)  # -> Segments, Vertices
crv_cp = CurveClosestPoint(Point=area.Centroid, Curve=explode_2.Segments)  # -> Point, Parameter, Distance
A = ClusterInput()
B = ClusterInput()
item_5 = ListItem(List=crv_cp.Point, Index=0, Wrap=True)  # -> Item, Item1, Item2, Item3
vec2pt_2 = Vector2Pt(PointA=A, PointB=B, Unitize=False)  # -> Vector, Length
vec2pt_3 = Vector2Pt(PointA=area.Centroid, PointB=item_5.Item3, Unitize=False)  # -> Vector, Length
angle = Angle(VectorA=vec2pt_2.Vector, VectorB=vec2pt_3.Vector)  # -> Angle, Reflex
rotate = Rotate(Geometry=move.Geometry, Angle=angle.Angle, Plane=area.Centroid)  # -> Geometry, Transform

rotate_2 = Rotate(Geometry=move_7.Geometry, Angle=angle.Angle, Plane=area.Centroid)  # -> Geometry, Transform
rotate_3 = Rotate(Geometry=move_8.Geometry, Angle=angle.Angle, Plane=area.Centroid)  # -> Geometry, Transform
rotate_4 = Rotate(Geometry=move_9.Geometry, Angle=angle.Angle, Plane=area.Centroid)  # -> Geometry, Transform
rotate_5 = Rotate(Geometry=move_10.Geometry, Angle=angle.Angle, Plane=area.Centroid)  # -> Geometry, Transform
rotate_6 = Rotate(Geometry=move_11.Geometry, Angle=angle.Angle, Plane=area.Centroid)  # -> Geometry, Transform
area_2 = Area(Geometry=move_7.Geometry)  # -> Area, Centroid
area_3 = Area(Geometry=move_8.Geometry)  # -> Area, Centroid
area_4 = Area(Geometry=move_9.Geometry)  # -> Area, Centroid
area_5 = Area(Geometry=move_10.Geometry)  # -> Area, Centroid
area_6 = Area(Geometry=move_11.Geometry)  # -> Area, Centroid
scale = Scale(Geometry=rotate_2.Geometry, Center=area_2.Centroid, Factor="1.01")  # -> Geometry, Transform
scale_2 = Scale(Geometry=rotate_3.Geometry, Center=area_3.Centroid, Factor="1.01")  # -> Geometry, Transform
scale_3 = Scale(Geometry=rotate_4.Geometry, Center=area_4.Centroid, Factor="1.01")  # -> Geometry, Transform
scale_4 = Scale(Geometry=rotate_5.Geometry, Center=area_5.Centroid, Factor="1.01")  # -> Geometry, Transform
scale_5 = Scale(Geometry=rotate_6.Geometry, Center=area_6.Centroid, Factor="1.01")  # -> Geometry, Transform
explode_3 = Explode(Curve=scale.Geometry, Recursive=True)  # -> Segments, Vertices
explode_4 = Explode(Curve=scale_2.Geometry, Recursive=True)  # -> Segments, Vertices
explode_5 = Explode(Curve=scale_3.Geometry, Recursive=True)  # -> Segments, Vertices
explode_6 = Explode(Curve=scale_4.Geometry, Recursive=True)  # -> Segments, Vertices
explode_7 = Explode(Curve=scale_5.Geometry, Recursive=True)  # -> Segments, Vertices
item_6 = ListItem(List=explode_3.Vertices, Index=0, Wrap=True)  # -> Item, Item1, Item2, Item3, Item4, Item5, Item6
item_7 = ListItem(List=explode_5.Vertices, Index=0, Wrap=True)  # -> Item, Item1, Item2, Item3, Item4, Item5, Item6
item_8 = ListItem(List=explode_6.Vertices, Index=0, Wrap=True)  # -> Item, Item1, Item2, Item3, Item4, Item5, Item6
item_9 = ListItem(List=explode_4.Vertices, Index=0, Wrap=True)  # -> Item, Item1, Item2, Item3, Item4, Item5, Item6
item_10 = ListItem(List=explode_7.Vertices, Index=0, Wrap=True)  # -> Item, Item1, Item2, Item3
dist = Distance(PointA=item_6.Item1, PointB=item_6.Item4)
item_11 = ListItem(List=rotate.Geometry, Index=0, Wrap=True)
dist_2 = Distance(PointA=item_9.Item1, PointB=item_9.Item4)
dist_3 = Distance(PointA=item_7.Item1, PointB=item_7.Item4)
dist_4 = Distance(PointA=item_8.Item1, PointB=item_8.Item4)
dist_5 = Distance(PointA=item_10.Item1, PointB=item_10.Item3)
division = Division(A=dist, B="12")
addition = Addition(A="3.2", B=division)
division_2 = Division(A=dist_4, B="12")
Z_2 = UnitZ(Factor="2.44")
division_3 = Division(A=dist_5, B="12")
move_12 = Move(Geometry=item_11, Motion=Z)  # -> Geometry, Transform
division_4 = Division(A=dist_2, B="12")
division_5 = Division(A=dist_3, B="12")
addition_2 = Addition(A="2.5", B=division_4)
addition_3 = Addition(A="2.5", B=division_5)
addition_4 = Addition(A="2.5", B=division_2)
Z_3 = UnitZ(Factor="3.2")
addition_5 = Addition(A="2.5", B=division_3)
area_7 = Area(Geometry=move_12.Geometry)  # -> Area, Centroid
Z_4 = UnitZ(Factor="2.44")
Z_5 = UnitZ(Factor="2.6")
Z_6 = UnitZ(Factor=addition_3)
Z_7 = UnitZ(Factor="2.44")
Z_8 = UnitZ(Factor=addition_2)
Z_9 = UnitZ(Factor=addition_4)
Z_10 = UnitZ(Factor=addition_5)
Z_11 = UnitZ(Factor="2.6")
scale_6 = Scale(Geometry=move_12.Geometry, Center=area_7.Centroid, Factor="1.01")  # -> Geometry, Transform
move_13 = Move(Geometry=item_9.Item1, Motion=Z_8)  # -> Geometry, Transform
move_14 = Move(Geometry=item_7.Item1, Motion=Z_4)  # -> Geometry, Transform
move_15 = Move(Geometry=item_9.Item5, Motion=Z_5)  # -> Geometry, Transform
move_16 = Move(Geometry=item_9.Item2, Motion=Z_5)  # -> Geometry, Transform
move_17 = Move(Geometry=item_6.Item1, Motion=Z_3)  # -> Geometry, Transform
move_18 = Move(Geometry=item_9.Item3, Motion=Z_5)  # -> Geometry, Transform
move_19 = Move(Geometry=item_6.Item3, Motion=Z_3)  # -> Geometry, Transform
move_20 = Move(Geometry=item_7.Item2, Motion=Z_6)  # -> Geometry, Transform
move_21 = Move(Geometry=item_7.Item5, Motion=Z_4)  # -> Geometry, Transform
move_22 = Move(Geometry=item_6.Item2, Motion=Z_2)  # -> Geometry, Transform
move_23 = Move(Geometry=item_6.Item4, Motion=Z_2)  # -> Geometry, Transform
move_24 = Move(Geometry=item_6.Item6, Motion=Z_2)  # -> Geometry, Transform
move_25 = Move(Geometry=item_9.Item4, Motion=Z_5)  # -> Geometry, Transform
move_26 = Move(Geometry=item_6.Item, Motion=Z_2)  # -> Geometry, Transform
move_27 = Move(Geometry=item_9.Item, Motion=Z_5)  # -> Geometry, Transform
move_28 = Move(Geometry=item_7.Item, Motion=Z_4)  # -> Geometry, Transform
move_29 = Move(Geometry=item_6.Item5, Motion=Z_3)  # -> Geometry, Transform
move_30 = Move(Geometry=item_7.Item3, Motion=Z_4)  # -> Geometry, Transform
move_31 = Move(Geometry=item_7.Item4, Motion=Z_4)  # -> Geometry, Transform
move_32 = Move(Geometry=item_10.Item, Motion=Z_11)  # -> Geometry, Transform
move_33 = Move(Geometry=item_10.Item1, Motion=Z_10)  # -> Geometry, Transform
move_34 = Move(Geometry=item_10.Item3, Motion=Z_11)  # -> Geometry, Transform
move_35 = Move(Geometry=item_10.Item2, Motion=Z_11)  # -> Geometry, Transform
move_36 = Move(Geometry=item_8.Item4, Motion=Z_9)  # -> Geometry, Transform
move_37 = Move(Geometry=item_8.Item1, Motion=Z_9)  # -> Geometry, Transform
move_38 = Move(Geometry=item_8.Item2, Motion=Z_7)  # -> Geometry, Transform
move_39 = Move(Geometry=item_8.Item3, Motion=Z_7)  # -> Geometry, Transform
move_40 = Move(Geometry=item_8.Item, Motion=Z_7)  # -> Geometry, Transform
move_41 = Move(Geometry=item_8.Item5, Motion=Z_7)  # -> Geometry, Transform
srf4pt = _4PointSurface(CornerA=move_33.Geometry, CornerB=move_34.Geometry, CornerC=move_35.Geometry)
srf4pt_2 = _4PointSurface(CornerA=move_33.Geometry, CornerB=move_34.Geometry, CornerC=move_32.Geometry)
srf4pt_3 = _4PointSurface(CornerA=move_29.Geometry, CornerB=move_23.Geometry, CornerC=move_19.Geometry)
srf4pt_4 = _4PointSurface(CornerA=move_22.Geometry, CornerB=move_17.Geometry, CornerC=move_19.Geometry)
srf4pt_5 = _4PointSurface(CornerA=move_29.Geometry, CornerB=move_17.Geometry, CornerC=move_19.Geometry)
srf4pt_6 = _4PointSurface(CornerA=move_29.Geometry, CornerB=move_17.Geometry, CornerC=move_26.Geometry, CornerD=move_24.Geometry)
srf4pt_7 = _4PointSurface(CornerA=move_13.Geometry, CornerB=move_27.Geometry, CornerC=move_15.Geometry)
srf4pt_8 = _4PointSurface(CornerA=move_20.Geometry, CornerB=move_21.Geometry, CornerC=move_28.Geometry)
srf4pt_9 = _4PointSurface(CornerA=move_13.Geometry, CornerB=move_18.Geometry, CornerC=move_25.Geometry)
srf4pt_10 = _4PointSurface(CornerA=move_20.Geometry, CornerB=move_31.Geometry, CornerC=move_21.Geometry)
srf4pt_11 = _4PointSurface(CornerA=move_13.Geometry, CornerB=move_18.Geometry, CornerC=move_16.Geometry)
srf4pt_12 = _4PointSurface(CornerA=move_13.Geometry, CornerB=move_15.Geometry, CornerC=move_25.Geometry)
srf4pt_13 = _4PointSurface(CornerA=move_20.Geometry, CornerB=move_14.Geometry, CornerC=move_28.Geometry)
srf4pt_14 = _4PointSurface(CornerA=move_20.Geometry, CornerB=move_31.Geometry, CornerC=move_30.Geometry)
merge_2 = Merge(Data1=srf4pt_2, Data2=srf4pt)
srf4pt_15 = _4PointSurface(CornerA=move_37.Geometry, CornerB=move_36.Geometry, CornerC=move_41.Geometry, CornerD=move_40.Geometry)
srf4pt_16 = _4PointSurface(CornerA=move_37.Geometry, CornerB=move_38.Geometry, CornerC=move_40.Geometry)
srf4pt_17 = _4PointSurface(CornerA=move_36.Geometry, CornerB=move_41.Geometry, CornerC=move_39.Geometry)
srf4pt_18 = _4PointSurface(CornerA=move_37.Geometry, CornerB=move_36.Geometry, CornerC=move_39.Geometry, CornerD=move_38.Geometry)
Z_12 = UnitZ(Factor=".3")
merge_3 = Merge(Data1=srf4pt_7, Data2=srf4pt_11, Data3=srf4pt_9, Data4=srf4pt_12)
merge_4 = Merge(Data1=srf4pt_8, Data2=srf4pt_13, Data3=srf4pt_10, Data4=srf4pt_14)
extr = Extrude(Base=merge_2, Direction=Z_12)
merge_5 = Merge(Data1=srf4pt_5, Data2=srf4pt_6, Data3=srf4pt_3, Data4=srf4pt_4)
merge_6 = Merge(Data1=srf4pt_15, Data2=srf4pt_18)
sunion = SolidUnion(Breps=extr)
project = Project(Curve=scale_6.Geometry, Brep=merge_2, Direction=Vector(0, 0, 1))  # -> flatten(Curve)
extr_2 = Extrude(Base=merge_5, Direction=Z_12)
extr_3 = Extrude(Base=merge_3, Direction=Z_12)
extr_4 = Extrude(Base=merge_4, Direction=Z_12)
extr_5 = Extrude(Base=merge_6, Direction=Z_12)
project_2 = Project(Curve=scale_6.Geometry, Brep=merge_5, Direction=Vector(0, 0, 1))  # -> flatten(Curve)
join = JoinCurves(Curves=project, Preserve=False)
project_3 = Project(Curve=scale_6.Geometry, Brep=merge_3, Direction=Vector(0, 0, 1))  # -> flatten(Curve)
sunion_2 = SolidUnion(Breps=extr_3)
sunion_3 = SolidUnion(Breps=extr_4)
sunion_4 = SolidUnion(Breps=extr_5)
join_2 = JoinCurves(Curves=project_2, Preserve=False)
join_3 = JoinCurves(Curves=project_3, Preserve=False)
explode_8 = Explode(Curve=join, Recursive=True)  # -> Segments, Vertices
srf4pt_19 = _4PointSurface(CornerA=move_19.Geometry, CornerB=move_22.Geometry, CornerC=move_23.Geometry)
srf4pt_20 = _4PointSurface(CornerA=move_29.Geometry, CornerB=move_23.Geometry, CornerC=move_24.Geometry)
srf4pt_21 = _4PointSurface(CornerA=move_17.Geometry, CornerB=move_22.Geometry, CornerC=move_26.Geometry)
brep_cp = BrepClosestPoint(Point=explode_8.Vertices, Brep=sunion)  # -> Point, Normal, Distance
explode_9 = Explode(Curve=join_3, Recursive=True)  # -> Segments, Vertices
sunion_5 = SolidUnion(Breps=extr_2)
merge_7 = Merge(Data1=sunion_4, Data2=srf4pt_16, Data3=srf4pt_17)
brep_cp_2 = BrepClosestPoint(Point=explode_9.Vertices, Brep=sunion_2)  # -> Point, Normal, Distance
crv_cp_2 = CurveClosestPoint(Point=brep_cp.Point, Curve=scale_6.Geometry)  # -> Point, Parameter, Distance
merge_8 = Merge(Data1=sunion_5, Data2=srf4pt_19, Data3=srf4pt_20, Data4=srf4pt_21)
crv_cp_3 = CurveClosestPoint(Point=brep_cp_2.Point, Curve=scale_6.Geometry)  # -> Point, Parameter, Distance
intcrv = Interpolate(Vertices=explode_8.Vertices, Degree=0, Periodic=True, KnotStyle=1)  # -> simplify(Curve), Length, Domain
intcrv_2 = Interpolate(Vertices=crv_cp_2.Point, Degree=0, Periodic=True, KnotStyle=1)  # -> simplify(Curve), Length, Domain
loft = Loft(
    Curves=flatten([intcrv_2.Curve, intcrv.Curve]),
    Options={Adjust=False, Closed=False, LoftEnds=0, LoftSimp=0, LoftType=0, Rebuild=10, Refit=0.01})
intcrv_3 = Interpolate(Vertices=explode_9.Vertices, Degree=0, Periodic=False, KnotStyle=1)  # -> Curve, Length, Domain
intcrv_4 = Interpolate(Vertices=crv_cp_3.Point, Degree=0, Periodic=False, KnotStyle=1)  # -> Curve, Length, Domain
loft_2 = Loft(
    Curves=flatten([intcrv_4.Curve, intcrv_3.Curve]),
    Options={Adjust=False, Closed=False, LoftEnds=0, LoftSimp=0, LoftType=0, Rebuild=10, Refit=0.01})
srf4pt_22 = _4PointSurface(CornerA=move_20.Geometry, CornerB=move_14.Geometry, CornerC=move_30.Geometry)

rotate_7 = Rotate(Geometry=move_2.Geometry, Angle=angle.Angle, Plane=area.Centroid)  # -> Geometry, Transform
rotate_8 = Rotate(Geometry=move_3.Geometry, Angle=angle.Angle, Plane=area.Centroid)  # -> Geometry, Transform
rotate_9 = Rotate(Geometry=move_5.Geometry, Angle=angle.Angle, Plane=area.Centroid)  # -> Geometry, Transform
rotate_10 = Rotate(Geometry=move_4.Geometry, Angle=angle.Angle, Plane=area.Centroid)  # -> Geometry, Transform
rotate_11 = Rotate(Geometry=move_6.Geometry, Angle=angle.Angle, Plane=area.Centroid)  # -> Geometry, Transform
item_12 = ListItem(List=rotate.Geometry, Index=0, Wrap=True)
cull_i = CullIndex(List=rotate.Geometry, Indices=0, Wrap=True)
addition_6 = Addition(A="2.44", B="0.2")
boundary = BoundarySurfaces(Edges=item_12)
Z_13 = UnitZ(Factor="-.2")
Z_14 = UnitZ(Factor=addition_6)

# ---- group: Slab
extr_6 = Extrude(Base=boundary, Direction=Z_13)

# ---- group: Windows
extr_7 = Extrude(Base=rotate_8.Geometry, Direction=Z)

# ---- group: Roof
move_42 = Move(Geometry=extr_6, Motion=Z_14)  # -> Geometry, Transform

# ---- group: Profiles
extr_8 = Extrude(Base=rotate_9.Geometry, Direction=Z)

# ---- group: Facades
extr_9 = Extrude(Base=rotate_7.Geometry, Direction=Z)

# ---- group: Interior partitions
extr_10 = Extrude(Base=cull_i, Direction=Z)

# ----
slab = ClusterOutput(extr_6)
E = ClusterOutput(extr_7)
E_2 = ClusterOutput(extr_8)
hb_o_2 = ClusterOutput(rotate_10.Geometry)
hb_c_2 = ClusterOutput(rotate_11.Geometry)
G_9 = ClusterOutput(move_42.Geometry)
cap_holes = CapHoles(Brep=extr_10)
cap_holes_2 = CapHoles(Brep=extr_9)
brep = ClusterOutput(cap_holes)
brep_2 = ClusterOutput(cap_holes_2)

# ---- group: NEW ROOF
merge_9 = Merge(Data1=loft, Data2=sunion, Data3=loft_2, Data4=sunion_2, Data5=sunion_3, Data6=srf4pt_22, Data7=merge_8, Data8=merge_7)

# ----
R = ClusterOutput(merge_9)
